# Grasshopper definition HVACer.gh (Grasshopper 1.0.7)
# plug-ins: ClimateStudioGH

panel = Panel("SYSTEM TYPE")

climate_zone = ValueList({"1", "2", "3", "4", "5", "6"}, selected="2")
# TASK A - PERFORMANCE BASED DESIGN
# OVERVIEW: In this portion of the exercise, you will evaluate the performance of 4 different HVAC systems. Please follow the steps below to setup your model and initiate your simulation. You will then proceed to compare the systems based on first cost, operating cost, operating carbon, payback period, and space requirements.
weathersearch = SearchForWeather(
    Selection="C:\Users\airan\AppData\Roaming\Solemma\ClimateStudio\WeatherFiles\USA_AZ_Tucson.Intl.AP.722740_TMYx.2004-2018.epw",
    UnitSystem=4)

panel_2 = Panel("BASELINE VAV")

ground = Brep(<brep referenced from the Rhino model>)
bco = CSBoundaryObject(Brep=ground, type="GROUND")

thermal_zones = Brep([<brep referenced from the Rhino model> x21])
template = GetCSZoneTemplate(Selection="LargeOffice-5A")

# ----
# 2. DEFINE GEOMETRY AND TEMPLATES
# GEOMETRY
# SETTINGS
# STEP 2A: Select geometry associated with all your building thermal zones and define a template for the zones.
# STEP 2B: Select window geometry and apply relevant construction.
# STEP 2C: Select ground and define the boundary conditions.
# STEP 2D: Define exterior shading objects such as context.
shading = Surface([<surface referenced from the Rhino model> x3])

path = FilePath("C:\Users\airan\Desktop\Demo\")

# ----
# 3. INITIATE ENERGY AND SIZING SIMULATION
# STEP 3A: Define location for simulation output. Select a directory using the File Path component. Ensure the folder location has no spaces in the name.
step_3b = Panel("Run simulation.")
simulate = Button()
simulation_directory = Panel(path)

# ----
# 1. DEFINE LOCATION
# STEP 1: Define weather file and climate zone for your project site.
epw_directory = Panel(weathersearch)

panel_3 = Panel("VAV w/ ECONOMIZER")
panel_4 = Panel("VRF UNITS W/ DOAS")

branch_depth_m = Slider(0.6, range=0..10)
riser_aspect_ratio = Slider(1, range=1..4)

return_air_riser_offset_m = Slider(2.5, range=0..10)
alternate_return_air_riser_location = Slider(0, range=0..3)

terminal_distance_from_center = Slider(4.33, range=0..5)
length_of_diffuser_m = Slider(0.5, range=0..10)

duct_height_m = Slider(1.1, range=0..4)
duct_offset_m = Slider(1, range=0..10)

# ----
# 1. HVAC SPATIAL LAYOUT
# BASIC DESIGN PARAMETERS
# STEP 1A: Select your riser locations on the roof of your building. One riser minimum is needed.
# Define and reference points on the roof corresponding to your vertical risers. One minimum riser necessary.
# STEP 1B: Select your desired HVAC system.
# Select HVAC system.
# STEP 1C: Select the desired aspect ratio for all ductwork.
# Specify the aspect ratio for your main supply duct as well as the branch ducts in each thermal zone.
# STEP 1D: Modify the placement and geometry of the main ductwork by modifying these parameters.
# The DUCT OFFSET parameter is the distance the main supply air duct is offset from the facade of the building. The DUCT HEIGHT parameter controls the vertical placement of the ductwork.
# ADVANCED DESIGN PARAMETERS
# The distance the branch duct extends into each thermal zone from the supply duct.
# STEP 1E: Modify other geometric parameters to arrive at the final, desired HVAC system spatial layout.
# The aspect ratio of the supply air riser.
# The distance the diffuser in each thermal zone extends down from the branch.
# The distance separating the zone terminal equipment (FCU, VRF) from the centroid of the room.
# The distance separating the supply and return air risers.
# Utilize slider to visualize alternative return air riser locations.
list = ValueList({"Baseline Variable Air Volume (VAV)": 0, "Variable Air Volume with Air-Side Economizer": 1, "Dedicated Outdoor Air System with Fan Coil Units": 2, "Dedicated Outdoor Air System with VRF": 3}, selected="Dedicated Outdoor Air System with Fan Coil Units")
# TASK B - SPATIAL DESIGN
# OVERVIEW: In this portion of the exercise, you will design the spatial layout of your selected HVAC system. Please follow the steps below to modify the geometry of the HVAC system based on spatial and aesthetic considerations.
riser_points_on_roof = Point([<point referenced from the Rhino model> x2])

main_supply_duct_aspect_ratio = Slider(2, range=1..4)
zone_branch_duct_aspect_ratio = Slider(1, range=1..4)

merge_programs = Entwine(Branch00=thermal_zones, FlattenInputs=True)

# ----
# CORRECTION FACTORS
cooling_fcu = Panel("""0.332382505
0.364688997
0.384051831
0.406636947
0.421921367
0.424398652""")
cooling_vav = Panel("""0.338304747
0.424532174
0.521251082
0.595711614
0.729295723
0.777426462""")
heating_fcu = Panel("""1.462890625
1.69591362
1.287998394
1.182696083
1.114243169
1.10329084""")
heating_vav = Panel("""36.45019531
4.027476627
2.228652663
1.528278436
1.398512562
1.275514263""")
cooling_vave = Panel("""0.367920609
0.406818149
0.44946186
0.468459257
0.515916141
0.515747793""")
cooling_vrf = Panel("""0.385650114
0.414072048
0.419062825
0.427487709
0.430133093
0.429630322""")
heating_vave = Panel("""36.72753906
4.033314313
2.228271341
1.528417193
1.398481126
1.27532766""")
heating_vrf = Panel("""4.563476563
1.377013563
0.95187316
0.850381287
0.783476038
0.764129031""")
heat_rejection_fcu = Panel("""0.123573565
0.146753604
0.164526651
0.164138729
0.145859035
0.129416953""")
pumps_fcu = Panel("""0.123573565
0.146753604
0.164526651
0.164138729
0.145859035
0.129416953""")
heat_rejection_vav = Panel("""0.118998558
0.177184872
0.23653099
0.252021215
0.268204079
0.249167798""")
pumps_vav = Panel("""0.118998558
0.177184872
0.23653099
0.252021215
0.268204079
0.249167798""")
fans_fcu = Panel("""0.100728755
0.138895958
0.176708174
0.188413388
0.171526622
0.155161158""")
fans_vav = Panel("""0.076213077
0.108373435
0.14742834
0.154599606
0.159795841
0.150777332""")
heat_rejection_vave = Panel("""0.12092473
0.157680532
0.19308492
0.189480952
0.19565865
0.179598978""")
heat_rejection_vrf = Panel("""0
0
0
0
0
0""")
pumps_vave = Panel("""0.12092473
0.157680532
0.19308492
0.189480952
0.19565865
0.179598978""")
pumps_vrf = Panel("""0
0
0
0
0
0""")
fans_vave = Panel("""0.076217727
0.108373435
0.147436522
0.154599606
0.159795841
0.150777332""")
fans_vrf = Panel("""0.154061679
0.214218695
0.274697037
0.291767269
0.268633051
0.244531888""")

python = GhPythonScript(x=simulation_directory)  # -> a
# ---------- python: Python ----------
__author__ = "airan"
__version__ = "2022.11.08"

import rhinoscriptsyntax as rs
import System as s
import ghpythonlib.components as ghcomp

a = s.IO.Directory.Exists(x)
print a

import Grasshopper as gh
gh.GUI.GH_PanelEditor.DefaultBackColor.Red
# ---------- end python ----------
shading_2 = CSShadingObject(Surface=shading)
p_n_c = PickNChoose(Pattern=python, Stream0="WARNING: THIS DIRECTORY IS INVALID. CHOOSE ANOTHER.", Stream1="NO WARNINGS")
panel_5 = Panel(p_n_c)

all_template_data = Data(template)
txt = Text(graft(all_template_data))
split = TextSplit(Text=txt, Separators="\"")  # -> simplify(Result)
item = ListItem(List=split, Index=458, Wrap=True)
item_2 = ListItem(List=split, Index=454, Wrap=True)
item_3 = ListItem(List=split, Index=460, Wrap=True)
item_4 = ListItem(List=split, Index=456, Wrap=True)
split_2 = TextSplit(Text=item, Separators=": ")
split_3 = TextSplit(Text=item_2, Separators=" : ")
split_4 = TextSplit(Text=item_3, Separators=": ")
split_5 = TextSplit(Text=item_4, Separators=" : ")
item_5 = ListItem(List=split_2, Index=2, Wrap=True)
item_6 = ListItem(List=split_4, Index=2, Wrap=True)
item_7 = ListItem(List=split_3, Index=2, Wrap=True)
item_8 = ListItem(List=split_5, Index=2, Wrap=True)
split_6 = TextSplit(Text=item_5, Separators=" ,")
split_7 = TextSplit(Text=item_6, Separators=" ,")
split_8 = TextSplit(Text=item_7, Separators=" ,")
split_9 = TextSplit(Text=item_8, Separators=" ,")
item_9 = ListItem(List=split, Index=154, Wrap=True)
item_10 = ListItem(List=split, Index=204, Wrap=True)
item_11 = ListItem(List=split, Index=152, Wrap=True)
item_12 = ListItem(List=split, Index=206, Wrap=True)
item_13 = ListItem(List=split, Index=86, Wrap=True)
item_14 = ListItem(List=split, Index=81, Wrap=True)
item_15 = ListItem(List=split_6, Index=0, Wrap=True)  # -> flatten(Item)
item_16 = ListItem(List=split_7, Index=0, Wrap=True)  # -> flatten(Item)
item_17 = ListItem(List=split_8, Index=0, Wrap=True)  # -> flatten(Item)
item_18 = ListItem(List=split_9, Index=0, Wrap=True)  # -> flatten(Item)
split_10 = TextSplit(Text=item_9, Separators=": ,")
split_11 = TextSplit(Text=item_10, Separators=": ,")
split_12 = TextSplit(Text=item_11, Separators=": ,")
split_13 = TextSplit(Text=item_12, Separators=": ,")
split_14 = TextSplit(Text=item_13, Separators=": ,")
split_15 = TextSplit(Text=item_14, Separators=" _ ")
item_19 = ListItem(List=split_10, Index=2, Wrap=True)  # -> simplify(Item)
item_20 = ListItem(List=split_11, Index=2, Wrap=True)  # -> simplify(Item)
item_21 = ListItem(List=split_12, Index=2, Wrap=True)  # -> simplify(Item)
item_22 = ListItem(List=split_13, Index=2, Wrap=True)  # -> simplify(Item)
item_23 = ListItem(List=split_14, Index=2, Wrap=True)  # -> simplify(Item)
item_24 = ListItem(List=item_15, Index=0, Wrap=True)  # -> flatten(Item)
item_25 = ListItem(List=item_16, Index=0, Wrap=True)  # -> flatten(Item)
item_26 = ListItem(List=item_17, Index=0, Wrap=True)  # -> flatten(Item)
item_27 = ListItem(List=item_18, Index=0, Wrap=True)  # -> flatten(Item)
join = TextJoin(Text=split_15, Join="_")
electricity_co2 = Panel(item_26)
hot_water_co2 = Panel(item_24)
electricity_cost = Panel(item_27)
hot_water_cost = Panel(item_25)
program = Panel(join)
data = Data(flatten(join))
occupant_density_people_m2 = Panel(item_23)
cooling_setpoint_c = Panel(item_19)
fresh_air_per_person_l_s_per = Panel(item_20)
heating_setpoint_c = Panel(item_21)
fresh_air_per_area_l_s_m2 = Panel(item_22)

num = Number(branch_depth_m)
vec = VectorXYZ(XComponent=1, YComponent=0, ZComponent=0)  # -> Vector, Length

# ----
# 4. OUTPUTS AND METRICS
# AREA REQUIREMENTS PER FLOOR
# (sq.m)
# STEP 4: Given the performance metrics from the table above as well as your understanding of HVAC systems, please indicate which system you would select for your building? Please indicate why and provide a discussion of the energy, cost, and space requirements for your selected system.
panel_6 = Panel("FIRST COST")
panel_7 = Panel("""EUI
(kWh/sq.m)""")
panel_8 = Panel("ANNUAL OPERATING COST")
panel_9 = Panel("""OPERATING CARBON
(tons CO2)""")

windows = Brep([<brep referenced from the Rhino model> x12])

# ----
# 2. VISUALIZE HVAC GEOMETRY
# STEP 2: When you have finalized your HVAC system layout, please take a screenshot of your final design. Also incluse your Rhino model and GH for the assignment submission.
swatch = ColourSwatch(SwatchColor=RGBA(0, 55, 255, 200))

thermal_zones_2 = CustomPreview(Geometry=thermal_zones, Material=ColourSwatch(SwatchColor=RGBA(217, 217, 217, 70)))

all_programs = Brep(flatten(merge_programs))

# ----
# Intersect input BREP geometry and assign, unique zone names to each thermal zone in building.
intersector = CSIntersector(Brep=merge_programs)
lng = ListLength(List=intersector)  # -> flatten(Length)
partition = PartitionList(List=flatten(intersector), Size=lng)  # -> flatten(Chunks)
repeat = RepeatData(Data=join, Length=graft(lng))  # -> simplify(flatten(Data))

debrep = DeconstructBrep(Brep=partition)  # -> Faces, Edges, Vertices
evalsrf = EvaluateSurface(Surface=debrep.Faces, Point="0.5,0.5")  # -> Point, Normal, UDirection, VDirection, Frame
devec = DeconstructVector(Vector=evalsrf.Normal)  # -> XComponent, YComponent, ZComponent
abs = Absolute(Value=devec.ZComponent)
larger = LargerThan(FirstNumber=abs, SecondNumber=0.1)  # -> LargerThan, OrEqualTo
dispatch = Dispatch(List=debrep.Faces, DispatchPattern=larger.LargerThan)  # -> ListA, ListB
# Define unique names for each thermal zone.
srf = Surface(dispatch.ListA)
srf_2 = Surface(dispatch.ListB)
evalsrf_2 = EvaluateSurface(Surface=srf_2, Point="0.5,0.5")  # -> Point, Normal, UDirection, VDirection, Frame
area = Area(Geometry=srf)  # -> Area, Centroid
area_2 = Area(Geometry=srf_2)  # -> Area, Centroid
sort = SortList(Keys=area.Area, ValuesA=dispatch.ListA)  # -> reverse(Keys), reverse(ValuesA)
sort_2 = SortList(Keys=area_2.Area, ValuesA=srf_2, ValuesB=evalsrf_2.Normal)  # -> reverse(Keys), reverse(ValuesA), reverse(ValuesB)
item_28 = ListItem(List=sort_2.ValuesB, Index=0, Wrap=True)  # -> flatten(Item)
# Deconstruct thermal zone geometry, extracting floor edges and full floorplate geometry.
item_29 = ListItem(List=sort.ValuesA, Index=0, Wrap=True)  # -> Item, Item1
srf_3 = Surface([item_29.Item1, item_29.Item])
area_3 = Area(Geometry=srf_3)  # -> Area, Centroid
pdecon = Deconstruct(Point=area_3.Centroid)  # -> XComponent, YComponent, ZComponent
sort_3 = SortList(Keys=pdecon.ZComponent, ValuesA=srf_3)  # -> Keys, ValuesA
item_30 = ListItem(List=sort_3.ValuesA, Index=0, Wrap=True)
srf_4 = Surface(item_30)

# ----
# Split program by level and assign thermal zones by every floor.
area_4 = Area(Geometry=flatten(srf_4))  # -> Area, Centroid
pdecon_2 = Deconstruct(Point=area_4.Centroid)  # -> XComponent, YComponent, ZComponent

python_2 = GhPythonScript(x=pdecon_2.ZComponent)  # -> a
# ---------- python_2: Python ----------
__author__ = "airan"
__version__ = "2022.10.24"

import rhinoscriptsyntax as rs

import math as m

a = round(x,1)
# ---------- end python_2 ----------

cset = CreateSet(List=python_2)  # -> Set, Map

sort_4 = SortList(Keys=cset.Set)  # -> Keys, ValuesA

mindex = MemberIndex(Set=python_2, Member=sort_4.Keys)  # -> Index, Count
item_31 = ListItem(List=all_programs, Index=mindex.Index, Wrap=True)
sorted_tz = Brep(item_31)

tstat = TreeStatistics(Tree=item_31)  # -> Paths, Length, Count
series = Series(Start=1, Step=1, Count=tstat.Count)  # -> simplify(graft(Series))
series_2 = Series(Start=1, Step=1, Count=graft(mindex.Count))  # -> simplify(Series)
item_32 = ListItem(List=repeat, Index=mindex.Index, Wrap=True)
concat = Concatenate(FragmentA="FLR_", FragmentB=series, FragmentC="_ZONE_", FragmentD=series_2, FragmentF="_", FragmentE=item_32)

sorted_tz_names = Data(flatten(concat))
tmatch = MatchText(Text=sorted_tz_names, RegEx=join, Case=True)
dispatch_2 = Dispatch(List=sorted_tz_names, DispatchPattern=tmatch)  # -> ListA, ListB

program_names = ExplodeTree(Data=dispatch_2.ListA)
zone = CSEnergyZone(
    Brep=flatten(sorted_tz),
    Name=program_names,
    Settings=template,
    UsedLibraryObjects="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")  # -> Zones, Settings
all_thermal_zones = Data(zone.Zones)
panel_10 = Panel(zone.Settings)
item_33 = ListItem(List=item_28, Index=mindex.Index, Wrap=True)  # -> flatten(Item)

sunion = SolidUnion(Breps=sorted_tz)
fmerge = MergeFaces(Brep=sunion)  # -> Breps, Before, After
debrep_2 = DeconstructBrep(Brep=sorted_tz)  # -> Faces, Edges, Vertices
debrep_3 = DeconstructBrep(Brep=fmerge.Breps)  # -> Faces, Edges, Vertices
area_5 = Area(Geometry=debrep_2.Faces)  # -> Area, Centroid
area_6 = Area(Geometry=debrep_3.Faces)  # -> Area, Centroid
devec_2 = DeconstructVector(Vector=area_6.Centroid)  # -> XComponent, YComponent, ZComponent
devec_3 = DeconstructVector(Vector=area_5.Centroid)  # -> XComponent, YComponent, ZComponent
sort_5 = SortList(Keys=devec_3.ZComponent, ValuesA=debrep_2.Faces)  # -> Keys, ValuesA, ValuesB
sort_6 = SortList(Keys=devec_2.ZComponent, ValuesA=debrep_3.Faces)  # -> Keys, ValuesA
item_34 = ListItem(List=sort_5.ValuesA, Index=0, Wrap=True)
item_35 = ListItem(List=sort_6.ValuesA, Index=0, Wrap=True)
edges = BrepEdges(Brep=item_35)  # -> Naked, Interior, NonManifold
edges_2 = BrepEdges(Brep=item_34)  # -> simplify(Naked), Interior, NonManifold
join_2 = JoinCurves(Curves=edges_2.Naked, Preserve=False)  # -> flatten(Curves)
lng_2 = ListLength(List=sorted_tz)  # -> flatten(Length)
partition_2 = PartitionList(List=join_2, Size=lng_2)
sorted_zone_floorplate_edge_curve = Curve(partition_2)
sorted_floorplate_edge_curve = Curve(edges.Naked)

item_36 = ListItem(List=sort_6.ValuesA, Index=-1, Wrap=True)
edges_3 = BrepEdges(Brep=item_36)  # -> Naked, Interior, NonManifold
join_3 = JoinCurves(Curves=edges_3.Naked, Preserve=False)
len = Length(Curve=join_3)
sort_7 = SortList(Keys=len, ValuesA=join_3)  # -> reverse(Keys), reverse(ValuesA)
sorted_full_floor_geometry = Brep(flatten(fmerge.Breps))
item_37 = ListItem(List=sort_7.ValuesA, Index=0, Wrap=True)
join_4 = JoinCurves(Curves=sorted_floorplate_edge_curve, Preserve=False)  # -> simplify(Curves)
item_38 = ListItem(List=item_33, Index=mindex.Index, Wrap=True)
tstat_2 = TreeStatistics(Tree=item_38)  # -> Paths, Length, Count
abs_2 = Absolute(Value=item_33)

# ----
# Inititate and run energy model.
wwr = Slider(100, range=10..100)
cluster = Cluster(G=windows, A=wwr)
toggle = BooleanToggle(True)

window = Window(
    Surface=cluster,
    Settings="gn01EAGCARxTb2xhcmJhbiA2MCAoMikgb24gU3RhcnBoaXJl+QEAAAAAAAD4P4ECAAAAAAAA4D86A0FsbA==",
    UsedLibraryObjects="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")  # -> Window, Settings

model = CSModelMaker(Zones=all_thermal_zones, Windows=window.Window, Boundaries=bco, Shading=shading_2)  # -> Model, Invalid
run_e = RunCSEnergyModel(
    Model=model.Model,
    Name="HVAC_1",
    Directory=simulation_directory,
    Location=weathersearch,
    Run=simulate,
    NorthOffset=0,
    settings="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")  # -> Model, Settings, Result
energy_results = LoadCSEnergyResult(ThermalModel=run_e.Model, Mode=0, Resolution=0, Toggle=Toggle(True))  # -> TotalEUI, Baseline, TotalCO2, TotalCost, FloorArea, Data, Labels, Months, Colors, CSR
heating_load = LoadCSZoneResults(
    ThermalModel=run_e.Model,
    Toggle=toggle,
    byzone="True",
    settings="""{
  "zoneIDs": [],
  "output2Display": [
    {
      "key": "Zone Ideal Loads Supply Air Total Heating Energy",
      "unit": "HVAC Sum [J]",
      "type": 0
    }
  ],
  "normalizeByFloorArea": false
}""")  # -> ResultsPerZone, Labels, Name, Zone
cooling_load = LoadCSZoneResults(
    ThermalModel=run_e.Model,
    Toggle=toggle,
    byzone="True",
    settings="""{
  "zoneIDs": [],
  "output2Display": [
    {
      "key": "Zone Ideal Loads Supply Air Total Cooling Energy",
      "unit": "HVAC Sum [J]",
      "type": 0
    }
  ],
  "normalizeByFloorArea": false
}""")  # -> ResultsPerZone, Labels, Name, Zone

warnings = Panel(model.Invalid)
cluster_2 = Cluster_2(brep=cluster)

windows_2 = CustomPreview(Geometry=cluster_2, Material=ColourSwatch(SwatchColor=RGBA(31, 173, 224, 114)))

# ----
# Extract airflow rates, setpoints, utility cost, and occupancy density from the building templates.
sort_8 = SortList(Keys=heating_load.ResultsPerZone)  # -> Keys, ValuesA
# Extract heating and cooling loads for each zone from the energy model results.
sort_9 = SortList(Keys=cooling_load.ResultsPerZone)  # -> Keys, ValuesA
item_39 = ListItem(List=sort_8.Keys, Index=-1, Wrap=True)
item_40 = ListItem(List=sort_9.Keys, Index=-1, Wrap=True)
division = Division(A=item_39, B=3600)
division_2 = Division(A=item_40, B=3600)
split_16 = TextSplit(Text=heating_load.Name, Separators="_*")
cull_i = CullIndex(List=split_16, Indices=-1, Wrap=True)
sorted_zone_names = Data(concat)
join_5 = TextJoin(Text=cull_i, Join="_")
lng_3 = ListLength(List=sorted_zone_names)  # -> flatten(Length)
mindex_2 = MemberIndex(Set=flatten(join_5), Member=flatten(sorted_zone_names))  # -> Index, Count
item_41 = ListItem(List=flatten(division), Index=flatten(mindex_2.Index), Wrap=True)
item_42 = ListItem(List=flatten(division_2), Index=flatten(mindex_2.Index), Wrap=True)
item_43 = ListItem(List=flatten(join_5), Index=flatten(mindex_2.Index), Wrap=True)
cooling_load_2 = PartitionList(List=item_42, Size=lng_3)
zone_name = PartitionList(List=item_43, Size=lng_3)
heating_load_2 = PartitionList(List=item_41, Size=lng_3)
division_3 = Division(A=heating_load_2, B=1000)
division_4 = Division(A=cooling_load_2, B=1000)
heating_load_kw = Panel(division_3)
cooling_load_kw = Panel(division_4)

cset_2 = CreateSet(List=flatten(join))  # -> Set, Map
mindex_3 = MemberIndex(Set=flatten(item_32), Member=cset_2.Set)  # -> Index, Count
lng_4 = ListLength(List=mindex_3.Index)  # -> flatten(Length)
repeat_2 = RepeatData(Data=item_20, Length=graft(lng_4))
repeat_3 = RepeatData(Data=item_22, Length=graft(lng_4))
repeat_4 = RepeatData(Data=item_21, Length=graft(lng_4))
repeat_5 = RepeatData(Data=item_19, Length=graft(lng_4))
item_44 = ListItem(List=flatten(repeat_2), Index=flatten(mindex_2.Index), Wrap=True)
item_45 = ListItem(List=flatten(repeat_3), Index=flatten(mindex_2.Index), Wrap=True)
item_46 = ListItem(List=flatten(repeat_4), Index=flatten(mindex_2.Index), Wrap=True)
item_47 = ListItem(List=flatten(repeat_5), Index=flatten(mindex_2.Index), Wrap=True)
repeat_6 = RepeatData(Data=item_23, Length=graft(lng_4))
item_48 = ListItem(List=flatten(repeat_6), Index=flatten(mindex_2.Index), Wrap=True)
occupancy = PartitionList(List=item_48, Size=lng_3)
fresh_air_per_person = PartitionList(List=item_44, Size=lng_3)
fresh_air_per_area = PartitionList(List=item_45, Size=lng_3)
heating_setpoint = PartitionList(List=item_46, Size=lng_3)
cooling_setpoint = PartitionList(List=item_47, Size=lng_3)
supply_air_temperature_sat_c = Panel("12.8")
area_7 = Area(Geometry=sorted_zone_floorplate_edge_curve)  # -> Area, Centroid
specific_heat_capacity_kj_kg_c = Panel("1.006")
air_density_kg_m3 = Panel("1.202")
expression = Expression(
    Air_person=fresh_air_per_person,
    Air_area=fresh_air_per_area,
    Occupancy=occupancy,
    Area=area_7.Area,
    Expression="((Occupancy*Area)*Air_person)+(Air_area*Area)")
subtraction = Subtraction(A=heating_setpoint, B=supply_air_temperature_sat_c)
subtraction_2 = Subtraction(A=cooling_setpoint, B=supply_air_temperature_sat_c)
expression_2 = Expression(
    H_heat=division_3,
    Cp=specific_heat_capacity_kj_kg_c,
    rho=air_density_kg_m3,
    dt=subtraction,
    Expression="(H_heat/(Cp*rho*dt))*1000")
expression_3 = Expression(
    H_cool=division_4,
    Cp=specific_heat_capacity_kj_kg_c,
    rho=air_density_kg_m3,
    dt=subtraction_2,
    Expression="(H_cool/(Cp*rho*dt))*1000")
heating_flow_rate_l_s = Panel(expression_2)
oa_flow_rate_l_s = Panel(expression)
cooling_flow_rate_l_s = Panel(expression_3)
max = Maximum(A=expression_2, B=expression_3)

panel_11 = Panel(fresh_air_per_person)

# ----
# Adjust energy consumption for different HVAC system and output all metrics after first simulation.
bang = ExplodeTree(Data=energy_results.Data)  # -> Branch0, Branch1, Branch2, Branch3, Branch4, Branch5
cooling = MassAddition(Input=bang.Branch5)  # -> Result, PartialResults
heating = MassAddition(Input=bang.Branch4)  # -> Result, PartialResults
ma = MassAddition(Input=max)  # -> Result, PartialResults
ma_2 = MassAddition(Input=expression)  # -> Result, PartialResults
cooling_2 = Entwine(Branch00=cooling_vav, Branch01=cooling_vave, Branch02=cooling_fcu, Branch03=cooling_vrf, FlattenInputs=True)
entwine = Entwine(Branch00=heating_vav, Branch01=heating_vave, Branch02=heating_fcu, Branch03=heating_vrf, FlattenInputs=True)
equipment = MassAddition(Input=bang.Branch0)  # -> Result, PartialResults
lighting = MassAddition(Input=bang.Branch2)  # -> Result, PartialResults
fans = Entwine(Branch00=fans_vav, Branch01=fans_vave, Branch02=fans_fcu, Branch03=fans_vrf, FlattenInputs=True)
pumps = Entwine(Branch00=pumps_vav, Branch01=pumps_vave, Branch02=pumps_fcu, Branch03=pumps_vrf, FlattenInputs=True)
heat_rejection = Entwine(
    Branch00=heat_rejection_vav,
    Branch01=heat_rejection_vave,
    Branch02=heat_rejection_fcu,
    Branch03=heat_rejection_vrf,
    FlattenInputs=True)
light = Entwine(
    Branch00=lighting.Result,
    Branch01=lighting.Result,
    Branch02=lighting.Result,
    Branch03=lighting.Result,
    FlattenInputs=True)
equipm = Entwine(
    Branch00=equipment.Result,
    Branch01=equipment.Result,
    Branch02=equipment.Result,
    Branch03=equipment.Result,
    FlattenInputs=True)
ma_3 = MassAddition(Input=flatten([heating.Result, cooling.Result]))  # -> Result, PartialResults
ma_4 = MassAddition(Input=flatten([heating.Result, cooling.Result]))  # -> Result, PartialResults
ma_5 = MassAddition(Input=flatten([heating.Result, cooling.Result]))  # -> Result, PartialResults
item_49 = ListItem(List=fans, Index=climate_zone, Wrap=True)
item_50 = ListItem(List=pumps, Index=climate_zone, Wrap=True)
item_51 = ListItem(List=heat_rejection, Index=climate_zone, Wrap=True)
item_52 = ListItem(List=cooling_2, Index=climate_zone, Wrap=True)
item_53 = ListItem(List=entwine, Index=climate_zone, Wrap=True)
multiplication = Multiplication(A=cooling.Result, B=item_52)
multiplication_2 = Multiplication(A=heating.Result, B=item_53)
multiplication_3 = Multiplication(A=ma_5.Result, B=item_51)
multiplication_4 = Multiplication(A=ma_3.Result, B=item_49)
multiplication_5 = Multiplication(A=ma_4.Result, B=item_50)
bang_2 = ExplodeTree(Data=multiplication_2)  # -> Branch0, Branch1, Branch2, Branch3
ma_6 = MassAddition(Input=[multiplication, light, equipm, multiplication_4, multiplication_5, multiplication_3])  # -> Result, PartialResults
ma_7 = MassAddition(Input=[ma_6.Result, bang_2.Branch3])  # -> Result, PartialResults
elec_use = Data(ma_7.Result)
gas_use = Data([bang_2.Branch0, bang_2.Branch1, bang_2.Branch2])
price = Panel("""270
270
320
300""")
entwine_2 = Entwine(
    Branch00=multiplication_2,
    Branch01=multiplication,
    Branch02=light,
    Branch03=equipm,
    Branch04=multiplication_4,
    Branch05=multiplication_5,
    Branch06=multiplication_3,
    FlattenInputs=True)
ma_8 = MassAddition(Input=[multiplication_2, multiplication, light, equipm, multiplication_4, multiplication_5, multiplication_3])  # -> flatten(Result), PartialResults
python_3 = GhPythonScript(x=ma_8.Result)  # -> a
# ---------- python_3: Python ----------
__author__ = "airan"
__version__ = "2022.10.24"

import rhinoscriptsyntax as rs

import math as m

a = round(x,0)
# ---------- end python_3 ----------
item_54 = ListItem(List=python_3, Index=0, Wrap=True)  # -> Item, Item1, Item2, Item3
sort_10 = SortList(Keys=python_3)  # -> Keys, ValuesA
item_55 = ListItem(List=sort_10.Keys, Index=-1, Wrap=True)

addition = Addition(A=item_55, B=10)
panel_12 = Panel("Chart formatting.")
panel_13 = Panel("""VAV
VAV + Economizer
FCU + DOAS
VRF + DOAS""")
panel_14 = Panel("""226,39,58 (200)
25,148,218 (200)
246,226,3 (200)
120,120,120 (200)
100,20,20 (200)
120,175,64 (200)
20,20,150(200)""")
round = Round(Number=addition)  # -> Nearest, Floor, Ceiling
panel_15 = Panel("""Heating
Cooling
Lighting
Equipment
Fan
Pump
Heat Rejection""")
dom = ConstructDomain(DomainStart=0, DomainEnd=round.Nearest)
dom_2 = ConstructDomain(DomainStart=0, DomainEnd=4)

plotter = CSPlotter(
    Type=2,
    Width=1000,
    Height=1000,
    Title="HVAC System Energy Performance",
    Y_title="Energy Use Intensity (kWh/sq.m)",
    X_labels=panel_13,
    X_rot=0,
    Y_data=entwine_2,
    Colors=panel_14,
    Names=panel_15,
    Domain=dom_2,
    Range=dom,
    Show_xgrid=False,
    Show_ygrid=True,
    Legend=1,
    PreviewDimension=2,
    InfinateZoomDisplay=False,
    UnitSystem=4)
panel_16 = Panel(item_54.Item)
panel_17 = Panel(item_54.Item1)
# FAN COIL UNITS W/ DOAS
panel_18 = Panel(item_54.Item2)
panel_19 = Panel(item_54.Item3)

sorted_floorplate_geometry = Surface(item_35)
area_8 = Area(Geometry=flatten(sorted_floorplate_geometry))  # -> Area, Centroid
ma_9 = MassAddition(Input=area_8.Area)  # -> Result, PartialResults
neg = Negative(Value=duct_offset_m)
midpt = CurveMiddle(Curve=item_37)
pdecon_3 = Deconstruct(Point=midpt)  # -> XComponent, YComponent, flatten(ZComponent)
neg_2 = Negative(Value=duct_height_m)
Z = UnitZ(Factor=neg_2)

edges_4 = BrepEdges(Brep=sorted_floorplate_geometry)  # -> Naked, Interior, NonManifold
join_6 = JoinCurves(Curves=edges_4.Naked, Preserve=False)
len_2 = Length(Curve=join_6)
sort_11 = SortList(Keys=len_2, ValuesA=join_6)  # -> reverse(Keys), reverse(ValuesA)
item_56 = ListItem(List=sort_11.ValuesA, Index=0, Wrap=True)  # -> flatten(Item)

# ----
# Draw primary loop duct for the supply air.
safety_factor = Panel("1.0")
air_velocity = ValueList({"1 m/s or 200 fpm": 1, "2 m/s or 400 fpm": 2, "4 m/s or 750 fpm": 4, "8 m/s or 1500 fpm": 8, "16 m/s or 3000 fpm": 16}, selected="4 m/s or 750 fpm")

floor_by_floor_airflow = Expression(Flowrate=ma.Result, Airspeed=air_velocity, SF=safety_factor, Expression="Flowrate/1000/Airspeed*SF")
floor_by_floor_airflow_2 = Expression(Flowrate=ma_2.Result, Airspeed=air_velocity, SF=safety_factor, Expression="Flowrate/1000/Airspeed*SF")
ma_10 = MassAddition(Input=flatten(floor_by_floor_airflow_2))  # -> Result, PartialResults
ma_11 = MassAddition(Input=flatten(floor_by_floor_airflow))  # -> Result, PartialResults
entwine_3 = Entwine(Branch00=ma_11.Result, Branch01=ma_11.Result, Branch02=ma_10.Result, Branch03=ma_10.Result, FlattenInputs=True)
multiplication_6 = Multiplication(A=entwine_3, B=2)
multiplication_7 = Multiplication(AREA=ma_9.Result, RATE=item_26, C=elec_use)
multiplication_8 = Multiplication(AREA=ma_9.Result, RATE=item_24, C=gas_use)
multiplication_9 = Multiplication(AREA=ma_9.Result, RATE=item_25, C=gas_use)
multiplication_10 = Multiplication(AREA=ma_9.Result, RATE=item_27, C=elec_use)
multiplication_11 = Multiplication(A=ma_9.Result, B=graft(price))
ma_12 = MassAddition(Input=[multiplication_7, multiplication_8])  # -> Result, PartialResults
ma_13 = MassAddition(Input=[multiplication_10, multiplication_9])  # -> Result, PartialResults
round_2 = Round(Number=multiplication_11)  # -> Nearest, Floor, Ceiling
# Perform supply air system sizing based on loads from energy model as well as zone setpoint temperatures.
round_3 = Round(Number=ma_12.Result)  # -> Nearest, Floor, Ceiling
round_4 = Round(Number=ma_13.Result)  # -> Nearest, Floor, Ceiling
bang_3 = ExplodeTree(Data=multiplication_6)  # -> flatten(Branch0), flatten(Branch1), flatten(Branch2), flatten(Branch3)
python_4 = GhPythonScript(x=round_2.Nearest)  # -> a
# ---------- python_4: Python ----------
__author__ = "airan"
__version__ = "2022.10.24"

import rhinoscriptsyntax as rs

import math as m

a = round(x,-3)
# ---------- end python_4 ----------
python_5 = GhPythonScript(x=round_3.Nearest)  # -> a; same code as python_4
python_6 = GhPythonScript(x=round_4.Nearest)  # -> a; same code as python_4

division_5 = Division(A=python_5, B=1000)
concat_2 = Concatenate(FragmentA=division_5, FragmentB="k")
division_6 = Division(A=python_4, B=1000)
division_7 = Division(A=python_6, B=1000)

concat_3 = Concatenate(FragmentA="$", FragmentB=division_6, FragmentC="k")
concat_4 = Concatenate(FragmentA="$", FragmentB=division_7, FragmentC="k")
bang_4 = ExplodeTree(Data=concat_3)  # -> flatten(Branch0), flatten(Branch1), flatten(Branch2), flatten(Branch3)
bang_5 = ExplodeTree(Data=concat_4)  # -> flatten(Branch0), flatten(Branch1), flatten(Branch2), flatten(Branch3)
bang_6 = ExplodeTree(Data=concat_2)  # -> flatten(Branch0), flatten(Branch1), flatten(Branch2), flatten(Branch3)

panel_20 = Panel(bang_4.Branch0)
panel_21 = Panel(bang_6.Branch0)
panel_22 = Panel(bang_5.Branch0)
panel_23 = Panel(bang_3.Branch0)
panel_24 = Panel(bang_5.Branch1)
panel_25 = Panel(bang_4.Branch1)
panel_26 = Panel(bang_6.Branch1)
panel_27 = Panel(bang_3.Branch1)
panel_28 = Panel(bang_5.Branch2)
panel_29 = Panel(bang_4.Branch2)
panel_30 = Panel(bang_6.Branch2)
panel_31 = Panel(bang_3.Branch2)
panel_32 = Panel(bang_5.Branch3)
panel_33 = Panel(bang_4.Branch3)
panel_34 = Panel(bang_6.Branch3)
panel_35 = Panel(bang_3.Branch3)

midpt_2 = CurveMiddle(Curve=item_56)
offset = OffsetCurve(Curve=item_56, Distance=neg, Corners=1)  # -> flatten(Curve)
offset_2 = OffsetCurve(Curve=item_56, Distance=duct_offset_m, Corners=1)  # -> flatten(Curve)
pdecon_4 = Deconstruct(Point=midpt_2)  # -> XComponent, YComponent, ZComponent
len_3 = Length(Curve=offset)
len_4 = Length(Curve=offset_2)
smaller = SmallerThan(FirstNumber=len_3, SecondNumber=len_4)  # -> SmallerThan, OrEqualTo
subtraction_3 = Subtraction(A=pdecon_3.ZComponent, B=pdecon_4.ZComponent)
p_n_c_2 = PickNChoose(Pattern=smaller.SmallerThan, Stream0=offset_2, Stream1=offset)
Z_2 = UnitZ(Factor=subtraction_3)
move = Move(Geometry=p_n_c_2, Motion=Z_2)  # -> Geometry, Transform
move_2 = Move(Geometry=move.Geometry, Motion=Z)  # -> Geometry, Transform

cset_3 = CreateSet(List=Z_2)  # -> Set, Map

area_9 = Area(Geometry=flatten(sorted_floorplate_geometry))  # -> Area, Centroid
pdecon_5 = Deconstruct(Point=area_9.Centroid)  # -> XComponent, YComponent, ZComponent
sort_12 = SortList(Keys=pdecon_5.ZComponent, ValuesA=area_9.Centroid)  # -> Keys, ValuesA
item_57 = ListItem(List=sort_12.ValuesA, Index=0, Wrap=True)
expression_4 = Expression(x=ma_9.Result, Expression="(x*10.76/58)^1.087")
expression_5 = Expression(x=ma_9.Result, Expression="(x*10.76/69.2)^1.053")
pt = Point(riser_points_on_roof)
pt_2 = Point(item_57)
division_8 = Division(A=expression_4, B=10.76)
division_9 = Division(A=expression_5, B=10.76)
sqrt = SquareRoot(Value=division_9)
division_10 = Division(A=sqrt, B=2)
neg_3 = Negative(Value=division_10)
dom_3 = ConstructDomain(DomainStart=neg_3, DomainEnd=division_10)
Z_3 = UnitZ(Factor=3)
Z_4 = UnitZ(Factor=-3)
number_slider = Slider(1.3, range=0..10)

# ----
# Draw terminal zone equipment including FAN COIL UNITS, VRF CASSETTES, and VAV BOXES.
panel_36 = Panel("950x300x950")
split_17 = TextSplit(Text="1900x254x508", Separators="x")
split_18 = TextSplit(Text=panel_36, Separators="x")
division_11 = Division(A=split_17, B=1000)
division_12 = Division(A=split_18, B=1000)
item_58 = ListItem(List=division_11, Index=0, Wrap=True)  # -> Item, Item1, Item2
item_59 = ListItem(List=division_12, Index=0, Wrap=True)  # -> Item, Item1, Item2
panel_37 = Panel("""0
0
1
1""")
panel_38 = Panel("""0
0
1
2""")
item_60 = ListItem(List=panel_37, Index=list, Wrap=True)
item_61 = ListItem(List=panel_38, Index=list, Wrap=True)

filter = StreamFilter(Gate=item_60, Stream0=max, Stream1=expression)
ma_14 = MassAddition(Input=filter)  # -> Result, PartialResults
floor_by_floor_airflow_3 = Expression(Flowrate=ma_14.Result, Airspeed=air_velocity, SF=safety_factor, Expression="Flowrate/1000/Airspeed*SF")
division_13 = Division(A=floor_by_floor_airflow_3, B=main_supply_duct_aspect_ratio)
zone_by_zone_airflow = Expression(Flowrate=filter, Airspeed=air_velocity, SF=safety_factor, Expression="Flowrate/1000/Airspeed*SF")
# Utilize airflow rate from energy model to calculate overall supply air duct dimension and dimensions of individual zone branches.
division_14 = Division(A=zone_by_zone_airflow, B=zone_branch_duct_aspect_ratio)
sqrt_2 = SquareRoot(Value=division_13)
division_15 = Division(A=floor_by_floor_airflow_3, B=sqrt_2)
sqrt_3 = SquareRoot(Value=division_14)
division_16 = Division(A=zone_by_zone_airflow, B=sqrt_3)
python_7 = GhPythonScript(x=division_15)  # -> a; same code as python_2
python_8 = GhPythonScript(x=sqrt_2)  # -> a; same code as python_2
python_9 = GhPythonScript(x=division_16)  # -> a; same code as python_2
python_10 = GhPythonScript(x=sqrt_3)  # -> a; same code as python_2

multiplication_12 = Multiplication(A=python_7, B=1000)
multiplication_13 = Multiplication(A=python_8, B=1000)
panel_39 = Panel(division_13)
concat_5 = Concatenate(FragmentA=multiplication_12, FragmentB=" x ", FragmentC=multiplication_13)  # -> flatten(Result)

x_dim_floor = Data(python_7)
y_dim_floor = Data(python_8)
division_17 = Division(A=x_dim_floor, B=-2)
division_18 = Division(A=x_dim_floor, B=2)
division_19 = Division(A=y_dim_floor, B=-2)
division_20 = Division(A=y_dim_floor, B=2)
offset_3 = OffsetCurve(Curve=move_2.Geometry, Distance=flatten(division_18), Corners=1)
offset_4 = OffsetCurve(Curve=move_2.Geometry, Distance=flatten(division_17), Corners=1)
boundary = BoundarySurfaces(Edges=flatten([offset_4, offset_3]))
Z_5 = UnitZ(Factor=division_19)
Z_6 = UnitZ(Factor=division_20)
extr = Extrude(Base=boundary, Direction=flatten(Z_5))
extr_2 = Extrude(Base=boundary, Direction=flatten(Z_6))

pdecon_6 = Deconstruct(Point=riser_points_on_roof)  # -> XComponent, YComponent, ZComponent
Z_7 = UnitZ(Factor=-1)
line = LineSDL(Start=riser_points_on_roof, Direction=Z_7, Length=pdecon_6.ZComponent)
split_19 = SplitWithBreps(Curve=line, Brep=flatten(sorted_floorplate_geometry))  # -> Curve, Points
midpt_3 = CurveMiddle(Curve=split_19.Curve)
lng_5 = ListLength(List=line)
pdecon_7 = Deconstruct(Point=midpt_3)  # -> XComponent, YComponent, ZComponent
end = EndPoints(Curve=split_19.Curve)  # -> Start, End
sort_13 = SortList(Keys=flatten(pdecon_7.ZComponent), ValuesA=flatten(split_19.Curve), ValuesB=flatten(end.Start))  # -> Keys, ValuesA, ValuesB
partition_3 = PartitionList(List=sort_13.ValuesA, Size=lng_5)
partition_4 = PartitionList(List=sort_13.ValuesB, Size=lng_5)
ma_15 = MassAddition(Input=flatten(floor_by_floor_airflow_3))  # -> Result, PartialResults
division_21 = Division(A=ma_15.Result, B=riser_aspect_ratio)
sqrt_4 = SquareRoot(Value=division_21)
division_22 = Division(A=ma_15.Result, B=sqrt_4)
python_11 = GhPythonScript(x=sqrt_4)  # -> a; same code as python_2
python_12 = GhPythonScript(x=division_22)  # -> a; same code as python_2
y_dim_floor_2 = Data(python_11)
x_dim_floor_2 = Data(python_12)
division_23 = Division(A=x_dim_floor_2, B=-2)
division_24 = Division(A=x_dim_floor_2, B=2)
division_25 = Division(A=y_dim_floor_2, B=-2)
division_26 = Division(A=y_dim_floor_2, B=2)
neg_4 = Negative(Value=return_air_riser_offset_m)
X = UnitX(Factor=[neg_4, return_air_riser_offset_m])
Y = UnitY(Factor=[return_air_riser_offset_m, neg_4])

lng_6 = ListLength(List=flatten(split_19.Curve))
repeat_7 = RepeatData(Data=cset_3.Set, Length=lng_6)
xy = XYPlane(Origin=partition_4)
angle = Angle(VectorA=abs_2, VectorB=vec.Vector, Plane=xy)  # -> Angle, Reflex
cset_4 = CreateSet(List=angle.Angle)  # -> Set, Map
sort_14 = SortList(Keys=cset_4.Set)  # -> Keys, ValuesA
item_62 = ListItem(List=sort_14.Keys, Index=0, Wrap=True)
prot = RotatePlane(Plane=xy, Angle=item_62)
pln = Plane(prot)

# ----
# Draw supply air riser and return air riser.
area_10 = Area(Geometry=sorted_zone_floorplate_edge_curve)  # -> Area, Centroid
Z_8 = UnitZ(Factor=subtraction_3)
neg_5 = Negative(Value=duct_height_m)
Z_9 = UnitZ(Factor=neg_5)
x_dim_floor_3 = Data(python_9)
y_dim_floor_3 = Data(python_10)
division_27 = Division(A=x_dim_floor_3, B=-2)
division_28 = Division(A=x_dim_floor_3, B=2)
division_29 = Division(A=y_dim_floor_3, B=-2)
division_30 = Division(A=y_dim_floor_3, B=2)
xy_2 = XYPlane(Origin=Point(0, 0, 0))
dom_4 = ConstructDomain(DomainStart=division_29, DomainEnd=division_30)
dom_5 = ConstructDomain(DomainStart=division_27, DomainEnd=division_28)
Z_10 = UnitZ(Factor=length_of_diffuser_m)
neg_6 = Negative(Value=Z_10)
dom_6 = ConstructDomain(DomainStart="-0.1", DomainEnd="0.1")
number_slider_2 = Slider(1.5, range=0..2)
Z_11 = UnitZ(Factor=division_29)
Z_12 = UnitZ(Factor=division_30)
sunion_2 = SolidUnion(Breps=[extr, extr_2])

cset_5 = CreateSet(List=Z_8)  # -> Set, Map

supply_air_ring_duct = Brep(sunion_2)

move_3 = Move(Geometry=graft(split_19.Points), Motion=reverse(graft(repeat_7)))  # -> Geometry, Transform

item_63 = ListItem(List=move_3.Geometry, Index=0, Wrap=True)  # -> Item, Item1
smaller_2 = SmallerThan(FirstNumber=item_63.Item, SecondNumber=item_63.Item1)  # -> SmallerThan, OrEqualTo
p_n_c_3 = PickNChoose(Pattern=smaller_2.SmallerThan, Stream0=item_63.Item1, Stream1=item_63.Item)

move_4 = Move(Geometry=area_10.Centroid, Motion=graft(cset_5.Set))  # -> Geometry, Transform
move_5 = Move(Geometry=move_4.Geometry, Motion=Z_9)  # -> Geometry, Transform
crv_cp = CurveClosestPoint(Point=move_5.Geometry, Curve=graft(move_2.Geometry))  # -> Point, Parameter, Distance

incurves = PointInCurves(Point=move_5.Geometry, Curves=join_4)  # -> Relationship, Index, Point
equals = Equality(FirstNumber=incurves.Relationship, SecondNumber=0)  # -> Equality, Inequality
move_6 = Move(Geometry=flatten(move_5.Geometry), Motion=item_33)  # -> Geometry, Transform
dispatch_3 = Dispatch(List=crv_cp.Point, DispatchPattern=equals.Inequality)  # -> ListA, ListB
# Draw branch ducts to each thermal zone as well as air diffusers at the end of the branch into the zone.
pt_3 = Point(flatten(dispatch_3.ListA))
xy_3 = XYPlane(Origin=move_5.Geometry)
partition_5 = PartitionList(List=pt_3, Size=tstat_2.Length)
partition_6 = PartitionList(List=move_6.Geometry, Size=tstat_2.Length)
tstat_3 = TreeStatistics(Tree=xy_3)  # -> Paths, Length, Count
ln = Line(StartPoint=partition_5, EndPoint=partition_6)
ext = ExtendCurve(Curve=ln, Type=0, Start=0, End=num)
partition_7 = PartitionList(List=item_33, Size=tstat_3.Length)
align = AlignPlane(Plane=xy_3, Direction=partition_7)  # -> Plane, Angle
Z_13 = UnitZ(Factor=align.Plane)

divide = DivideCurve(Curve=ext, Count=5, Kinks=False)  # -> Points, Tangents, Parameters
item_64 = ListItem(List=divide.Points, Index=-2, Wrap=True)
xy_4 = XYPlane(Origin=item_64)
offset_5 = OffsetCurve(Curve=ext, Distance=division_28, Plane=xy_2, Corners=1)
offset_6 = OffsetCurve(Curve=ext, Distance=division_27, Plane=xy_2, Corners=1)
rulesrf = RuledSurface(CurveA=offset_6, CurveB=offset_5)
rectangle = Rectangle(Plane=xy_4, XSize=dom_6, YSize=dom_6, Radius=0)  # -> Rectangle, Length
extr_3 = Extrude(Base=flatten(rulesrf), Direction=flatten(Z_12))  # -> graft(Extrusion)
extr_4 = Extrude(Base=flatten(rulesrf), Direction=flatten(Z_11))  # -> graft(Extrusion)
move_7 = Move(Geometry=rectangle.Rectangle, Motion=neg_6)  # -> Geometry, Transform
extr_5 = Extrude(Base=rectangle.Rectangle, Direction=neg_6)
scale_nu = ScaleNU(Geometry=move_7.Geometry, Plane=xy_4, ScaleX=number_slider_2, ScaleY=number_slider_2, ScaleZ=1)  # -> Geometry, Transform
extr_6 = ExtrudePoint(Base=scale_nu.Geometry, Point=xy_4)
sunion_3 = SolidUnion(Breps=[extr_3, extr_4])  # -> flatten(Result)
cap = CapHoles(Brep=extr_6)
sunion_4 = SolidUnion(Breps=[extr_5, cap])

vrot = Rotate(Vector=item_33, Axis=flatten(Z_13), Angle=1.570796327)
multiplication_14 = Multiplication(A=vrot, B=terminal_distance_from_center)

box = CenterBox(Base=align.Plane, X=item_58.Item2, Y=item_58.Item, Z=item_58.Item1)
box_2 = CenterBox(Base=align.Plane, X=item_59.Item2, Y=item_59.Item, Z=item_59.Item1)
colom = CollisionOneMany(Collider=box, Obstacles=supply_air_ring_duct)  # -> Collision, Index
move_8 = Move(Geometry=graft(box), Motion=graft(multiplication_14))  # -> Geometry, Transform
midpt_4 = CurveMiddle(Curve=ext)
move_9 = Move(Geometry=graft(box_2), Motion=multiplication_14)  # -> Geometry, Transform
box_3 = CenterBox(Base=midpt_4, X="0.6", Y="0.6", Z="0.6")
item_65 = ListItem(List=move_8.Geometry, Index=0, Wrap=True)
item_66 = ListItem(List=move_9.Geometry, Index=0, Wrap=True)
filter_2 = StreamFilter(Gate=item_61, Stream0=box_3, Stream1=item_65, Stream2=item_66)

item_67 = ListItem(List=flatten(align.Plane), Index=0, Wrap=True)
align_2 = AlignPlanes(Planes=pt, Master=item_67)
align_3 = AlignPlanes(Planes=pt_2, Master=item_67)

division_31 = Division(A=division_8, B=lng_5)
sqrt_5 = SquareRoot(Value=division_31)
division_32 = Division(A=sqrt_5, B=2)
neg_7 = Negative(Value=division_32)
dom_7 = ConstructDomain(DomainStart=neg_7, DomainEnd=division_32)
rectangle_2 = Rectangle(Plane=align_2, XSize=dom_7, YSize=dom_7, Radius=0)  # -> Rectangle, Length
rectangle_3 = Rectangle(Plane=align_3, XSize=dom_3, YSize=dom_3, Radius=0)  # -> Rectangle, Length
extr_7 = Extrude(Base=rectangle_2.Rectangle, Direction=Z_3)
extr_8 = Extrude(Base=rectangle_3.Rectangle, Direction=Z_4)
cap_2 = CapHoles(Brep=extr_7)
cap_3 = CapHoles(Brep=extr_8)
scale_nu_2 = ScaleNU(Geometry=cap_2, Plane=pln, ScaleX=number_slider, ScaleY=number_slider, ScaleZ=1)  # -> Geometry, Transform
filter_3 = StreamFilter(Gate=list, Stream0=cap_2, Stream1=cap_2, Stream2=cap_2, Stream3=scale_nu_2.Geometry)

filter_4 = StreamFilter(Gate=list, Stream0=cap_3, Stream1=cap_3, Stream2=cap_3)

mechanical_rooms = Brep([filter_3, filter_4])
zone_supply_air_branch = Brep(sunion_3)
terminal_equipment = Brep(filter_2)
zone_diffuser = Brep(sunion_4)

preview = CustomPreview(Geometry=mechanical_rooms, Material=ColourSwatch(SwatchColor=RGBA(255, 0, 0, 200)))
preview_2 = CustomPreview(Geometry=[terminal_equipment, zone_diffuser], Material=ColourSwatch(SwatchColor=RGBA(255, 123, 0, 200)))

move_10 = Move(Geometry=p_n_c_3, Motion=Z)  # -> Geometry, Transform
pdecon_8 = Deconstruct(Point=move_10.Geometry)  # -> XComponent, YComponent, ZComponent
sort_15 = SortList(Keys=flatten(pdecon_8.ZComponent), ValuesA=flatten(move_10.Geometry), ValuesB=flatten(move_10.Geometry))  # -> Keys, ValuesA, ValuesB

partition_8 = PartitionList(List=sort_15.ValuesA, Size=lng_5)
tstat_4 = TreeStatistics(Tree=partition_8)  # -> Paths, Length, Count
replace = ReplacePaths(Data=partition_8, Search=tstat_4.Paths, Replace=reverse(tstat_4.Paths))

crv_cp_2 = CurveClosestPoint(Point=partition_8, Curve=graft(move_2.Geometry))  # -> Point, Parameter, Distance
ln_2 = Line(StartPoint=partition_8, EndPoint=crv_cp_2.Point)

ln_3 = Line(StartPoint=replace, EndPoint=crv_cp_2.Point)
len_5 = Length(Curve=ln_3)
len_6 = Length(Curve=ln_2)
smaller_3 = SmallerThan(FirstNumber=len_5, SecondNumber=len_6)  # -> SmallerThan, OrEqualTo
p_n_c_4 = PickNChoose(Pattern=smaller_3.SmallerThan, Stream0=ln_2, Stream1=ln_3)

lng_7 = ListLength(List=p_n_c_4)
division_33 = Division(A=division_25, B=lng_7)
division_34 = Division(A=division_26, B=lng_7)
division_35 = Division(A=division_23, B=lng_7)
division_36 = Division(A=division_24, B=lng_7)
dom_8 = ConstructDomain(DomainStart=division_33, DomainEnd=division_34)
dom_9 = ConstructDomain(DomainStart=division_35, DomainEnd=division_36)
rectangle_4 = Rectangle(Plane=pln, XSize=dom_9, YSize=dom_8, Radius=0)  # -> Rectangle, Length
extrcrv = ExtrudeAlong(Base=rectangle_4.Rectangle, Curve=partition_3)
cap_4 = CapHoles(Brep=flatten(extrcrv))
sunion_5 = SolidUnion(Breps=cap_4)

# ----
# Draw branch ducts from the supply air riser to the main supply air duct in every floor.
x_dim_floor_4 = Data(python_7)
y_dim_floor_4 = Data(python_8)
division_37 = Division(A=x_dim_floor_4, B=-2)
division_38 = Division(A=x_dim_floor_4, B=2)
division_39 = Division(A=y_dim_floor_4, B=-2)
division_40 = Division(A=y_dim_floor_4, B=2)
division_41 = Division(A=division_39, B=lng_7)
division_42 = Division(A=division_40, B=lng_7)
division_43 = Division(A=division_37, B=lng_7)
division_44 = Division(A=division_38, B=lng_7)
offset_7 = OffsetCurve(Curve=p_n_c_4, Distance=division_44, Plane=crv_cp_2.Point, Corners=1)
offset_8 = OffsetCurve(Curve=p_n_c_4, Distance=division_43, Plane=crv_cp_2.Point, Corners=1)
rulesrf_2 = RuledSurface(CurveA=offset_8, CurveB=offset_7)  # -> flatten(Surface)
partition_9 = PartitionList(List=rulesrf_2, Size=lng_5)
Z_14 = UnitZ(Factor=division_41)
Z_15 = UnitZ(Factor=division_42)
extr_9 = Extrude(Base=partition_9, Direction=Z_14)
extr_10 = Extrude(Base=partition_9, Direction=Z_15)
sunion_6 = SolidUnion(Breps=[extr_9, extr_10])

volume = Volume(Geometry=sunion_5)  # -> Volume, Centroid
scale_nu_3 = ScaleNU(Geometry=sunion_5, Plane=volume.Centroid, ScaleX=0.75, ScaleY=0.75, ScaleZ=1)  # -> Geometry, Transform

move_11 = Move(Geometry=graft(scale_nu_3.Geometry), Motion=[X, Y])  # -> Geometry, Transform
colom_2 = CollisionOneMany(Collider=move_11.Geometry, Obstacles=flatten([sunion_3, sunion_6, sunion_2]))  # -> Collision, Index
dispatch_4 = Dispatch(List=move_11.Geometry, DispatchPattern=colom_2.Collision)  # -> ListA, ListB
item_68 = ListItem(List=dispatch_4.ListB, Index=alternate_return_air_riser_location, Wrap=True)

supply_air_riser_branch = Brep(sunion_6)
return_air_riser = Brep(item_68)
supply_air_riser = Brep(sunion_5)

preview_3 = CustomPreview(Geometry=[supply_air_riser_branch, supply_air_ring_duct, supply_air_riser, zone_supply_air_branch], Material=swatch)
preview_4 = CustomPreview(Geometry=return_air_riser, Material=ColourSwatch(SwatchColor=RGBA(242, 255, 0, 200)))

# ==== cluster Cluster
G = ClusterInput()
A = ClusterInput()
area = Area(Geometry=G)  # -> Area, Centroid
division = Division(A=A, B="100")
sqrt = SquareRoot(Value=division)
scale = Scale(Geometry=G, Center=area.Centroid, Factor=sqrt)  # -> Geometry, Transform
G_2 = ClusterOutput(scale.Geometry)

# ==== cluster Cluster_2
brep = ClusterInput()
brep_2 = Brep(brep)
area = Area(Geometry=brep_2)  # -> Area, Centroid
evalsrf = EvaluateSurface(Surface=brep_2, Point=area.Centroid)  # -> Point, Normal, UDirection, VDirection, Frame
rev = Reverse(Vector=evalsrf.Normal)
move = Move(Geometry=brep_2, Motion=expr("x*0.01", graft([evalsrf.Normal, rev])))  # -> Geometry, Transform
panel = Panel(evalsrf.Normal)
G = ClusterOutput(move.Geometry)
