# Grasshopper definition HVACER_v3.2.gh (Grasshopper 1.0.8)
# plug-ins: RhinoCodePluginGH, ClimateStudioGH

building_program = ValueList({"OFFICE", "APARTMENT"}, selected="OFFICE")
main_zone_template = GetCSSpaceUseTemplate(Selection="90.1-2019 MediumOffice - OpenOffice ")
addt_l_zone_template = GetCSSpaceUseTemplate(Selection="90.1-2019 Office - Corridor ")

# ----
# STEP 1: Select the weather file for your project.
weathersearch = SearchForWeather(
    Selection="C:\ProgramData\Solemma\Common\WeatherData\EPW\USA_MA_Boston-Logan.Intl.AP.725090_TMYx.2004-2018.epw",
    UnitSystem=4)
epw_directory = Panel(weathersearch)

# ----
# STEP 2: Define emission factors and costs for electricity and natural gas for your location.
emission = CSEmissionFactor(Settings="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")  # -> EmissionFactors, EmissionFactorsSummary

# ----
# STEP 3C: Specify the approximate window to wall ratio for your project.
window_to_wall_ratio = Slider(40, range=1..99)

# ----
# STEP 3D: Define exterior shading objects such as context.
shading = Surface()  # disabled

# ----
# STEP 4A: Define location for simulation output. Select a directory using the File Path component. Ensure the folder location has no spaces in the name.
path = FilePath("C:\Users\airan\Desktop\SCRIPT\CB\")
simulation_directory = Panel(path)

# ----
# CONSTRUCTION SETTINGS
# (WHOLE BUILDING)
# STEP 3B: Then select the construction template for your building.
construction_template = GetCSConstructionTemplate(Selection="90.1-2019 Office CZ 5")

simulate_all_energy_performance = Button()
perform_sizing_calculation = Button()

# ----
# SPACE USE SETTINGS
# GEOMETRY
# In Rhino, place all thermal zone geometry (closed polysurfaces) into a layer named THERMAL ZONE 1. This corresponds to the main space use type in your building. You only need one space type but can use up to 2 with this script. If you have more than one space use type, place all main zone geometry under THERMAL ZONE 1 and place all secondary zone geometry under a layer named THERMAL ZONE 2.
# STEP 3A: First, select whether your building has primarily office or apartment program from the drop down list. Then select the space use template for each of your two primary thermal zone types.
thermal_zone_2 = GeometryPipeline(
    GroupByLayer=False,
    GroupByType=False,
    IncludeHidden=True,
    IncludeLocked=False,
    LayerFilter="THERMAL ZONE 2",
    NameFilter="*",
    SublayerFiltering=True,
    TypeFilter=1073741848)
thermal_zone_1 = GeometryPipeline(
    GroupByLayer=False,
    GroupByType=False,
    IncludeHidden=True,
    IncludeLocked=False,
    LayerFilter="THERMAL ZONE 1",
    SublayerFiltering=True,
    TypeFilter=1073741848)

# ----
# 1. HVAC SPATIAL LAYOUT
# BASIC DESIGN PARAMETERS
# STEP 1A: First, choose whether you want your ductwork as a ring (offset from facade) or follwing corridors (you will have to draw and define the corridor ceiling centerlines).
# If you select OFFSET FROM FACADE, specify the offset distance for your supply duct. If you select CORRIDOR CENTERLINES, for all corridor zones, draw one or more polylines on the ceiling corresponding to the main supply duct location. Each floor should have at least one corridor centerline.
# STEP 1B: Select your riser locations on the roof of your building. One riser minimum is needed.
# Define and reference points on the roof corresponding to your vertical risers. One minimum riser necessary.
# STEP 1C: Select your desired HVAC system.
# Select HVAC system.
# STEP 1D: Select the desired aspect ratio for all ductwork.
# Specify the aspect ratio for your main supply duct as well as the branch ducts in each thermal zone.
# STEP 1E: Modify the placement and geometry of the main ductwork by modifying this parameter.
# The duct height is the height of the primary supply air duct above the floor.
list = ValueList({"Variable Air Volume": 0, "Fan Coil Units with Dedicated Outdoor Air System": 1, "Variable Refrigerant Flow Units with Dedicated Outdooor Air System": 2}, selected="Fan Coil Units with Dedicated Outdoor Air System")
duct_height_m = Slider(3, range=0..4)
riser_points_on_roof = Point(Point(-31, 5, 14.4))

# ----
# TASK B - SPATIAL DESIGN
# OVERVIEW: In this portion of the exercise, you will design the spatial layout of your selected HVAC system. Please follow the steps below to modify the geometry of the HVAC system based on spatial and aesthetic considerations.
list_2 = ValueList({"OFFSET FROM FACADE": 0, "CORRIDOR CENTERLINE": 1}, selected="OFFSET FROM FACADE")
offset_distance_from_facade_m = Slider(3, range=-10..10)
corridor_centerline = Curve([<curve referenced from the Rhino model> x4])

main_supply_duct_aspect_ratio = Slider(2, range=1..4)
zone_branch_duct_aspect_ratio = Slider(2, range=1..4)

brep = Brep(thermal_zone_1)
brep_2 = Brep(thermal_zone_2)
Z = UnitZ(Factor=0.3)
Z_2 = UnitZ(Factor=1)

# ----
# Variable Refrigerant Flow (VRF) with Dedicated Outdoor Air System (DOAS)
# Fan Coil Units (FCU) with Dedicated Outdoor Air System (DOAS)
# Ideal Air Loads System
# Variable Air Volume (VAV)
# AREA REQUIREMENTS PER FLOOR
# (sq.m)
# STEP 4: Given the performance metrics from the table above as well as your understanding of HVAC systems, please indicate which system you would select for your building? Please indicate why and provide a discussion of the energy, cost, and space requirements for your selected system.
panel = Panel("ANNUAL OPERATING COST")
panel_2 = Panel("FIRST COST")
panel_3 = Panel("""EUI
(kWh/sq.m)""")
panel_4 = Panel("""OPERATING CARBON
(tons CO2)""")
panel_5 = Panel("SYSTEM TYPE")

# ----
# STEP 2: When you have finalized your HVAC system layout, please take a screenshot of your final design. Also incluse your Rhino model and GH for the assignment submission.
swatch = ColourSwatch(SwatchColor=RGBA(255, 0, 0, 200))
thermal_zones = CustomPreview(Geometry=thermal_zone_1, Material=ColourSwatch(SwatchColor=RGBA(214, 212, 212, 70)))
thermal_zones_2 = CustomPreview(Geometry=thermal_zone_2, Material=ColourSwatch(SwatchColor=RGBA(242, 136, 136, 15)))

# ----
# Split program by level and assign thermal zones by every floor.
merge_all_programs = Entwine(Branch00=brep, Branch01=brep_2, FlattenInputs=True)
bang = ExplodeTree(Data=merge_all_programs)  # -> Branch0, Branch1
lng = ListLength(List=bang.Branch0)
lng_2 = ListLength(List=bang.Branch1)
repeat = RepeatData(Data=building_program, Length=lng)
repeat_2 = RepeatData(Data="CORRIDOR", Length=lng_2)
merge = Merge(Data1=repeat, Data2=repeat_2)  # -> flatten(Result)

# ----
# Intersect input BREP geometry and assign, unique zone names to each thermal zone in building.
intersector = CSIntersector(Brep=merge_all_programs)
lng_3 = ListLength(List=intersector)  # -> flatten(Length)
partition = PartitionList(List=flatten(intersector), Size=lng_3)  # -> flatten(Chunks)
debrep = DeconstructBrep(Brep=partition)  # -> Faces, Edges, Vertices
evalsrf = EvaluateSurface(Surface=debrep.Faces, Point="0.5,0.5")  # -> Point, Normal, UDirection, VDirection, Frame
devec = DeconstructVector(Vector=evalsrf.Normal)  # -> XComponent, YComponent, ZComponent
abs = Absolute(Value=devec.ZComponent)
larger = LargerThan(FirstNumber=abs, SecondNumber=0.1)  # -> LargerThan, OrEqualTo
dispatch = Dispatch(List=debrep.Faces, DispatchPattern=larger.LargerThan)  # -> ListA, ListB
srf = Surface(dispatch.ListA)
area = Area(Geometry=srf)  # -> Area, Centroid
sort = SortList(Keys=area.Area, ValuesA=dispatch.ListA)  # -> reverse(Keys), reverse(ValuesA)
item = ListItem(List=sort.ValuesA, Index=0, Wrap=True)  # -> Item, Item1
srf_2 = Surface([item.Item1, item.Item])
srf_3 = Surface(dispatch.ListB)
evalsrf_2 = EvaluateSurface(Surface=srf_3, Point="0.5,0.5")  # -> Point, Normal, UDirection, VDirection, Frame
area_2 = Area(Geometry=srf_2)  # -> Area, Centroid
area_3 = Area(Geometry=srf_3)  # -> Area, Centroid
pdecon = Deconstruct(Point=area_2.Centroid)  # -> XComponent, YComponent, ZComponent
sort_2 = SortList(Keys=area_3.Area, ValuesA=srf_3, ValuesB=evalsrf_2.Normal)  # -> reverse(Keys), reverse(ValuesA), reverse(ValuesB)
sort_3 = SortList(Keys=pdecon.ZComponent, ValuesA=srf_2)  # -> Keys, ValuesA
item_2 = ListItem(List=sort_2.ValuesB, Index=0, Wrap=True)  # -> flatten(Item)
item_3 = ListItem(List=sort_3.ValuesA, Index=0, Wrap=True)
srf_4 = Surface(item_3)

all_programs = Brep(flatten(intersector))
area_4 = Area(Geometry=flatten(srf_4))  # -> Area, Centroid
pdecon_2 = Deconstruct(Point=area_4.Centroid)  # -> XComponent, YComponent, ZComponent
sort_4 = SortList(Keys=pdecon_2.ZComponent, ValuesA=merge)  # -> Keys, ValuesA
python = GhPythonScript(x=pdecon_2.ZComponent)  # -> a
# ---------- python: Python ----------
__author__ = "airan"
__version__ = "2023.09.28"

import rhinoscriptsyntax as rs

a = round(x,1);
# ---------- end python ----------
python_2 = GhPythonScript(x=sort_4.Keys)  # -> a; same code as python
cset = CreateSet(List=python_2)  # -> Set, Map
mindex = MemberIndex(Set=python, Member=cset.Set)  # -> Index, Count
item_4 = ListItem(List=flatten(intersector), Index=mindex.Index, Wrap=True)
item_5 = ListItem(List=all_programs, Index=mindex.Index, Wrap=True)
item_6 = ListItem(List=merge, Index=mindex.Index, Wrap=True)
item_7 = ListItem(List=merge, Index=mindex.Index, Wrap=True)
cset_2 = CreateSet(List=item_7)  # -> Set, Map
tmatch = MatchText(Text=item_6, RegEx="CORRIDOR", Case=True)
sorted_tz = Brep(item_5)

# ----
# Define unique names for each thermal zone.
tstat = TreeStatistics(Tree=item_5)  # -> Paths, Length, Count
series = Series(Start=1, Step=1, Count=tstat.Count)  # -> simplify(graft(Series))
series_2 = Series(Start=1, Step=1, Count=graft(mindex.Count))  # -> simplify(Series)
dispatch_2 = Dispatch(List=sorted_tz, DispatchPattern=tmatch)  # -> ListA, ListB
concat = Concatenate(FragmentA="FLR_", FragmentB=series, FragmentC="_ZONE_", FragmentD=series_2, FragmentF="_", FragmentH=item_6)

# ----
# Deconstruct thermal zone geometry, extracting floor edges and full floorplate geometry.
sunion = SolidUnion(Breps=sorted_tz)
fmerge = MergeFaces(Brep=sunion)  # -> Breps, Before, After
debrep_2 = DeconstructBrep(Brep=sorted_tz)  # -> Faces, Edges, Vertices
debrep_3 = DeconstructBrep(Brep=fmerge.Breps)  # -> Faces, Edges, Vertices
area_5 = Area(Geometry=debrep_2.Faces)  # -> Area, Centroid
area_6 = Area(Geometry=debrep_3.Faces)  # -> Area, Centroid
devec_2 = DeconstructVector(Vector=area_6.Centroid)  # -> XComponent, YComponent, ZComponent
devec_3 = DeconstructVector(Vector=area_5.Centroid)  # -> XComponent, YComponent, ZComponent
sort_5 = SortList(Keys=devec_3.ZComponent, ValuesA=debrep_2.Faces)  # -> Keys, ValuesA, ValuesB
sort_6 = SortList(Keys=devec_2.ZComponent, ValuesA=debrep_3.Faces)  # -> Keys, ValuesA
item_8 = ListItem(List=sort_5.ValuesA, Index=0, Wrap=True)
item_9 = ListItem(List=sort_6.ValuesA, Index=-1, Wrap=True)
item_10 = ListItem(List=sort_6.ValuesA, Index=0, Wrap=True)
edges = BrepEdges(Brep=item_10)  # -> Naked, Interior, NonManifold
edges_2 = BrepEdges(Brep=item_8)  # -> simplify(Naked), Interior, NonManifold
join = JoinCurves(Curves=edges_2.Naked, Preserve=False)  # -> flatten(Curves)
lng_4 = ListLength(List=sorted_tz)  # -> flatten(Length)
edges_3 = BrepEdges(Brep=item_9)  # -> Naked, Interior, NonManifold
partition_2 = PartitionList(List=join, Size=lng_4)
join_2 = JoinCurves(Curves=edges_3.Naked, Preserve=False)
len = Length(Curve=join_2)
sorted_zone_floorplate_edge_curve = Curve(partition_2)
sort_7 = SortList(Keys=len, ValuesA=join_2)  # -> reverse(Keys), reverse(ValuesA)
sorted_full_floor_geometry = Brep(flatten(fmerge.Breps))
sorted_floorplate_edge_curve = Curve(edges.Naked)
item_11 = ListItem(List=sort_7.ValuesA, Index=0, Wrap=True)

item_12 = ListItem(List=item_2, Index=mindex.Index, Wrap=True)  # -> flatten(Item)

secondary_zone_template = Data(addt_l_zone_template)
main_zone_template_2 = Data(main_zone_template)
ground_bco = CSharpScript(ZSetIn=secondary_zone_template)  # -> ZSetOut
# ---------- ground_bco: C# ----------
// Grasshopper Script Instance
#region Usings
using System;
#r "C:\Program Files\Solemma\ClimateStudio\bin\ClimateStudioLib.dll"
using System.Linq;
using System.Collections;
using System.Collections.Generic;
using System.Drawing;

using Rhino;
using Rhino.Geometry;

using Grasshopper;
using Grasshopper.Kernel;
using Grasshopper.Kernel.Data;
using Grasshopper.Kernel.Types;
#endregion

using CSEnergyLib.LibraryObjects;

public class Script_Instance : GH_ScriptInstance
{
    #region Notes
/// <summary>Print a String to the [Out] Parameter of the Script component.</summary>
  /// <param name="text">String to print.</param>
    private void Print(string text) { /* Implementation hidden. */ }
  /// <summary>Print a formatted String to the [Out] Parameter of the Script component.</summary>
  /// <param name="format">String format.</param>
  /// <param name="args">Formatting parameters.</param>
    private void Print(string format, params object[] args) { /* Implementation hidden. */ }
  /// <summary>Print useful information about an object instance to the [Out] Parameter of the Script component. </summary>
  /// <param name="obj">Object instance to parse.</param>
    private void Reflect(object obj) { /* Implementation hidden. */ }
  /// <summary>Print the signatures of all the overloads of a specific method to the [Out] Parameter of the Script component. </summary>
  /// <param name="obj">Object instance to parse.</param>
    private void Reflect(object obj, string method_name) { /* Implementation hidden. */ }

  /// <summary>Gets the current Rhino document.</summary>
    private readonly RhinoDoc RhinoDocument;
  /// <summary>Gets the Grasshopper document that owns this script.</summary>
    private readonly GH_Document GrasshopperDocument;
  /// <summary>Gets the Grasshopper script component that owns this script.</summary>
    private readonly IGH_Component Component;
  /// <summary>
  /// Gets the current iteration count. The first call to RunScript() is associated with Iteration==0.
  /// Any subsequent call within the same solution will increment the Iteration count.
  /// </summary>
    private readonly int Iteration;

  /// <summary>
  /// This procedure contains the user code. Input parameters are provided as regular arguments,
  /// Output parameters as ref arguments. You don't have to assign output parameters,
  /// they will have a default value.
  /// </summary>
    #endregion

    private void RunScript(object ZSetIn, ref object ZSetOut)
    {
        var settings = ZSetIn as CSEnergyLib.LibraryObjects.CSZoneDefinition;
            if (settings == null)
        {
        Print("Warning: ZSetIn is null or not of type Settings_IdealAirLoad. Initializing a new instance.");
        settings = new CSEnergyLib.LibraryObjects.CSZoneDefinition();
        }
        settings.Constructions.SlabConstruction = "ConcreteFloor";
        settings.Constructions.GroundSlabConstruction = "ConcreteOnGrade";
        settings.Constructions.ExternalFloorConstruction = "ConcreteOnGrade";
    ZSetOut = settings;
    }

    public override BoundingBox ClippingBox => BoundingBox.Empty;

    public override void DrawViewportMeshes(IGH_PreviewArgs args)
    {
    }

    public override void DrawViewportWires(IGH_PreviewArgs args)
    {
    }
}
# ---------- end ground_bco ----------
ground_bco_2 = CSharpScript(ZSetIn=main_zone_template_2)  # -> ZSetOut; same code as ground_bco
panel_6 = Panel("""Output:Meter:MeterFileOnly,  InteriorLights:Electricity,Hourly;
Output:Meter:MeterFileOnly,  InteriorEquipment:Electricity,Hourly; """)
weatherfile = Data(weathersearch)
wwr = Division(A=window_to_wall_ratio, B=100)
directory = Data(path)
name = Text("HVAC_MODEL_")
dispatch_3 = Dispatch(List=concat, DispatchPattern=tmatch)  # -> ListA, ListB
dispatch_4 = Dispatch(List=item_4, DispatchPattern=tmatch)  # -> ListA, ListB
additional_brep = Brep(flatten(dispatch_4.ListA))
main_brep = Brep(flatten(dispatch_4.ListB))
zone_setting = CSMakeEnergyZoneSetting(SpaceUseTemplate=ground_bco_2, ConstructionTemplate=construction_template)
zone_setting_2 = CSMakeEnergyZoneSetting(SpaceUseTemplate=ground_bco, ConstructionTemplate=construction_template)
zone_win = CSEnergyZoneWithWindows(
    Brep=main_brep,
    Name=flatten(dispatch_3.ListB),
    ZoneSetting=zone_setting,
    WindowToWallRatio=wwr,
    Settings="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",
    UsedLibraryObjects="Cg4yLjAuODk5MS4yOTY0OBILCNSD89CAp8Q9EAU=")  # -> Zones, ZoneSetting
zone_win_2 = CSEnergyZoneWithWindows(
    Brep=additional_brep,
    Name=flatten(dispatch_3.ListA),
    ZoneSetting=zone_setting_2,
    WindowToWallRatio=wwr,
    Settings="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",
    UsedLibraryObjects="Cg4yLjAuODk5MS4yOTY0OBILCNKi3tKAp8Q9EAU=")  # -> Zones, ZoneSetting
all_zones = Data([zone_win.Zones, zone_win_2.Zones])
toggle = BooleanToggle(False)
ial = IALSystem(Zones=all_zones, Name="IAL", Settings="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")  # -> System, Settings
vav = VAVSystem(Zones=all_zones, Name="VAV", Settings="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")  # -> System, Settings
vrf = VRFSystem(Zones=all_zones, Name="VRF", Settings="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")  # -> System, Settings
fcu = DOASFCUSystem(Zones=all_zones, Name="FCU", Settings="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")  # -> System, Settings
model = CSModelMaker(Systems=fcu.System, Shading=shading, Idf=panel_6)  # -> Model, Invalid
model_2 = CSModelMaker(Systems=vrf.System, Shading=shading, Idf=panel_6)  # -> Model, Invalid
model_3 = CSModelMaker(Systems=vav.System, Shading=shading, Idf=panel_6)  # -> Model, Invalid
model_4 = CSModelMaker(Systems=ial.System, Shading=shading, Idf=panel_6)  # -> Model, Invalid
concat_2 = Concatenate(FragmentA=name, FragmentB="FCU")
concat_3 = Concatenate(FragmentA=name, FragmentB="VRF")
concat_4 = Concatenate(FragmentA=name, FragmentB="VAV")
concat_5 = Concatenate(FragmentA=name, FragmentB="IAL")
run_e = RunCSEnergyModel(
    Model=model_2.Model,
    Name=concat_3,
    Directory=directory,
    Location=weatherfile,
    EmissionFactors=emission.EmissionFactors,
    Run=simulate_all_energy_performance,
    NorthOffset=0,
    settings="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")  # -> Model, Settings, Result
run_e_2 = RunCSEnergyModel(
    Model=model_3.Model,
    Name=concat_4,
    Directory=directory,
    Location=weatherfile,
    EmissionFactors=emission.EmissionFactors,
    Run=simulate_all_energy_performance,
    NorthOffset=0,
    settings="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")  # -> Model, Settings, Result
run_e_3 = RunCSEnergyModel(
    Model=model.Model,
    Name=concat_2,
    Directory=directory,
    Location=weatherfile,
    EmissionFactors=emission.EmissionFactors,
    Run=simulate_all_energy_performance,
    NorthOffset=0,
    settings="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")  # -> Model, Settings, Result
run_e_4 = RunCSEnergyModel(
    Model=model_4.Model,
    Name=concat_5,
    Directory=directory,
    Location=weatherfile,
    EmissionFactors=emission.EmissionFactors,
    Run=perform_sizing_calculation,
    NorthOffset=0,
    settings="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")  # -> Model, Settings, Result
demodel = DeconstructCSEnergyModel(
    Model=model_4.Model,
    Output_0_Hidden=False,
    Output_0_Name="Facade",
    Output_10_Hidden=True,
    Output_10_Name="Adiabatic Roof",
    Output_11_Hidden=False,
    Output_11_Name="Window",
    Output_12_Hidden=True,
    Output_12_Name="Internal Window",
    Output_13_Hidden=True,
    Output_13_Name="Shading",
    Output_14_Hidden=True,
    Output_14_Name="Face ID",
    Output_15_Hidden=True,
    Output_15_Name="ID Location",
    Output_16_Hidden=True,
    Output_16_Name="Area",
    Output_17_Hidden=True,
    Output_17_Name="Zone Settings",
    Output_18_Hidden=True,
    Output_18_Name="Window Settings",
    Output_19_Hidden=True,
    Output_19_Name="Internal Window Settings",
    Output_1_Hidden=False,
    Output_1_Name="Partition",
    Output_2_Hidden=False,
    Output_2_Name="Ceiling",
    Output_3_Hidden=False,
    Output_3_Name="Roof",
    Output_4_Hidden=False,
    Output_4_Name="External Floor"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)  # -> Facade, Partition, Ceiling, Roof, ExternalFloor, Floor, FloorGround, AdiabaticFloor, Window
srf_5 = Surface(flatten(demodel.Window))
srf_6 = Surface([demodel.AdiabaticFloor, demodel.Floor, demodel.ExternalFloor, demodel.FloorGround, demodel.Roof, demodel.Ceiling, demodel.Partition, demodel.Facade])
py3 = Python3Script()  # -> out, a; inputs x: list; unedited script template
energy_results = LoadCSEnergyResult(ThermalModel=run_e_4.Model, Mode=0, Resolution=0, Toggle=Toggle(True))  # -> TotalEUI, Baseline, TotalCO2, TotalCost, FloorArea, Data, Labels, Months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
panel_7 = Panel("""Cooling:Electricity*
Heating:Electricity*
Fans:Electricity*
Pumps:Electricity*
Humidifier:Electricity*
HeatRejection:Electricity*
InteriorLights:Electricity*
InteriorEquipment:Electricity*""")
meter_results = LoadCSMeterResults(ThermalModel=run_e_3.Model, Toggle=Toggle(True))  # -> Results, Labels
meter_results_2 = LoadCSMeterResults(ThermalModel=run_e.Model, Toggle=Toggle(True))  # -> Results, Labels
meter_results_3 = LoadCSMeterResults(ThermalModel=run_e_2.Model, Toggle=Toggle(True))  # -> Results, Labels
round = Round(Number=energy_results.TotalEUI)  # -> Nearest, Floor, Ceiling
tmatch_2 = MatchText(Text=meter_results_2.Labels, Pattern=graft(panel_7), Case=True)
tmatch_3 = MatchText(Text=meter_results.Labels, Pattern=graft(panel_7), Case=True)
tmatch_4 = MatchText(Text=meter_results_3.Labels, Pattern=graft(panel_7), Case=True)
tmatch_5 = MatchText(Text=meter_results.Labels, Pattern="Heating:NaturalGas*", Case=True)
tmatch_6 = MatchText(Text=meter_results_3.Labels, Pattern="Heating:NaturalGas*", Case=True)
bool = Boolean(True)
bool_2 = Boolean(True)
bool_3 = Boolean(True)
bool_4 = Boolean(True)
bool_5 = Boolean(True)
mindex_2 = MemberIndex(Set=tmatch_3, Member=bool_2)  # -> flatten(Index), Count
mindex_3 = MemberIndex(Set=tmatch_2, Member=bool)  # -> flatten(Index), Count
mindex_4 = MemberIndex(Set=tmatch_4, Member=bool_4)  # -> flatten(Index), Count
mindex_5 = MemberIndex(Set=tmatch_5, Member=bool_3)  # -> Index, Count
mindex_6 = MemberIndex(Set=tmatch_6, Member=bool_5)  # -> Index, Count
branch = TreeBranch(Tree=meter_results.Results, Path=mindex_2.Index, MaintainPaths=True)
branch_2 = TreeBranch(Tree=meter_results.Results, Path=mindex_5.Index, MaintainPaths=True)
branch_3 = TreeBranch(Tree=meter_results_3.Results, Path=mindex_4.Index, MaintainPaths=True)
branch_4 = TreeBranch(Tree=meter_results_2.Results, Path=mindex_3.Index, MaintainPaths=True)
branch_5 = TreeBranch(Tree=meter_results_3.Results, Path=mindex_6.Index, MaintainPaths=True)
ma = MassAddition(Input=flatten(branch_2))  # -> Result, PartialResults
ma_2 = MassAddition(Input=flatten(branch_3))  # -> Result, PartialResults
ma_3 = MassAddition(Input=flatten(branch_5))  # -> Result, PartialResults
ma_4 = MassAddition(Input=flatten(branch_4))  # -> Result, PartialResults
ma_5 = MassAddition(Input=flatten(branch))  # -> Result, PartialResults
toggle_2 = BooleanToggle(True)
heating_load = LoadCSZoneResults(
    ThermalModel=run_e_4.Model,
    Toggle=toggle_2,
    byzone="True",
    settings="""{
  "zoneIDs": [],
  "output2Display": [
    {
      "key": "Zone Ideal Loads Supply Air Total Heating Energy",
      "unit": "HVAC Sum [J]",
      "type": 0
    }
  ],
  "normalizeByFloorArea": false
}""")  # -> ResultsPerZone, Labels, Name, Zone
cooling_load = LoadCSZoneResults(
    ThermalModel=run_e_4.Model,
    Toggle=toggle_2,
    byzone="True",
    settings="""{
  "zoneIDs": [],
  "output2Display": [
    {
      "key": "Zone Ideal Loads Supply Air Total Cooling Energy",
      "unit": "HVAC Sum [J]",
      "type": 0
    }
  ],
  "normalizeByFloorArea": false
}""")  # -> ResultsPerZone, Labels, Name, Zone
data = Data(0)
entwine = Entwine(Branch00=ma_2.Result, Branch01=ma_5.Result, Branch02=ma_4.Result, FlattenInputs=True)  # -> simplify(Result)
entwine_2 = Entwine(Branch00=ma_3.Result, Branch01=ma.Result, Branch02=data, FlattenInputs=True)  # -> simplify(Result)

# ----
# TASK A - PERFORMANCE BASED DESIGN
# OVERVIEW: In this portion of the exercise, you will evaluate the performance of 4 different HVAC systems. Please follow the steps below to setup your model and initiate your simulation. You will then proceed to compare the systems based on first cost, operating cost, operating carbon, payback period, and space requirements.
# 
# In Rhino, place all thermal zone geometry (closed polysurfaces) into a layer named THERMAL ZONE 1. This corresponds to the main space use type in your building. You only need one space type but can use up to 2 with this script. If you have more than one space use type, place all main zone geometry under THERMAL ZONE 1 and place all secondary zone geometry under a layer named THERMAL ZONE 2.
# 1. DEFINE LOCATION
# 2. DEFINE EMISSION FACTORS AND UTILITY COSTS
# 3. DEFINE GEOMETRY AND TEMPLATES
# 4. INITIATE ENERGY AND SIZING SIMULATION
# 5. OUTPUTS AND METRICS
panel_8 = Panel(round.Nearest)

# ----
# Extract airflow rates, setpoints, utility cost, and occupancy density from the building templates.
# Extract heating and cooling loads for each zone from the energy model results.
# Perform supply air system sizing based on loads from energy model as well as zone setpoint temperatures.
data_2 = Data(main_zone_template)
all_template_data = Data(flatten(data_2))
sort_8 = SortList(Keys=heating_load.ResultsPerZone)  # -> Keys, ValuesA
sort_9 = SortList(Keys=cooling_load.ResultsPerZone)  # -> Keys, ValuesA
item_13 = ListItem(List=sort_8.Keys, Index=-1, Wrap=True)
item_14 = ListItem(List=sort_9.Keys, Index=-1, Wrap=True)
division = Division(A=item_13, B=3600)
division_2 = Division(A=item_14, B=3600)
txt = Text(graft(all_template_data))
split = TextSplit(Text=txt, Separators=[",", "{"])
split_2 = TextSplit(Text=heating_load.Name, Separators="_*")
cull_i = CullIndex(List=split_2, Indices=-1, Wrap=True)
python_3 = GhPythonScript(x=txt)  # -> out, a
# ---------- python_3: Python ----------
__author__ = "airan"
__version__ = "2024.09.18"

import rhinoscriptsyntax as rs

a = x.find("HeatingSetpointConstant")
# ---------- end python_3 ----------
python_4 = GhPythonScript(x=txt)  # -> out, a
# ---------- python_4: Python ----------
__author__ = "airan"
__version__ = "2024.09.18"

import rhinoscriptsyntax as rs

a = x.find("CoolingSetpoint")
# ---------- end python_4 ----------
python_5 = GhPythonScript(x=txt)  # -> out, a; same code as python_4
python_6 = GhPythonScript(x=txt)  # -> out, a
# ---------- python_6: Python ----------
__author__ = "airan"
__version__ = "2024.09.18"

import rhinoscriptsyntax as rs

a = x.find("MinFreshAirArea")
# ---------- end python_6 ----------
python_7 = GhPythonScript(x=txt)  # -> out, a
# ---------- python_7: Python ----------
__author__ = "airan"
__version__ = "2024.09.18"

import rhinoscriptsyntax as rs

a = x.find("CoolingCOP")
# ---------- end python_7 ----------
python_8 = GhPythonScript(x=txt)  # -> out, a
# ---------- python_8: Python ----------
__author__ = "airan"
__version__ = "2024.09.18"

import rhinoscriptsyntax as rs

a = x.find("MetabolicRate")
# ---------- end python_8 ----------
python_9 = GhPythonScript(x=txt)  # -> out, a
# ---------- python_9: Python ----------
__author__ = "airan"
__version__ = "2024.09.18"

import rhinoscriptsyntax as rs

a = x.find("HeatingSetpoint")
# ---------- end python_9 ----------
python_10 = GhPythonScript(x=txt)  # -> out, a
# ---------- python_10: Python ----------
__author__ = "airan"
__version__ = "2024.09.18"

import rhinoscriptsyntax as rs

a = x.find("MinFreshAirPerson")
# ---------- end python_10 ----------
python_11 = GhPythonScript(x=txt)  # -> out, a; same code as python_6
python_12 = GhPythonScript(x=txt)  # -> out, a
# ---------- python_12: Python ----------
__author__ = "airan"
__version__ = "2024.09.18"

import rhinoscriptsyntax as rs

a = x.find("PeopleDensity")
# ---------- end python_12 ----------
python_13 = GhPythonScript(x=txt)  # -> out, a
# ---------- python_13: Python ----------
__author__ = "airan"
__version__ = "2024.09.18"

import rhinoscriptsyntax as rs

a = x.find("BuildingType")
# ---------- end python_13 ----------
python_14 = GhPythonScript(x=txt)  # -> out, a
# ---------- python_14: Python ----------
__author__ = "airan"
__version__ = "2024.09.18"

import rhinoscriptsyntax as rs

a = x.find("Program")
# ---------- end python_14 ----------
zone_location_index = Data(mindex.Index)
sorted_zone_names = Data(item_6)
join_3 = TextJoin(Text=cull_i, Join="_")
subtraction = Subtraction(A=python_3.a, B=python_5.a)
subtraction_2 = Subtraction(A=python_4.a, B=python_9.a)
subtraction_3 = Subtraction(A=python_6.a, B=python_10.a)
subtraction_4 = Subtraction(A=python_7.a, B=python_11.a)
subtraction_5 = Subtraction(A=python_8.a, B=python_12.a)
subtraction_6 = Subtraction(A=python_14.a, B=python_13.a)
fragment = TextFragment(Text=txt, Start=python_5.a, Count=subtraction)
fragment_2 = TextFragment(Text=txt, Start=python_9.a, Count=subtraction_2)
fragment_3 = TextFragment(Text=txt, Start=python_10.a, Count=subtraction_3)
fragment_4 = TextFragment(Text=txt, Start=python_11.a, Count=subtraction_4)
fragment_5 = TextFragment(Text=txt, Start=python_12.a, Count=subtraction_5)
fragment_6 = TextFragment(Text=txt, Start=python_14.a, Count=subtraction_6)
lng_5 = ListLength(List=sorted_zone_names)  # -> flatten(Length)
split_3 = TextSplit(Text=fragment, Separators=":")
split_4 = TextSplit(Text=fragment_2, Separators=":")
split_5 = TextSplit(Text=fragment_3, Separators=":")
split_6 = TextSplit(Text=fragment_4, Separators=":")
split_7 = TextSplit(Text=fragment_5, Separators=":")
split_8 = TextSplit(Text=fragment_6, Separators="\"")
split_9 = TextSplit(Text=split_3, Separators=",")  # -> flatten(Result)
split_10 = TextSplit(Text=split_4, Separators=",")  # -> flatten(Result)
split_11 = TextSplit(Text=split_5, Separators=",")  # -> flatten(Result)
split_12 = TextSplit(Text=split_6, Separators=",")  # -> flatten(Result)
split_13 = TextSplit(Text=split_7, Separators=",")  # -> flatten(Result)
item_15 = ListItem(List=flatten(join_3), Index=flatten(zone_location_index), Wrap=True)
item_16 = ListItem(List=flatten(division_2), Index=flatten(zone_location_index), Wrap=True)
item_17 = ListItem(List=flatten(division), Index=flatten(zone_location_index), Wrap=True)
item_18 = ListItem(List=split_8, Index=2, Wrap=True)
item_19 = ListItem(List=split_9, Index=1, Wrap=True)
item_20 = ListItem(List=split_10, Index=1, Wrap=True)
item_21 = ListItem(List=split_11, Index=1, Wrap=True)
item_22 = ListItem(List=split_12, Index=1, Wrap=True)
item_23 = ListItem(List=split_13, Index=1, Wrap=True)
cooling_load_2 = PartitionList(List=item_16, Size=lng_5)
zone_name = PartitionList(List=item_15, Size=lng_5)
heating_load_2 = PartitionList(List=item_17, Size=lng_5)
data_3 = Data(flatten(item_18))
num = Number(item_21)
num_2 = Number(item_23)
num_3 = Number(item_22)
num_4 = Number(item_19)
division_3 = Division(A=heating_load_2, B=1000)
num_5 = Number(item_20)
division_4 = Division(A=cooling_load_2, B=1000)
occupant_density_people_m2 = Panel(num_2)
program = Panel(item_18)
fresh_air_per_area_l_s_m2 = Panel(num_3)
heating_setpoint_c = Panel(num_5)
cooling_setpoint_c = Panel(num_4)
heating_load_kw = Panel(division_3)
cooling_load_kw = Panel(division_4)
area_7 = Area(Geometry=sorted_zone_floorplate_edge_curve)  # -> Area, Centroid
occupancy = PartitionList(List=flatten(num_2), Size=lng_5)
fresh_air_per_person = PartitionList(List=flatten(num), Size=lng_5)
fresh_air_per_area = PartitionList(List=flatten(num_3), Size=lng_5)
heating_setpoint = PartitionList(List=flatten(num_5), Size=lng_5)
cooling_setpoint = PartitionList(List=flatten(num_4), Size=lng_5)
repeat_3 = RepeatData(Data=flatten(area_7.Area), Length=lng_5)
supply_air_temperature_sat_c = Panel("12.8")
specific_heat_capacity_kj_kg_c = Panel("1.006")
air_density_kg_m3 = Panel("1.202")
expression = Expression(
    Air_person=fresh_air_per_person,
    Air_area=fresh_air_per_area,
    Occupancy=occupancy,
    Area=repeat_3,
    Expression="((Occupancy*Area)*Air_person)+(Air_area*Area)")
subtraction_7 = Subtraction(A=heating_setpoint, B=supply_air_temperature_sat_c)
subtraction_8 = Subtraction(A=cooling_setpoint, B=supply_air_temperature_sat_c)
expression_2 = Expression(
    H_heat=division_3,
    Cp=specific_heat_capacity_kj_kg_c,
    rho=air_density_kg_m3,
    dt=subtraction_7,
    Expression="(H_heat/(Cp*rho*dt))*1000")
expression_3 = Expression(
    H_cool=division_4,
    Cp=specific_heat_capacity_kj_kg_c,
    rho=air_density_kg_m3,
    dt=subtraction_8,
    Expression="(H_cool/(Cp*rho*dt))*1000")
heating_flow_rate_l_s = Panel(expression_2)
oa_flow_rate_l_s = Panel(expression)
cooling_flow_rate_l_s = Panel(expression_3)
max = Maximum(A=expression_2, B=expression_3)

# ----
# STEP 4B: First, perform the sizing calculation which will run an IAL system and generate ductwork. Then, simulate all systems by using the second toggle.
energy_result_comparison = CSEnergyResultComparison(
    R=[run_e_4.Result, run_e_2.Result, run_e_3.Result, run_e.Result],
    DataType="EnergyUseIntensity",
    Target=0,
    Baseline=0,
    FileName="ResultComparison",
    PNGOrPDF="PNG",
    Width=800,
    Height=800,
    CreatePlot=False,
    PreviewDimension="Large",
    Input_0_Hidden=False,
    Input_0_Name="Result Files",
    Input_10_Hidden=False,
    Input_10_Name="Directory",
    Input_11_Hidden=False,
    Input_11_Name="File Name",
    Input_12_Hidden=False,
    Input_12_Name="PNG or PDF",
    Input_13_Hidden=False,
    Input_13_Name="Width",
    Input_14_Hidden=False,
    Input_14_Name="Height",
    Input_15_Hidden=True,
    Input_15_Name="Text Scaler",
    Input_16_Hidden=True,
    Input_16_Name="Lineweight Scaler",
    Input_17_Hidden=False,
    Input_17_Name="Create Plot",
    Input_18_Hidden=False,
    Input_18_Name="Preview Dimension",
    Input_19_Hidden=True,
    Input_19_Name="Infinate Zoom Display",
    Input_1_Hidden=True,
    Input_1_Name="Result Comparison File",
    Input_2_Hidden=False,
    Input_2_Name="Data Type",
    Input_3_Hidden=True,
    Input_3_Name="Bar Width",
    Input_4_Hidden=True,
    Input_4_Name="Show Numbers"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)

windows = CustomPreview(Geometry=srf_5, Material=ColourSwatch(SwatchColor=RGBA(31, 173, 224, 80)))

python_15 = GhPythonScript(x=emission.EmissionFactorsSummary)  # -> out, a
# ---------- python_15: Python ----------
__author__ = "airan"
__version__ = "2024.09.18"

import rhinoscriptsyntax as rs

a = x.find("Electricity")
# ---------- end python_15 ----------
python_16 = GhPythonScript(x=emission.EmissionFactorsSummary)  # -> out, a
# ---------- python_16: Python ----------
__author__ = "airan"
__version__ = "2024.09.18"

import rhinoscriptsyntax as rs

a = x.find("Fuel Oil")
# ---------- end python_16 ----------
fragment_7 = TextFragment(Text=emission.EmissionFactorsSummary, Start=python_15.a, Count=python_16.a)
split_14 = TextSplit(Text=fragment_7, Separators="|")
item_24 = ListItem(List=split_14, Index=7, Wrap=True)
item_25 = ListItem(List=split_14, Index=3, Wrap=True)
item_26 = ListItem(List=split_14, Index=6, Wrap=True)
item_27 = ListItem(List=split_14, Index=2, Wrap=True)
electricity_price = Number(item_27)
natural_gas_price = Number(item_26)

division_5 = Division(A=item_24, B=1000)
division_6 = Division(A=item_25, B=1000)

natural_gas_carbon = Number(division_5)
electricity_carbon = Number(division_6)

# ----
# Adjust energy consumption for different HVAC system and output all metrics after first simulation.
ma_6 = MassAddition(Input=max)  # -> Result, PartialResults
electricity = Data(flatten(entwine))
ma_7 = MassAddition(Input=expression)  # -> Result, PartialResults
gas = Data(flatten(entwine_2))
price = Panel("""270
350
400""")

multiplication = Multiplication(A=electricity, B=2.77778e-07)
multiplication_2 = Multiplication(A=gas, B=2.77778e-07)

elec_use = Data(multiplication)
gas_use = Data(multiplication_2)
addition = Addition(A=multiplication, B=multiplication_2)
axb = Multiplication(RATE=electricity_carbon, B=elec_use)  # -> simplify(graft(Result))
multiplication_3 = Multiplication(RATE=natural_gas_carbon, B=gas_use)  # -> simplify(graft(Result))
multiplication_4 = Multiplication(RATE=electricity_price, B=elec_use)  # -> simplify(graft(Result))
multiplication_5 = Multiplication(RATE=natural_gas_price, B=gas_use)  # -> simplify(graft(Result))
ma_8 = MassAddition(Input=[axb, multiplication_3])  # -> Result, PartialResults
ma_9 = MassAddition(Input=[multiplication_4, multiplication_5])  # -> Result, PartialResults
python_17 = GhPythonScript(x=ma_8.Result)  # -> a
# ---------- python_17: Python ----------
__author__ = "airan"
__version__ = "2022.10.24"

import rhinoscriptsyntax as rs

import math as m

a = round(x,-2)
# ---------- end python_17 ----------
python_18 = GhPythonScript(x=ma_9.Result)  # -> a; same code as python_17
division_7 = Division(A=python_17, B=1000)
division_8 = Division(A=python_18, B=1000)
concat_6 = Concatenate(FragmentA=division_7)
operating_carbon = ExplodeTree(Data=concat_6)  # -> Branch0, Branch1, Branch2

round_2 = Round(Number=division_8)  # -> Nearest, Floor, Ceiling

panel_9 = Panel(operating_carbon.Branch0)
panel_10 = Panel(operating_carbon.Branch1)
panel_11 = Panel(operating_carbon.Branch2)

concat_7 = Concatenate(FragmentA="$", FragmentB=round_2.Nearest, FragmentC="k")
operating_cost = ExplodeTree(Data=concat_7)  # -> Branch0, Branch1, Branch2

panel_12 = Panel(operating_cost.Branch0)
panel_13 = Panel(operating_cost.Branch1)
panel_14 = Panel(operating_cost.Branch2)

# ----
# Utilize airflow rate from energy model to calculate overall supply air duct dimension and dimensions of individual zone branches.
air_velocity = ValueList({"1 m/s or 200 fpm": 1, "2 m/s or 400 fpm": 2, "4 m/s or 750 fpm": 4, "8 m/s or 1500 fpm": 8, "16 m/s or 3000 fpm": 16}, selected="4 m/s or 750 fpm")
safety_factor = Panel("1.2")

floor_by_floor_airflow = Expression(Flowrate=ma_6.Result, Airspeed=air_velocity, SF=safety_factor, Expression="Flowrate/1000/Airspeed*SF")
floor_by_floor_airflow_2 = Expression(Flowrate=ma_7.Result, Airspeed=air_velocity, SF=safety_factor, Expression="Flowrate/1000/Airspeed*SF")
ma_10 = MassAddition(Input=flatten(floor_by_floor_airflow_2))  # -> Result, PartialResults
ma_11 = MassAddition(Input=flatten(floor_by_floor_airflow))  # -> Result, PartialResults
entwine_3 = Entwine(Branch00=ma_11.Result, Branch01=ma_10.Result, Branch02=ma_10.Result, FlattenInputs=True)
multiplication_6 = Multiplication(A=entwine_3, B=2)
python_19 = GhPythonScript(x=multiplication_6)  # -> a
# ---------- python_19: Python ----------
__author__ = "airan"
__version__ = "2022.10.24"

import rhinoscriptsyntax as rs

import math as m

a = round(x,2)
# ---------- end python_19 ----------
area_requirements = ExplodeTree(Data=simplify(python_19))  # -> Branch0, Branch1, Branch2

panel_15 = Panel(area_requirements.Branch0)
panel_16 = Panel(area_requirements.Branch1)
panel_17 = Panel(area_requirements.Branch2)

sorted_floorplate_geometry = Surface(item_10)
join_4 = JoinCurves(Curves=sorted_floorplate_edge_curve, Preserve=False)  # -> simplify(Curves)
area_8 = Area(Geometry=flatten(sorted_floorplate_geometry))  # -> Area, Centroid
ma_12 = MassAddition(Input=area_8.Area)  # -> Result, PartialResults
# Draw primary supply air duct for every floor. Either use offset method (default) or corridor centerlines.
xy = XYPlane(Origin=area_8.Centroid)
edges_4 = BrepEdges(Brep=sorted_floorplate_geometry)  # -> Naked, Interior, NonManifold
join_5 = JoinCurves(Curves=edges_4.Naked, Preserve=False)
len_2 = Length(Curve=join_5)
sort_10 = SortList(Keys=len_2, ValuesA=join_5)  # -> reverse(Keys), reverse(ValuesA)
item_28 = ListItem(List=sort_10.ValuesA, Index=0, Wrap=True)  # -> flatten(Item)
midpt = CurveMiddle(Curve=item_28)
midpt_2 = CurveMiddle(Curve=item_11)
pdecon_3 = Deconstruct(Point=midpt)  # -> XComponent, YComponent, ZComponent
pdecon_4 = Deconstruct(Point=midpt_2)  # -> XComponent, YComponent, flatten(ZComponent)
subtraction_9 = Subtraction(A=pdecon_4.ZComponent, B=pdecon_3.ZComponent)
python_20 = GhPythonScript(x=subtraction_9)  # -> a; same code as python
Z_3 = UnitZ(Factor=python_20)
neg = Negative(Value=offset_distance_from_facade_m)
offset = OffsetCurve(Curve=join_4, Distance=neg, Corners=1)

area_9 = Data(ma_12.Result)
division_9 = Division(A=graft(addition), B=graft(area_9))  # -> simplify(Result)
multiplication_7 = Multiplication(A=ma_12.Result, B=graft(price))
python_21 = GhPythonScript(x=multiplication_7)  # -> a
# ---------- python_21: Python ----------
__author__ = "airan"
__version__ = "2022.10.24"

import rhinoscriptsyntax as rs

import math as m

a = round(x,-3)
# ---------- end python_21 ----------
python_22 = GhPythonScript(x=division_9)  # -> a
# ---------- python_22: Python ----------
__author__ = "airan"
__version__ = "2022.10.24"

import rhinoscriptsyntax as rs

import math as m

a = round(x,0)
# ---------- end python_22 ----------
division_10 = Division(A=python_21, B=1000)
concat_8 = Concatenate(FragmentA="$", FragmentB=division_10, FragmentC="k")
first_cost = ExplodeTree(Data=concat_8)  # -> Branch0, Branch1, Branch2
eui = ExplodeTree(Data=python_22)  # -> Branch0, Branch1, Branch2

panel_18 = Panel(first_cost.Branch0)
panel_19 = Panel(eui.Branch0)
panel_20 = Panel(eui.Branch1)
panel_21 = Panel(first_cost.Branch1)
panel_22 = Panel(eui.Branch2)
panel_23 = Panel(first_cost.Branch2)

# ----
# Draw branch ducts to each thermal zone as well as air diffusers at the end of the branch into the zone.
Z_4 = UnitZ(Factor=python_20)
dispatch_5 = Dispatch(List=sorted_zone_floorplate_edge_curve, DispatchPattern=tmatch)  # -> ListA, ListB
cset_3 = CreateSet(List=Z_4)  # -> Set, Map
area_10 = Area(Geometry=[dispatch_5.ListB, dispatch_5.ListA])  # -> Area, Centroid
move = Move(Geometry=area_10.Centroid, Motion=graft(cset_3.Set))  # -> Geometry, Transform
item_29 = ListItem(List=item_12, Index=mindex.Index, Wrap=True)
tstat_2 = TreeStatistics(Tree=item_29)  # -> Paths, Length, Count
Z_5 = UnitZ(Factor=0.3)
neg_2 = Negative(Value=Z_5)
dom = ConstructDomain(DomainStart="-0.1", DomainEnd="0.1")
number_slider = Slider(1.5, range=0..2)

move_2 = Move(Geometry=offset, Motion=graft(Z_4))  # -> Geometry, Transform
filter = StreamFilter(Gate=list_2, Stream0=move_2.Geometry, Stream1=corridor_centerline)
join_6 = JoinCurves(Curves=filter, Preserve=False)
midpt_3 = CurveMiddle(Curve=join_6)
midpt_4 = CurveMiddle(Curve=join_6)
pdecon_5 = Deconstruct(Point=midpt_3)  # -> XComponent, YComponent, ZComponent
pdecon_6 = Deconstruct(Point=midpt_4)  # -> XComponent, YComponent, ZComponent
cset_4 = CreateSet(List=pdecon_5.ZComponent)  # -> Set, Map
sort_11 = SortList(Keys=pdecon_6.ZComponent, ValuesA=join_6)  # -> Keys, ValuesA
mindex_7 = MemberIndex(Set=pdecon_5.ZComponent, Member=cset_4.Set)  # -> Index, Count
item_30 = ListItem(List=sort_11.ValuesA, Index=mindex_7.Index, Wrap=True)

crv_cp = CurveClosestPoint(Point=move.Geometry, Curve=graft(item_30))  # -> Point, Parameter, Distance
larger_2 = LargerThan(FirstNumber=crv_cp.Distance, SecondNumber=0)  # -> LargerThan, OrEqualTo
dispatch_6 = Dispatch(List=move.Geometry, DispatchPattern=larger_2.LargerThan)  # -> ListA, ListB
dispatch_7 = Dispatch(List=move.Geometry, DispatchPattern=larger_2.LargerThan)  # -> ListA, ListB
incurves = PointInCurves(Point=dispatch_7.ListA, Curves=join_4)  # -> Relationship, Index, Point
dispatch_8 = Dispatch(List=crv_cp.Point, DispatchPattern=larger_2.LargerThan)  # -> ListA, ListB
equals = Equality(FirstNumber=incurves.Relationship, SecondNumber=0)  # -> Equality, Inequality
dispatch_9 = Dispatch(List=dispatch_8.ListA, DispatchPattern=equals.Inequality)  # -> ListA, ListB
partition_3 = PartitionList(List=dispatch_6.ListA, Size=tstat_2.Length)  # -> simplify(Chunks)
partition_4 = PartitionList(List=dispatch_9.ListA, Size=tstat_2.Length)  # -> simplify(Chunks)
ln = Line(StartPoint=partition_3, EndPoint=partition_4)
len_3 = Length(Curve=ln)
divide = DivideCurve(Curve=ln, Count=1, Kinks=False)  # -> Points, Tangents, Parameters
item_31 = ListItem(List=divide.Points, Index=-2, Wrap=True)
xy_2 = XYPlane(Origin=item_31)
rectangle = Rectangle(Plane=xy_2, XSize=dom, YSize=dom, Radius=0)  # -> Rectangle, Length
move_3 = Move(Geometry=rectangle.Rectangle, Motion=neg_2)  # -> Geometry, Transform
extr = Extrude(Base=rectangle.Rectangle, Direction=neg_2)
scale_nu = ScaleNU(Geometry=move_3.Geometry, Plane=xy_2, ScaleX=number_slider, ScaleY=number_slider, ScaleZ=1)  # -> Geometry, Transform

# ----
# FCU
# VRF
# VAV
# Draw terminal zone equipment including FAN COIL UNITS, VRF CASSETTES, and VAV BOXES.
panel_24 = Panel("800x400x150")
debrep_4 = DeconstructBrep(Brep=dispatch_2.ListB)  # -> Faces, Edges, Vertices
area_11 = Area(Geometry=debrep_4.Faces)  # -> Area, Centroid
split_15 = TextSplit(Text=panel_24, Separators="x")
split_16 = TextSplit(Text="200x200x700", Separators="x")
sort_12 = SortList(Keys=area_11.Area, ValuesA=area_11.Centroid)  # -> Keys, ValuesA
sort_13 = SortList(Keys=area_11.Area, ValuesA=debrep_4.Faces)  # -> Keys, ValuesA
division_11 = Division(A=split_15, B=1000)
division_12 = Division(A=split_16, B=1000)
item_32 = ListItem(List=sort_13.ValuesA, Index=0, Wrap=True)
item_33 = ListItem(List=sort_12.ValuesA, Index=0, Wrap=True)
item_34 = ListItem(List=division_11, Index=0, Wrap=True)  # -> Item, Item1, Item2
item_35 = ListItem(List=division_12, Index=0, Wrap=True)  # -> Item, Item1, Item2
devec_4 = DeconstructVector(Vector=item_33)  # -> XComponent, YComponent, ZComponent
sort_14 = SortList(Keys=flatten(devec_4.ZComponent))  # -> Keys, ValuesA
panel_25 = Panel("""0
1
1""")
panel_26 = Panel("""0
1
1""")
Z_6 = UnitZ(Factor=item_34.Item1)
item_36 = ListItem(List=sort_14.Keys, Index=0, Wrap=True)
addition_2 = Addition(A=2.5, B=item_36)
Z_7 = UnitZ(Factor=addition_2)
item_37 = ListItem(List=panel_25, Index=list, Wrap=True)
item_38 = ListItem(List=panel_26, Index=list, Wrap=True)
neg_3 = Negative(Value=item_36)
Z_8 = UnitZ(Factor=neg_3)
midpt_5 = CurveMiddle(Curve=ln)
move_4 = Move(Geometry=item_33, Motion=Z_8)  # -> Geometry, Transform
evalsrf_3 = EvaluateSurface(Surface=item_32, Point="0.5,0.5")  # -> Point, Normal, UDirection, VDirection, Frame
pl = PlaneNormal(Origin=move_4.Geometry, ZAxis=evalsrf_3.Normal)
xz = XZPlane(Origin=Point(0, 0, 0))
box = CenterBox(Base=midpt_5, X="0.25", Y="0.25", Z="0.25")
align = AlignPlanes(Planes=pl, Master=xz)
box_2 = CenterBox(Base=align, X=item_34.Item, Y=item_34.Item1, Z=item_34.Item2)
box_3 = CenterBox(Base=align, X=item_35.Item2, Y=item_35.Item, Z=item_35.Item1)
move_5 = Move(Geometry=box_2, Motion=Z_6)  # -> Geometry, Transform
move_6 = Move(Geometry=box_3, Motion=Z_7)  # -> Geometry, Transform
neg_4 = Negative(Value=Z_3)
Z_9 = UnitZ(Factor=duct_height_m)
move_7 = Move(Geometry=box, Motion=graft(neg_4))  # -> Geometry, Transform
move_8 = Move(Geometry=move_7.Geometry, Motion=Z_9)  # -> Geometry, Transform
filter_2 = StreamFilter(Gate=item_38, Stream0=move_8.Geometry, Stream1=move_5.Geometry)

filter_3 = StreamFilter(Gate=item_37, Stream0=max, Stream1=expression)
ma_13 = MassAddition(Input=filter_3)  # -> Result, PartialResults
floor_by_floor_airflow_3 = Expression(Flowrate=ma_13.Result, Airspeed=air_velocity, SF=safety_factor, Expression="Flowrate/1000/Airspeed*SF")
zone_by_zone_airflow = Expression(Flowrate=filter_3, Airspeed=air_velocity, SF=safety_factor, Expression="Flowrate/1000/Airspeed*SF")
division_13 = Division(A=floor_by_floor_airflow_3, B=main_supply_duct_aspect_ratio)
division_14 = Division(A=zone_by_zone_airflow, B=zone_branch_duct_aspect_ratio)
sqrt = SquareRoot(Value=division_13)
sqrt_2 = SquareRoot(Value=division_14)
division_15 = Division(A=floor_by_floor_airflow_3, B=sqrt)
division_16 = Division(A=zone_by_zone_airflow, B=sqrt_2)
python_23 = GhPythonScript(x=division_15)  # -> a
# ---------- python_23: Python ----------
__author__ = "airan"
__version__ = "2022.10.24"

import rhinoscriptsyntax as rs

import math as m

a = round(x,1)
# ---------- end python_23 ----------
python_24 = GhPythonScript(x=sqrt)  # -> a; same code as python_23
python_25 = GhPythonScript(x=division_16)  # -> a; same code as python_23
python_26 = GhPythonScript(x=sqrt_2)  # -> a; same code as python_23
panel_27 = Panel(division_15)
multiplication_8 = Multiplication(A=python_23, B=1000)
multiplication_9 = Multiplication(A=python_24, B=1000)
concat_9 = Concatenate(FragmentA=multiplication_8, FragmentB=" x ", FragmentC=multiplication_9)  # -> flatten(Result)
panel_28 = Panel(python_23)

x_dim_floor = Data(python_23)
y_dim_floor = Data(python_24)
division_17 = Division(A=x_dim_floor, B=-2)
division_18 = Division(A=x_dim_floor, B=2)
division_19 = Division(A=y_dim_floor, B=-2)
division_20 = Division(A=y_dim_floor, B=2)
offset_2 = OffsetCurve(Curve=flatten(item_30), Distance=flatten(division_18), Plane=xy, Corners=1)
offset_3 = OffsetCurve(Curve=flatten(item_30), Distance=flatten(division_17), Plane=xy, Corners=1)
Z_10 = UnitZ(Factor=division_19)
rulesrf = RuledSurface(CurveA=offset_3, CurveB=offset_2)
boundary = BoundarySurfaces(Edges=[offset_3, offset_2])
Z_11 = UnitZ(Factor=division_20)
filter_4 = StreamFilter(Gate=list_2, Stream0=boundary, Stream1=rulesrf)
move_9 = Move(Geometry=filter_4, Motion=Z_10)  # -> Geometry, Transform
multiplication_10 = Multiplication(A=Z_11, B=2)
extr_2 = Extrude(Base=move_9.Geometry, Direction=multiplication_10)

extr_3 = Extrude(Base=scale_nu.Geometry, Direction=Z)

dispatch_10 = Dispatch(List=python_26, DispatchPattern=larger_2.LargerThan)  # -> ListA, ListB
dispatch_11 = Dispatch(List=python_25, DispatchPattern=larger_2.LargerThan)  # -> ListA, ListB
x_dim_floor_2 = Data(dispatch_11.ListA)
y_dim_floor_2 = Data(dispatch_10.ListA)
division_21 = Division(A=y_dim_floor_2, B=-2)
division_22 = Division(A=y_dim_floor_2, B=2)
division_23 = Division(A=x_dim_floor_2, B=-2)
division_24 = Division(A=x_dim_floor_2, B=2)
offset_4 = OffsetCurve(Curve=ln, Distance=simplify(division_24), Corners=1)
offset_5 = OffsetCurve(Curve=ln, Distance=simplify(division_23), Corners=1)
Z_12 = UnitZ(Factor=flatten(division_21))  # -> graft(UnitVector)
rulesrf_2 = RuledSurface(CurveA=offset_5, CurveB=offset_4)
Z_13 = UnitZ(Factor=flatten(division_22))  # -> graft(UnitVector)
multiplication_11 = Multiplication(A=Z_13, B=2)
move_10 = Move(Geometry=rulesrf_2, Motion=Z_12)  # -> Geometry, Transform
extr_4 = Extrude(Base=move_10.Geometry, Direction=multiplication_11)
cap = CapHoles(Brep=extr_3)

# ----
# Draw supply air riser and return air riser.
pdecon_7 = Deconstruct(Point=riser_points_on_roof)  # -> XComponent, YComponent, ZComponent
Z_14 = UnitZ(Factor=-1)
cset_5 = CreateSet(List=Z_3)  # -> Set, Map
line = LineSDL(Start=riser_points_on_roof, Direction=Z_14, Length=pdecon_7.ZComponent)
split_17 = SplitWithBreps(Curve=line, Brep=flatten(sorted_floorplate_geometry))  # -> Curve, Points
lng_6 = ListLength(List=flatten(Z_3))
repeat_4 = RepeatData(Data=cset_5.Set, Length=lng_6)
move_11 = Move(Geometry=graft(split_17.Points), Motion=graft(repeat_4))  # -> Geometry, Transform
item_39 = ListItem(List=move_11.Geometry, Index=0, Wrap=True)  # -> Item, Item1
smaller = SmallerThan(FirstNumber=item_39.Item, SecondNumber=item_39.Item1)  # -> SmallerThan, OrEqualTo
midpt_6 = CurveMiddle(Curve=split_17.Curve)
lng_7 = ListLength(List=line)
p_n_c = PickNChoose(Pattern=smaller.SmallerThan, Stream0=item_39.Item1, Stream1=item_39.Item)
pdecon_8 = Deconstruct(Point=midpt_6)  # -> XComponent, YComponent, ZComponent
end = EndPoints(Curve=split_17.Curve)  # -> Start, End
pdecon_9 = Deconstruct(Point=p_n_c)  # -> XComponent, YComponent, ZComponent
sort_15 = SortList(Keys=flatten(pdecon_8.ZComponent), ValuesA=flatten(split_17.Curve), ValuesB=flatten(end.Start))  # -> Keys, ValuesA, ValuesB
sort_16 = SortList(Keys=flatten(pdecon_9.ZComponent), ValuesA=flatten(p_n_c), ValuesB=flatten(p_n_c))  # -> Keys, ValuesA, ValuesB
partition_5 = PartitionList(List=sort_15.ValuesA, Size=lng_7)
partition_6 = PartitionList(List=sort_15.ValuesB, Size=lng_7)
partition_7 = PartitionList(List=sort_16.ValuesA, Size=lng_7)  # -> simplify(Chunks)
crv_cp_2 = CurveClosestPoint(Point=graft(partition_7), Curve=simplify(flatten(item_30)))  # -> Point, Parameter, Distance
sort_17 = SortList(Keys=crv_cp_2.Distance, ValuesA=crv_cp_2.Point)  # -> Keys, ValuesA
item_40 = ListItem(List=sort_17.ValuesA, Index=0, Wrap=True)
xy_3 = XYPlane(Origin=partition_6)
abs_2 = Absolute(Value=item_12)
ln_2 = Line(StartPoint=item_40, EndPoint=simplify(graft(partition_6)))
ma_14 = MassAddition(Input=flatten(floor_by_floor_airflow_3))  # -> Result, PartialResults
vec = VectorXYZ(XComponent=1, YComponent=0, ZComponent=0)  # -> Vector, Length
angle = Angle(VectorA=abs_2, VectorB=vec.Vector, Plane=xy_3)  # -> Angle, Reflex
division_25 = Division(A=ma_14.Result, B=1)
cset_6 = CreateSet(List=angle.Angle)  # -> Set, Map
sqrt_3 = SquareRoot(Value=division_25)
division_26 = Division(A=ma_14.Result, B=sqrt_3)
lng_8 = ListLength(List=ln_2)
sort_18 = SortList(Keys=cset_6.Set)  # -> Keys, ValuesA
python_27 = GhPythonScript(x=sqrt_3)  # -> a; same code as python_23
python_28 = GhPythonScript(x=division_26)  # -> a; same code as python_23
item_41 = ListItem(List=sort_18.Keys, Index=0, Wrap=True)
y_dim_floor_3 = Data(python_27)
x_dim_floor_3 = Data(python_28)
prot = RotatePlane(Plane=xy_3, Angle=item_41)
division_27 = Division(A=x_dim_floor_3, B=-2)
division_28 = Division(A=x_dim_floor_3, B=2)
division_29 = Division(A=y_dim_floor_3, B=-2)
division_30 = Division(A=y_dim_floor_3, B=2)
pln = Plane(prot)
division_31 = Division(A=division_29, B=lng_8)
division_32 = Division(A=division_30, B=lng_8)
division_33 = Division(A=division_27, B=lng_8)
division_34 = Division(A=division_28, B=lng_8)
multiplication_12 = Multiplication(A=y_dim_floor_3, B=1.5)
dom_2 = ConstructDomain(DomainStart=division_31, DomainEnd=division_32)
dom_3 = ConstructDomain(DomainStart=division_33, DomainEnd=division_34)
rectangle_2 = Rectangle(Plane=pln, XSize=dom_3, YSize=dom_2, Radius=0)  # -> Rectangle, Length
alternate_return_air_riser_location = Slider(0, range=0..3)
extrcrv = ExtrudeAlong(Base=rectangle_2.Rectangle, Curve=partition_5)
cap_2 = CapHoles(Brep=flatten(extrcrv))
sunion_2 = SolidUnion(Breps=cap_2)
X = UnitX(Factor=multiplication_12)
Y = UnitY(Factor=multiplication_12)
volume = Volume(Geometry=sunion_2)  # -> Volume, Centroid
scale_nu_2 = ScaleNU(Geometry=sunion_2, Plane=volume.Centroid, ScaleX=0.75, ScaleY=0.75, ScaleZ=1)  # -> Geometry, Transform
move_12 = Move(Geometry=graft(scale_nu_2.Geometry), Motion=[X, Y])  # -> Geometry, Transform
colom = CollisionOneMany(Collider=move_12.Geometry, Obstacles=flatten(extr_4))  # -> Collision, Index
dispatch_12 = Dispatch(List=move_12.Geometry, DispatchPattern=colom.Collision)  # -> ListA, ListB
item_42 = ListItem(List=dispatch_12.ListB, Index=alternate_return_air_riser_location, Wrap=True)

area_12 = Area(Geometry=flatten(sorted_floorplate_geometry))  # -> Area, Centroid
pdecon_10 = Deconstruct(Point=area_12.Centroid)  # -> XComponent, YComponent, ZComponent
sort_19 = SortList(Keys=pdecon_10.ZComponent, ValuesA=area_12.Centroid)  # -> Keys, ValuesA
item_43 = ListItem(List=sort_19.ValuesA, Index=0, Wrap=True)
expression_4 = Expression(x=ma_12.Result, Expression="(x*10.76/58)^1.087*1.25")
expression_5 = Expression(x=ma_12.Result, Expression="(x*10.76/69.2)^1.053")
pt = Point(riser_points_on_roof)
pt_2 = Point(item_43)
division_35 = Division(A=expression_4, B=10.76)
align_2 = AlignPlanes(Planes=pt)
division_36 = Division(A=expression_5, B=10.76)
division_37 = Division(A=division_35, B=lng_7)
sqrt_4 = SquareRoot(Value=division_37)
sqrt_5 = SquareRoot(Value=division_36)
division_38 = Division(A=sqrt_4, B=2)
neg_5 = Negative(Value=division_38)
division_39 = Division(A=sqrt_5, B=2)
neg_6 = Negative(Value=division_39)
dom_4 = ConstructDomain(DomainStart=neg_5, DomainEnd=division_38)
dom_5 = ConstructDomain(DomainStart=neg_6, DomainEnd=division_39)
Z_15 = UnitZ(Factor=2)
rectangle_3 = Rectangle(Plane=align_2, XSize=dom_4, YSize=dom_4, Radius=0)  # -> Rectangle, Length
align_3 = AlignPlanes(Planes=pt_2)
rectangle_4 = Rectangle(Plane=align_3, XSize=dom_5, YSize=dom_5, Radius=0)  # -> Rectangle, Length
Z_16 = UnitZ(Factor=-2)
number_slider_2 = Slider(0.7, range=0..10)
number_slider_3 = Slider(0.9, range=0..10)
extr_5 = Extrude(Base=rectangle_3.Rectangle, Direction=Z_15)
extr_6 = Extrude(Base=rectangle_4.Rectangle, Direction=Z_16)
cap_3 = CapHoles(Brep=extr_5)
cap_4 = CapHoles(Brep=extr_6)
scale_nu_3 = ScaleNU(Geometry=cap_3, Plane=pt, ScaleX=number_slider_2, ScaleY=number_slider_2, ScaleZ=1)  # -> Geometry, Transform
scale_nu_4 = ScaleNU(Geometry=cap_3, Plane=pt, ScaleX=number_slider_3, ScaleY=number_slider_3, ScaleZ=1)  # -> Geometry, Transform
filter_5 = StreamFilter(Gate=list, Stream0=cap_4, Stream1=cap_4)
filter_6 = StreamFilter(Gate=list, Stream0=cap_3, Stream1=scale_nu_3.Geometry, Stream2=scale_nu_4.Geometry)

lng_9 = ListLength(List=division_21)  # -> flatten(Length)
partition_8 = PartitionList(List=flatten(extr_4), Size=lng_9)
partition_9 = PartitionList(List=flatten(cap), Size=lng_9)

# ----
# Draw branch ducts from the supply air riser to the main supply air duct in every floor.
y_dim_floor_4 = Data(python_24)
x_dim_floor_4 = Data(python_23)
division_40 = Division(A=x_dim_floor_4, B=-2)
division_41 = Division(A=x_dim_floor_4, B=2)
division_42 = Division(A=y_dim_floor_4, B=-2)
division_43 = Division(A=y_dim_floor_4, B=2)
division_44 = Division(A=division_42, B=lng_8)
division_45 = Division(A=division_43, B=lng_8)
division_46 = Division(A=division_40, B=lng_8)
division_47 = Division(A=division_41, B=lng_8)
offset_6 = OffsetCurve(Curve=ln_2, Distance=division_47, Plane=Z_2, Corners=1)
offset_7 = OffsetCurve(Curve=ln_2, Distance=division_46, Plane=Z_2, Corners=1)
rulesrf_3 = RuledSurface(CurveA=offset_7, CurveB=offset_6)  # -> flatten(Surface)
partition_10 = PartitionList(List=rulesrf_3, Size=lng_7)
Z_17 = UnitZ(Factor=division_45)
Z_18 = UnitZ(Factor=division_44)
neg_7 = Negative(Value=Z_3)
neg_8 = Negative(Value=Z_3)
Z_19 = UnitZ(Factor=duct_height_m)
Z_20 = UnitZ(Factor=duct_height_m)
neg_9 = Negative(Value=Z_3)
Z_21 = UnitZ(Factor=duct_height_m)
move_13 = Move(Geometry=simplify(partition_8), Motion=graft(neg_7))  # -> Geometry, Transform
move_14 = Move(Geometry=partition_9, Motion=graft(neg_9))  # -> Geometry, Transform
extr_7 = Extrude(Base=partition_10, Direction=Z_18)
extr_8 = Extrude(Base=partition_10, Direction=Z_17)
move_15 = Move(Geometry=move_13.Geometry, Motion=Z_20)  # -> Geometry, Transform
move_16 = Move(Geometry=move_14.Geometry, Motion=Z_21)  # -> Geometry, Transform
sunion_3 = SolidUnion(Breps=[extr_7, extr_8])
move_17 = Move(Geometry=[extr_2, sunion_3], Motion=graft(neg_8))  # -> Geometry, Transform
move_18 = Move(Geometry=move_17.Geometry, Motion=Z_19)  # -> Geometry, Transform

supply_air_riser = Brep(scale_nu_2.Geometry)
supply_air_main_duct = Brep(move_18.Geometry)
zone_supply_air_branch = Brep(move_15.Geometry)
terminal_equipment = Brep([move_16.Geometry, filter_2])
return_air_riser = Brep(item_42)
mechanical_rooms = Brep([filter_6, filter_5])
preview = CustomPreview(
    Geometry=[supply_air_main_duct, supply_air_riser, zone_supply_air_branch],
    Material=ColourSwatch(SwatchColor=RGBA(0, 55, 255, 200)))
preview_2 = CustomPreview(Geometry=return_air_riser, Material=ColourSwatch(SwatchColor=RGBA(242, 255, 0, 200)))
preview_3 = CustomPreview(Geometry=mechanical_rooms, Material=swatch)
preview_4 = CustomPreview(Geometry=terminal_equipment, Material=ColourSwatch(SwatchColor=RGBA(255, 123, 0, 200)))
