# Grasshopper definition HVACer_MultiFamRes.gh (Grasshopper 1.0.7)
# plug-ins: ClimateStudioGH

# ----
# 3. INITIATE ENERGY AND SIZING SIMULATION
# STEP 3A: Define location for simulation output. Select a directory using the File Path component. Ensure the folder location has no spaces in the name.
step_3b = Panel("Run simulation.")
path = FilePath()
simulate = Button()
simulation_directory = Panel(path)

# ----
# TASK A - PERFORMANCE BASED DESIGN
# OVERVIEW: In this portion of the exercise, you will evaluate the performance of 4 different HVAC systems. Please follow the steps below to setup your model and initiate your simulation. You will then proceed to compare the systems based on first cost, operating cost, operating carbon, payback period, and space requirements.
# 1. DEFINE LOCATION
# STEP 1: Define weather file and climate zone for your project site.
weathersearch = SearchForWeather(
    Selection="C:\ProgramData\Solemma\Common\WeatherData\EPW\USA_MA_Boston-Logan.Intl.AP.725090_TMYx.2004-2018.epw",
    UnitSystem=4)
epw_directory = Panel(weathersearch)

ground = Brep()
bco = CSBoundaryObject(Brep=ground, type="GROUND")

# ----
# 2. DEFINE GEOMETRY AND TEMPLATES
# GEOMETRY
# SETTINGS
# STEP 2A: Select geometry associated with your apartment and corridor zones and define a unique template for each.
# STEP 2B: Select window geometry and apply relevant construction.
# STEP 2C: Select ground and define the boundary conditions.
# STEP 2D: Define exterior shading objects such as context.
shading = Surface()

apartments = Brep()
corridors = Brep()
template = GetCSZoneTemplate(Selection="MidriseApartment-5A-OA")
template_2 = GetCSZoneTemplate(Selection="MidriseApartment-5A-OA")

windows = Brep()
window = Window(
    Surface=windows,
    Settings="gn01EAGCARxTb2xhcmJhbiA2MCAoMikgb24gU3RhcnBoaXJl+QEAAAAAAAD4P4ECAAAAAAAA4D86A0FsbA==",
    UsedLibraryObjects="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")  # -> Window, Settings

# ----
# 1. HVAC SPATIAL LAYOUT
# BASIC DESIGN PARAMETERS
# STEP 1B: Select your riser locations on the roof of your building. One riser minimum is needed.
# Define and reference points on the roof corresponding to your vertical risers. One minimum riser necessary.
# STEP 1C: Select your desired HVAC system.
# Select HVAC system.
# STEP 1D: Select the desired aspect ratio for all ductwork.
# Specify the aspect ratio for your main supply duct as well as the branch ducts in each thermal zone.
# STEP 1E: Modify the placement and geometry of the main ductwork by modifying this parameter.
# The duct height is the height of the primary supply air duct above the floor.
list = ValueList({"Variable Air Volume (Natural Gas Boiler, Water-Cooled Chiller)": 0, "Variable Air Volume (Air Source Heat Pump, Air-Cooled Chiller)": 1, "Variable Air Volume (Ground Source Heat Pump)": 2, "Fan Coil Units with Dedicated Outdoor Air System (Natural Gas Boiler, Water-Cooled Chiller)": 3, "Fan Coil Units with Dedicated Outdooor Air System (Air Source Heat Pump, Air-Cooled Chiller)": 4, "Fan Coil Units with Dedicated Outdooor Air System (Ground Source Heat Pump)": 5}, selected="Fan Coil Units with Dedicated Outdooor Air System (Air Source Heat Pump, Air-Cooled Chiller)")
duct_height_m = Slider(3.1, range=0..4)
riser_points_on_roof = Point()

main_supply_duct_aspect_ratio = Slider(2, range=1..4)
zone_branch_duct_aspect_ratio = Slider(1, range=1..4)

# ----
# TASK B - SPATIAL DESIGN
# OVERVIEW: In this portion of the exercise, you will design the spatial layout of your selected HVAC system. Please follow the steps below to modify the geometry of the HVAC system based on spatial and aesthetic considerations.
# STEP 1A: For the corridor zones, draw on the ceiling plane polylines corresponding to the main supply duct.
# For all corridor zones, draw one or more polylines on the ceiling corresponding to the main supply duct location. Each floor should have at least one corridor centerline.
# STEP 2: When you have finalized your HVAC system layout, please take a screenshot of your final design. Also incluse your Rhino model and GH for the assignment submission.
corridor_centerline = Curve()

panel = Panel("""Output:Meter:MeterFileOnly,  Cooling:Electricity, Monthly;  
Output:Meter:MeterFileOnly,  Heating:Electricity, Monthly;  
Output:Meter:MeterFileOnly,  Heating:NaturalGas, Monthly;  
Output:Meter:MeterFileOnly,  Fans:Electricity, Monthly;  
Output:Meter:MeterFileOnly,  Pumps:Electricity, Monthly;  
Output:Meter:MeterFileOnly,  Humidifier:Electricity, Monthly;  
Output:Meter:MeterFileOnly,  HeatRejection:Electricity, Monthly;  
Output:Meter:MeterFileOnly,  InteriorLights:Electricity, Monthly;
Output:Meter:MeterFileOnly,  InteriorEquipment:Electricity,Monthly; """)
panel_2 = Panel("""VAV - Option 1
VAV - Option 2
VAV - Option 3
FCU - Option 1
FCU - Option 2
FCU - Option 3""")
windowdata = Data(window.Window)
weatherfile = Data(weathersearch)
directory = Data(path)
emission = CSEmissionFactor(Settings="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")  # -> EmissionFactors, EmissionFactorsSummary
name = Text("HVAC_MODEL_")

merge = Merge(
    Data1=ColourSwatch(SwatchColor=RGB(0, 149, 255)),
    Data2=ColourSwatch(SwatchColor=RGB(186, 0, 0)),
    Data3=ColourSwatch(SwatchColor=RGB(255, 0, 0)),
    Data4=ColourSwatch(SwatchColor=RGB(13, 153, 0)),
    Data5=ColourSwatch(SwatchColor=RGB(195, 255, 0)),
    Data6=ColourSwatch(SwatchColor=RGB(0, 4, 255)),
    Data7=ColourSwatch(SwatchColor=RGB(161, 162, 255)),
    Data8=ColourSwatch(SwatchColor=RGB(255, 225, 0)),
    Data9=ColourSwatch(SwatchColor=RGB(92, 92, 92)))
merge_2 = Merge(
    Data1="Cooling:Electricity [KWh]",
    Data2="Heating:Electricity [KWh]",
    Data3="Heating:NaturalGas [KWh]",
    Data4="Fans:Electricity [KWh]",
    Data5="Pumps:Electricity [KWh]",
    Data6="Humidifier:Electricity [KWh]",
    Data7="HeatRejection:Electricity [KWh]",
    Data8="InteriorLights:Electricity [KWh]",
    Data9="InteriorEquipment:Electricity [KWh]")

number_slider = Slider(0.5, range=0..10)
number_slider_2 = Slider(0.7, range=0..10)

# ----
# 4. OUTPUTS AND METRICS
# FCU - Ground Source Heat Pump
# FCU - Natural Gas Boiler, Water-Cooled Chiller
# FCU - Air Source Heat Pump, Air-Cooled Chiller
# VAV - Natural Gas Boiler, Water-Cooled Chiller
# VAV - Air Source Heat Pump, Air-Cooled Chiller
# VAV - Ground Source Heat Pump
# AREA REQUIREMENTS PER FLOOR
# (sq.m)
# STEP 4: Given the performance metrics from the table above as well as your understanding of HVAC systems, please indicate which system you would select for your building? Please indicate why and provide a discussion of the energy, cost, and space requirements for your selected system.
panel_3 = Panel("FIRST COST")
panel_4 = Panel("SYSTEM TYPE")
panel_5 = Panel("""EUI
(kWh/sq.m)""")
panel_6 = Panel("ANNUAL OPERATING COST")
panel_7 = Panel("""OPERATING CARBON
(kg CO2)""")

thermal_zones = CustomPreview(Geometry=corridors, Material=ColourSwatch(SwatchColor=RGBA(242, 136, 136, 70)))

thermal_zones_2 = CustomPreview(Geometry=[apartments, corridors], Material=ColourSwatch(SwatchColor=RGBA(214, 212, 212, 70)))
windows_2 = CustomPreview(Geometry=windows, Material=ColourSwatch(SwatchColor=RGBA(31, 173, 224, 114)))

merge_programs = Entwine(Branch00=apartments, Branch01=corridors, FlattenInputs=True)
bang = ExplodeTree(Data=merge_programs)  # -> Branch0, Branch1, Branch2
lng = ListLength(List=bang.Branch0)
lng_2 = ListLength(List=bang.Branch1)
all_programs = Brep(flatten(merge_programs))
repeat = RepeatData(Data="APARTMENT", Length=lng)
repeat_2 = RepeatData(Data="CORRIDOR", Length=lng_2)
merge_3 = Merge(Data1=repeat, Data2=repeat_2)  # -> flatten(Result)
# FAN ROOMS
zset = CSZoneSettings(
    Name="MyZoneSettings",
    ZoneSettings=template,
    MinFreshAirPerson=5,
    MinFreshAirArea=1,
    Input_0_Hidden=False,
    Input_0_Name="Name",
    Input_10_Hidden=True,
    Input_10_Name="Ground Wall Construction",
    Input_11_Hidden=True,
    Input_11_Name="Program",
    Input_12_Hidden=True,
    Input_12_Name="UseType",
    Input_13_Hidden=True,
    Input_13_Name="People Density",
    Input_14_Hidden=True,
    Input_14_Name="Metabolic Rate",
    Input_15_Hidden=True,
    Input_15_Name="Airspeed Schedule",
    Input_16_Hidden=True,
    Input_16_Name="Equipment Power Density",
    Input_17_Hidden=True,
    Input_17_Name="Lighting Power Density",
    Input_18_Hidden=True,
    Input_18_Name="Illuminance Target",
    Input_19_Hidden=True,
    Input_19_Name="Occupancy Schedule",
    Input_1_Hidden=False,
    Input_1_Name="ZoneSettings",
    Input_20_Hidden=True,
    Input_20_Name="Equipment Availability  Schedule",
    Input_21_Hidden=True,
    Input_21_Name="Lights Availability Schedule",
    Input_22_Hidden=True,
    Input_22_Name="DimmingType"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)
zset_2 = CSZoneSettings(
    Name="MyZoneSettings",
    ZoneSettings=template_2,
    MinFreshAirArea=0.3,
    Input_0_Hidden=False,
    Input_0_Name="Name",
    Input_10_Hidden=True,
    Input_10_Name="Ground Wall Construction",
    Input_11_Hidden=True,
    Input_11_Name="Program",
    Input_12_Hidden=True,
    Input_12_Name="UseType",
    Input_13_Hidden=True,
    Input_13_Name="People Density",
    Input_14_Hidden=True,
    Input_14_Name="Metabolic Rate",
    Input_15_Hidden=True,
    Input_15_Name="Airspeed Schedule",
    Input_16_Hidden=True,
    Input_16_Name="Equipment Power Density",
    Input_17_Hidden=True,
    Input_17_Name="Lighting Power Density",
    Input_18_Hidden=True,
    Input_18_Name="Illuminance Target",
    Input_19_Hidden=True,
    Input_19_Name="Occupancy Schedule",
    Input_1_Hidden=False,
    Input_1_Name="ZoneSettings",
    Input_20_Hidden=True,
    Input_20_Name="Equipment Availability  Schedule",
    Input_21_Hidden=True,
    Input_21_Name="Lights Availability Schedule",
    Input_22_Hidden=True,
    Input_22_Name="DimmingType"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)

# ----
# Split program by level and assign thermal zones by every floor.
intersector = CSIntersector(Brep=merge_programs)
lng_3 = ListLength(List=intersector)  # -> flatten(Length)
partition = PartitionList(List=flatten(intersector), Size=lng_3)  # -> flatten(Chunks)
# Intersect input BREP geometry and assign, unique zone names to each thermal zone in building.
panel_8 = Panel("0.5,0.5")
debrep = DeconstructBrep(Brep=partition)  # -> Faces, Edges, Vertices
evalsrf = EvaluateSurface(Surface=debrep.Faces, Point=panel_8)  # -> Point, Normal, UDirection, VDirection, Frame
devec = DeconstructVector(Vector=evalsrf.Normal)  # -> XComponent, YComponent, ZComponent
abs = Absolute(Value=devec.ZComponent)
larger = LargerThan(FirstNumber=abs, SecondNumber=0.1)  # -> LargerThan, OrEqualTo
dispatch = Dispatch(List=debrep.Faces, DispatchPattern=larger.LargerThan)  # -> ListA, ListB
srf = Surface(dispatch.ListA)
# Define unique names for each thermal zone.
area = Area(Geometry=srf)  # -> Area, Centroid
sort = SortList(Keys=area.Area, ValuesA=dispatch.ListA)  # -> reverse(Keys), reverse(ValuesA)
item = ListItem(List=sort.ValuesA, Index=0, Wrap=True)  # -> Item, Item1
srf_2 = Surface([item.Item1, item.Item])
srf_3 = Surface(dispatch.ListB)
evalsrf_2 = EvaluateSurface(Surface=srf_3, Point="0.5,0.5")  # -> Point, Normal, UDirection, VDirection, Frame
# Deconstruct thermal zone geometry, extracting floor edges and full floorplate geometry.
area_2 = Area(Geometry=srf_2)  # -> Area, Centroid
area_3 = Area(Geometry=srf_3)  # -> Area, Centroid
pdecon = Deconstruct(Point=area_2.Centroid)  # -> XComponent, YComponent, ZComponent
sort_2 = SortList(Keys=area_3.Area, ValuesA=srf_3, ValuesB=evalsrf_2.Normal)  # -> reverse(Keys), reverse(ValuesA), reverse(ValuesB)
sort_3 = SortList(Keys=pdecon.ZComponent, ValuesA=srf_2)  # -> Keys, ValuesA
item_2 = ListItem(List=sort_2.ValuesB, Index=0, Wrap=True)  # -> flatten(Item)
item_3 = ListItem(List=sort_3.ValuesA, Index=0, Wrap=True)
srf_4 = Surface(item_3)

area_4 = Area(Geometry=flatten(srf_4))  # -> Area, Centroid
pdecon_2 = Deconstruct(Point=area_4.Centroid)  # -> XComponent, YComponent, ZComponent
sort_4 = SortList(Keys=pdecon_2.ZComponent, ValuesA=merge_3)  # -> Keys, ValuesA
python = GhPythonScript(x=pdecon_2.ZComponent)  # -> a
# ---------- python: Python ----------
__author__ = "airan"
__version__ = "2023.09.28"

import rhinoscriptsyntax as rs

a = round(x,1);
# ---------- end python ----------
python_2 = GhPythonScript(x=sort_4.Keys)  # -> a; same code as python
cset = CreateSet(List=python_2)  # -> Set, Map
mindex = MemberIndex(Set=python, Member=cset.Set)  # -> Index, Count
item_4 = ListItem(List=all_programs, Index=mindex.Index, Wrap=True)
item_5 = ListItem(List=merge_3, Index=mindex.Index, Wrap=True)
item_6 = ListItem(List=merge_3, Index=mindex.Index, Wrap=True)
cset_2 = CreateSet(List=item_6)  # -> Set, Map
sorted_tz = Brep(item_4)
tmatch = MatchText(Text=item_5, RegEx="CORRIDOR", Case=True)
tstat = TreeStatistics(Tree=item_4)  # -> Paths, Length, Count
series = Series(Start=1, Step=1, Count=tstat.Count)  # -> simplify(graft(Series))
series_2 = Series(Start=1, Step=1, Count=graft(mindex.Count))  # -> simplify(Series)
item_7 = ListItem(List=[zset, zset_2], Index=cset_2.Map, Wrap=True)
dispatch_2 = Dispatch(List=sorted_tz, DispatchPattern=tmatch)  # -> ListA, ListB
concat = Concatenate(FragmentA="FLR_", FragmentB=series, FragmentC="_ZONE_", FragmentD=series_2, FragmentF="_", FragmentH=item_5)

item_8 = ListItem(List=flatten(intersector), Index=mindex.Index, Wrap=True)

sunion = SolidUnion(Breps=sorted_tz)
fmerge = MergeFaces(Brep=sunion)  # -> Breps, Before, After
debrep_2 = DeconstructBrep(Brep=sorted_tz)  # -> Faces, Edges, Vertices
debrep_3 = DeconstructBrep(Brep=fmerge.Breps)  # -> Faces, Edges, Vertices
area_5 = Area(Geometry=debrep_2.Faces)  # -> Area, Centroid
area_6 = Area(Geometry=debrep_3.Faces)  # -> Area, Centroid
devec_2 = DeconstructVector(Vector=area_6.Centroid)  # -> XComponent, YComponent, ZComponent
devec_3 = DeconstructVector(Vector=area_5.Centroid)  # -> XComponent, YComponent, ZComponent
sort_5 = SortList(Keys=devec_3.ZComponent, ValuesA=debrep_2.Faces)  # -> Keys, ValuesA, ValuesB
sort_6 = SortList(Keys=devec_2.ZComponent, ValuesA=debrep_3.Faces)  # -> Keys, ValuesA
item_9 = ListItem(List=sort_5.ValuesA, Index=0, Wrap=True)
item_10 = ListItem(List=sort_6.ValuesA, Index=-1, Wrap=True)
item_11 = ListItem(List=sort_6.ValuesA, Index=0, Wrap=True)
edges = BrepEdges(Brep=item_11)  # -> Naked, Interior, NonManifold
edges_2 = BrepEdges(Brep=item_9)  # -> simplify(Naked), Interior, NonManifold
join = JoinCurves(Curves=edges_2.Naked, Preserve=False)  # -> flatten(Curves)
lng_4 = ListLength(List=sorted_tz)  # -> flatten(Length)
edges_3 = BrepEdges(Brep=item_10)  # -> Naked, Interior, NonManifold
partition_2 = PartitionList(List=join, Size=lng_4)
join_2 = JoinCurves(Curves=edges_3.Naked, Preserve=False)
len = Length(Curve=join_2)
sorted_zone_floorplate_edge_curve = Curve(partition_2)
sort_7 = SortList(Keys=len, ValuesA=join_2)  # -> reverse(Keys), reverse(ValuesA)
sorted_full_floor_geometry = Brep(flatten(fmerge.Breps))
sorted_floorplate_edge_curve = Curve(edges.Naked)
item_12 = ListItem(List=sort_7.ValuesA, Index=0, Wrap=True)

item_13 = ListItem(List=item_2, Index=mindex.Index, Wrap=True)  # -> flatten(Item)

dispatch_3 = Dispatch(List=item_8, DispatchPattern=tmatch)  # -> ListA, ListB
apartment_brep = Brep(flatten(dispatch_3.ListB))
corridor_brep = Brep(flatten(dispatch_3.ListA))

zone = CSEnergyZone(Brep=apartment_brep, Name="APARTMENT", Settings=template, UsedLibraryObjects="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")  # -> Zones, Settings
zone_2 = CSEnergyZone(Brep=corridor_brep, Name="CORRIDOR", Settings=template_2, UsedLibraryObjects="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")  # -> Zones, Settings
data = Data([zone.Zones, zone_2.Zones])

vav = VAVSystem(Name="VAV_ZONES_SYSTEM_1", Zones=data, Settings="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")  # -> System, Settings
vav_2 = VAVSystem(Name="VAV_ZONES_SYSTEM_2", Zones=data, Settings="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")  # -> System, Settings
vav_3 = VAVSystem(Name="VAV_ZONES_SYSTEM_3", Zones=[zone_2.Zones, zone.Zones], Settings="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")  # -> System, Settings
fcu = DOASFCUSystem(Name="FCU_ZONES_SYSTEM_2", Zones=data, Settings="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")  # -> System, Settings
fcu_2 = DOASFCUSystem(Name="FCU_ZONES_SYSTEM_1", Zones=data, Settings="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")  # -> System, Settings
fcu_3 = DOASFCUSystem(Name="FCU_ZONES_SYSTEM_3", Zones=data, Settings="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")  # -> System, Settings
ial = IALSystem(Name="IAL_SYSTEM", Zones=data, Settings="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")  # -> System, Settings
model = CSModelMaker(Zones=data, Windows=windowdata, Boundaries=bco, Shading=shading, Hvac=ial.System, Idf=panel)  # -> Model, Invalid
model_2 = CSModelMaker(Zones=data, Windows=windowdata, Boundaries=bco, Shading=shading, Hvac=vav.System, Idf=panel)  # -> Model, Invalid
model_3 = CSModelMaker(Zones=data, Windows=windowdata, Boundaries=bco, Shading=shading, Hvac=vav_2.System, Idf=panel)  # -> Model, Invalid
model_4 = CSModelMaker(Zones=data, Windows=windowdata, Boundaries=bco, Shading=shading, Hvac=vav_3.System, Idf=panel)  # -> Model, Invalid
model_5 = CSModelMaker(Zones=data, Windows=windowdata, Boundaries=bco, Shading=shading, Hvac=fcu_2.System, Idf=panel)  # -> Model, Invalid
model_6 = CSModelMaker(Zones=data, Windows=windowdata, Boundaries=bco, Shading=shading, Hvac=fcu.System, Idf=panel)  # -> Model, Invalid
model_7 = CSModelMaker(Zones=data, Windows=windowdata, Boundaries=bco, Shading=shading, Hvac=fcu_3.System, Idf=panel)  # -> Model, Invalid
concat_2 = Concatenate(FragmentA=name)
concat_3 = Concatenate(FragmentA=name, FragmentB="VAV_ZONES_SYSTEM_1")
concat_4 = Concatenate(FragmentA=name, FragmentB="VAV_ZONES_SYSTEM_2")
concat_5 = Concatenate(FragmentA=name, FragmentB="VAV_ZONES_SYSTEM_3")
concat_6 = Concatenate(FragmentA=name, FragmentB="FCU_ZONES_SYSTEM_1")
concat_7 = Concatenate(FragmentA=name, FragmentB="FCU_ZONES_SYSTEM_2")
concat_8 = Concatenate(FragmentA=name, FragmentB="FCU_ZONES_SYSTEM_3")
run_e = RunCSEnergyModel(
    Model=model_6.Model,
    Name=concat_7,
    Directory=directory,
    Location=weatherfile,
    EmissionFactors=emission.EmissionFactors,
    Run=simulate,
    NorthOffset=0,
    settings="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")  # -> Model, Settings, Result
run_e_2 = RunCSEnergyModel(
    Model=model_7.Model,
    Name=concat_8,
    Directory=directory,
    Location=weatherfile,
    EmissionFactors=emission.EmissionFactors,
    Run=simulate,
    NorthOffset=0,
    settings="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")  # -> Model, Settings, Result
run_e_3 = RunCSEnergyModel(
    Model=model_2.Model,
    Name=concat_3,
    Directory=directory,
    Location=weatherfile,
    EmissionFactors=emission.EmissionFactors,
    Run=simulate,
    NorthOffset=0,
    settings="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")  # -> Model, Settings, Result
run_e_4 = RunCSEnergyModel(
    Model=model_3.Model,
    Name=concat_4,
    Directory=directory,
    Location=weatherfile,
    EmissionFactors=emission.EmissionFactors,
    Run=simulate,
    NorthOffset=0,
    settings="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")  # -> Model, Settings, Result
run_e_5 = RunCSEnergyModel(
    Model=model_4.Model,
    Name=concat_5,
    Directory=directory,
    Location=weatherfile,
    EmissionFactors=emission.EmissionFactors,
    Run=simulate,
    NorthOffset=0,
    settings="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")  # -> Model, Settings, Result
run_e_6 = RunCSEnergyModel(
    Model=model_5.Model,
    Name=concat_6,
    Directory=directory,
    Location=weatherfile,
    EmissionFactors=emission.EmissionFactors,
    Run=simulate,
    NorthOffset=0,
    settings="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")  # -> Model, Settings, Result

meter_results = LoadCSMeterResults(ThermalModel=run_e_2.Model, Toggle=Toggle(True))  # -> Results, Labels
meter_results_2 = LoadCSMeterResults(ThermalModel=run_e.Model, Toggle=Toggle(True))  # -> Results, Labels
meter_results_3 = LoadCSMeterResults(ThermalModel=run_e_5.Model, Toggle=Toggle(True))  # -> Results, Labels
meter_results_4 = LoadCSMeterResults(ThermalModel=run_e_6.Model, Toggle=Toggle(True))  # -> Results, Labels
meter_results_5 = LoadCSMeterResults(ThermalModel=run_e_4.Model, Toggle=Toggle(True))  # -> Results, Labels
meter_results_6 = LoadCSMeterResults(ThermalModel=run_e_3.Model, Toggle=Toggle(True))  # -> Results, Labels
bang_2 = ExplodeTree(Data=meter_results.Results)  # -> Branch0, Branch1, Branch2, Branch3, Branch4, Branch5, Branch6
bang_3 = ExplodeTree(Data=meter_results_4.Results)  # -> Branch0, Branch1, Branch2, Branch3, Branch4, Branch5, Branch6, Branch7, Branch8
bang_4 = ExplodeTree(Data=meter_results_2.Results)  # -> Branch0, Branch1, Branch2, Branch3, Branch4, Branch5, Branch6
bang_5 = ExplodeTree(Data=meter_results_3.Results)  # -> Branch0, Branch1, Branch2, Branch3, Branch4, Branch5, Branch6
bang_6 = ExplodeTree(Data=meter_results_5.Results)  # -> Branch0, Branch1, Branch2, Branch3, Branch4, Branch5, Branch6
division = Division(A=meter_results_6.Results, B="3600000")
ma = MassAddition(Input=division)  # -> Result, PartialResults
entwine = Entwine(
    Branch00=bang_2.Branch0,
    Branch01=bang_2.Branch1,
    Branch03=bang_2.Branch2,
    Branch04=bang_2.Branch3,
    Branch05=bang_2.Branch4,
    Branch07=bang_2.Branch5,
    Branch08=bang_2.Branch6,
    FlattenInputs=True)
entwine_2 = Entwine(
    Branch00=bang_4.Branch0,
    Branch01=bang_4.Branch1,
    Branch03=bang_4.Branch2,
    Branch04=bang_4.Branch3,
    Branch05=bang_4.Branch4,
    Branch07=bang_4.Branch5,
    Branch08=bang_4.Branch6,
    FlattenInputs=True)
entwine_3 = Entwine(
    Branch00=bang_5.Branch0,
    Branch01=bang_5.Branch1,
    Branch03=bang_5.Branch2,
    Branch04=bang_5.Branch3,
    Branch05=bang_5.Branch4,
    Branch07=bang_5.Branch5,
    Branch08=bang_5.Branch6,
    FlattenInputs=True)
entwine_4 = Entwine(
    Branch00=bang_3.Branch0,
    Branch01=bang_3.Branch1,
    Branch02=bang_3.Branch2,
    Branch03=bang_3.Branch3,
    Branch04=bang_3.Branch4,
    Branch05=bang_3.Branch5,
    Branch06=bang_3.Branch6,
    Branch07=bang_3.Branch7,
    Branch08=bang_3.Branch8,
    FlattenInputs=True)
entwine_5 = Entwine(
    Branch00=bang_6.Branch0,
    Branch01=bang_6.Branch1,
    Branch03=bang_6.Branch2,
    Branch04=bang_6.Branch3,
    Branch05=bang_6.Branch4,
    Branch07=bang_6.Branch5,
    Branch08=bang_6.Branch6,
    FlattenInputs=True)
division_2 = Division(A=entwine, B="3600000")
division_3 = Division(A=entwine_2, B="3600000")
division_4 = Division(A=entwine_3, B="3600000")
division_5 = Division(A=entwine_4, B="3600000")
division_6 = Division(A=entwine_5, B="3600000")
path_2 = ConstructPath(Indices=graft([0, 1, 3, 4, 5, 6, 7, 8]))
path_3 = ConstructPath(Indices=2)
ma_2 = MassAddition(Input=division_2)  # -> simplify(Result), PartialResults
ma_3 = MassAddition(Input=division_3)  # -> simplify(Result), PartialResults
ma_4 = MassAddition(Input=division_4)  # -> simplify(Result), PartialResults
ma_5 = MassAddition(Input=division_5)  # -> simplify(Result), PartialResults
ma_6 = MassAddition(Input=division_6)  # -> simplify(Result), PartialResults
merge_4 = Merge(Data1=ma.Result, Data2=ma_6.Result, Data3=ma_4.Result, Data4=ma_5.Result, Data5=ma_3.Result, Data6=ma_2.Result)
branch = TreeBranch(Tree=merge_4, Path=simplify(path_2), MaintainPaths=True)
branch_2 = TreeBranch(Tree=merge_4, Path=path_3, MaintainPaths=True)
flip = FlipMatrix(Data=branch)
ma_7 = MassAddition(Input=flip)  # -> Result, PartialResults

run_e_7 = RunCSEnergyModel(
    Model=model.Model,
    Name=concat_2,
    Directory=directory,
    Location=weatherfile,
    EmissionFactors=emission.EmissionFactors,
    Run=simulate,
    NorthOffset=0,
    settings="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")  # -> Model, Settings, Result
toggle = BooleanToggle(True)
heating_load = LoadCSZoneResults(
    ThermalModel=run_e_7.Model,
    Toggle=toggle,
    byzone="True",
    settings="""{
  "zoneIDs": [],
  "output2Display": [
    {
      "key": "Zone Ideal Loads Supply Air Total Heating Energy",
      "unit": "HVAC Sum [J]",
      "type": 0
    }
  ],
  "normalizeByFloorArea": false
}""")  # -> ResultsPerZone, Labels, Name, Zone
cooling_load = LoadCSZoneResults(
    ThermalModel=run_e_7.Model,
    Toggle=toggle,
    byzone="True",
    settings="""{
  "zoneIDs": [],
  "output2Display": [
    {
      "key": "Zone Ideal Loads Supply Air Total Cooling Energy",
      "unit": "HVAC Sum [J]",
      "type": 0
    }
  ],
  "normalizeByFloorArea": false
}""")  # -> ResultsPerZone, Labels, Name, Zone

# ----
# Extract airflow rates, setpoints, utility cost, and occupancy density from the building templates.
# Extract heating and cooling loads for each zone from the energy model results.
# Perform supply air system sizing based on loads from energy model as well as zone setpoint temperatures.
data_2 = Data([template, template_2])
all_template_data = Data(flatten(data_2))
sort_8 = SortList(Keys=heating_load.ResultsPerZone)  # -> Keys, ValuesA
sort_9 = SortList(Keys=cooling_load.ResultsPerZone)  # -> Keys, ValuesA
item_14 = ListItem(List=sort_8.Keys, Index=-1, Wrap=True)
item_15 = ListItem(List=sort_9.Keys, Index=-1, Wrap=True)
division_7 = Division(A=item_14, B=3600)
division_8 = Division(A=item_15, B=3600)
txt = Text(graft(all_template_data))
split = TextSplit(Text=heating_load.Name, Separators="_*")
split_2 = TextSplit(Text=txt, Separators="\"")  # -> simplify(Result)
item_16 = ListItem(List=split_2, Index="336", Wrap=True)
item_17 = ListItem(List=split_2, Index="332", Wrap=True)
item_18 = ListItem(List=split_2, Index="338", Wrap=True)
item_19 = ListItem(List=split_2, Index="334", Wrap=True)
split_3 = TextSplit(Text=item_16, Separators=": ")
split_4 = TextSplit(Text=item_17, Separators=" : ")
split_5 = TextSplit(Text=item_18, Separators=": ")
split_6 = TextSplit(Text=item_19, Separators=" : ")
cull_i = CullIndex(List=split, Indices=-1, Wrap=True)
item_20 = ListItem(List=split_3, Index=2, Wrap=True)
item_21 = ListItem(List=split_5, Index=2, Wrap=True)
item_22 = ListItem(List=split_4, Index=2, Wrap=True)
item_23 = ListItem(List=split_6, Index=2, Wrap=True)
zone_location_index = Data(mindex.Index)
sorted_zone_names = Data(item_5)
join_3 = TextJoin(Text=cull_i, Join="_")
split_7 = TextSplit(Text=item_20, Separators=" ,")
split_8 = TextSplit(Text=item_21, Separators=" ,")
split_9 = TextSplit(Text=item_22, Separators=" ,")
split_10 = TextSplit(Text=item_23, Separators=" ,")
item_24 = ListItem(List=split_2, Index="150", Wrap=True)
item_25 = ListItem(List=split_2, Index="164", Wrap=True)
item_26 = ListItem(List=split_2, Index="148", Wrap=True)
item_27 = ListItem(List=split_2, Index="166", Wrap=True)
item_28 = ListItem(List=split_2, Index="86", Wrap=True)
item_29 = ListItem(List=split_2, Index="81", Wrap=True)
item_30 = ListItem(List=split_7, Index=0, Wrap=True)  # -> flatten(Item)
item_31 = ListItem(List=split_8, Index=0, Wrap=True)  # -> flatten(Item)
item_32 = ListItem(List=split_9, Index=0, Wrap=True)  # -> flatten(Item)
item_33 = ListItem(List=split_10, Index=0, Wrap=True)  # -> flatten(Item)
split_11 = TextSplit(Text=item_24, Separators=": ,")
lng_5 = ListLength(List=sorted_zone_names)  # -> flatten(Length)
split_12 = TextSplit(Text=item_25, Separators=": ,")
split_13 = TextSplit(Text=item_26, Separators=": ,")
split_14 = TextSplit(Text=item_27, Separators=": ,")
split_15 = TextSplit(Text=item_28, Separators=": ,")
split_16 = TextSplit(Text=item_29, Separators=" _ ")
item_34 = ListItem(List=split_11, Index=2, Wrap=True)  # -> simplify(Item)
item_35 = ListItem(List=split_12, Index=2, Wrap=True)  # -> simplify(Item)
item_36 = ListItem(List=split_13, Index=2, Wrap=True)  # -> simplify(Item)
item_37 = ListItem(List=split_14, Index=2, Wrap=True)  # -> simplify(Item)
item_38 = ListItem(List=split_15, Index=2, Wrap=True)  # -> simplify(Item)
item_39 = ListItem(List=item_30, Index=0, Wrap=True)  # -> flatten(Item)
item_40 = ListItem(List=item_31, Index=0, Wrap=True)  # -> flatten(Item)
item_41 = ListItem(List=item_32, Index=0, Wrap=True)  # -> flatten(Item)
item_42 = ListItem(List=item_33, Index=0, Wrap=True)  # -> flatten(Item)
join_4 = TextJoin(Text=split_16, Join="_")
item_43 = ListItem(List=flatten(join_3), Index=flatten(zone_location_index), Wrap=True)
item_44 = ListItem(List=flatten(division_8), Index=flatten(zone_location_index), Wrap=True)
item_45 = ListItem(List=flatten(division_7), Index=flatten(zone_location_index), Wrap=True)
electricity_co2 = Panel(item_41)
hot_water_co2 = Panel(item_39)
electricity_cost = Panel(item_42)
hot_water_cost = Panel(item_40)
program = Panel(join_4)
data_3 = Data(flatten(join_4))
occupant_density_people_m2 = Panel(item_38)
cooling_setpoint_c = Panel(item_34)
fresh_air_per_person_l_s_per = Panel(item_35)
heating_setpoint_c = Panel(item_36)
fresh_air_per_area_l_s_m2 = Panel(item_37)
cooling_load_2 = PartitionList(List=item_44, Size=lng_5)
zone_name = PartitionList(List=item_43, Size=lng_5)
heating_load_2 = PartitionList(List=item_45, Size=lng_5)
division_9 = Division(A=heating_load_2, B=1000)
division_10 = Division(A=cooling_load_2, B=1000)
heating_load_kw = Panel(division_9)
cooling_load_kw = Panel(division_10)
area_7 = Area(Geometry=sorted_zone_floorplate_edge_curve)  # -> Area, Centroid
occupancy = PartitionList(List=flatten(item_38), Size=lng_5)
fresh_air_per_person = PartitionList(List=flatten(item_35), Size=lng_5)
fresh_air_per_area = PartitionList(List=flatten(item_37), Size=lng_5)
heating_setpoint = PartitionList(List=flatten(item_36), Size=lng_5)
cooling_setpoint = PartitionList(List=flatten(item_34), Size=lng_5)
repeat_3 = RepeatData(Data=area_7.Area, Length=lng_5)
supply_air_temperature_sat_c = Panel("12.8")
specific_heat_capacity_kj_kg_c = Panel("1.006")
air_density_kg_m3 = Panel("1.202")
expression = Expression(
    Air_person=fresh_air_per_person,
    Air_area=fresh_air_per_area,
    Occupancy=occupancy,
    Area=repeat_3,
    Expression="((Occupancy*Area)*Air_person)+(Air_area*Area)")
subtraction = Subtraction(A=heating_setpoint, B=supply_air_temperature_sat_c)
subtraction_2 = Subtraction(A=cooling_setpoint, B=supply_air_temperature_sat_c)
expression_2 = Expression(
    H_heat=division_9,
    Cp=specific_heat_capacity_kj_kg_c,
    rho=air_density_kg_m3,
    dt=subtraction,
    Expression="(H_heat/(Cp*rho*dt))*1000")
expression_3 = Expression(
    H_cool=division_10,
    Cp=specific_heat_capacity_kj_kg_c,
    rho=air_density_kg_m3,
    dt=subtraction_2,
    Expression="(H_cool/(Cp*rho*dt))*1000")
heating_flow_rate_l_s = Panel(expression_2)
oa_flow_rate_l_s = Panel(expression)
cooling_flow_rate_l_s = Panel(expression_3)
max = Maximum(A=expression_2, B=expression_3)

xyplot = XYPlot(
    Type=2,
    Width=1100,
    Height=800,
    Title="Annual Energy Use Breakdown for HVAC System Options",
    Y_title="Annual Energy Consumption (kWh)",
    X_labels=panel_2,
    X_rot=0,
    Y_data=merge_4,
    Colors=merge,
    Names=merge_2,
    Domain=Domain(0, 6),
    Show_xgrid=False,
    Show_ygrid=True,
    Legend=0)

# ----
# Adjust energy consumption for different HVAC system and output all metrics after first simulation.
ma_8 = MassAddition(Input=max)  # -> Result, PartialResults
ma_9 = MassAddition(Input=expression)  # -> Result, PartialResults
electricity = Data(flatten(ma_7.Result))
gas = Data(flatten(branch_2))
elec_use = Data(electricity)
gas_use = Data(gas)
price = Panel("""270
350
400
320
410
480""")
addition = Addition(A=electricity, B=gas)
axb = Multiplication(RATE=item_41, B=elec_use)  # -> simplify(graft(Result))
multiplication = Multiplication(RATE=item_39, B=gas_use)  # -> simplify(graft(Result))
multiplication_2 = Multiplication(RATE=item_42, B=elec_use)  # -> simplify(graft(Result))
multiplication_3 = Multiplication(RATE=item_40, B=gas_use)  # -> simplify(graft(Result))
ma_10 = MassAddition(Input=[axb, multiplication])  # -> Result, PartialResults
ma_11 = MassAddition(Input=[multiplication_2, multiplication_3])  # -> Result, PartialResults
python_3 = GhPythonScript(x=ma_10.Result)  # -> a
# ---------- python_3: Python ----------
__author__ = "airan"
__version__ = "2022.10.24"

import rhinoscriptsyntax as rs

import math as m

a = round(x,-2)
# ---------- end python_3 ----------
python_4 = GhPythonScript(x=ma_11.Result)  # -> a; same code as python_3
division_11 = Division(A=python_3, B=1000)
division_12 = Division(A=python_4, B=1000)
concat_9 = Concatenate(FragmentA=division_11, FragmentB="k")
concat_10 = Concatenate(FragmentA="$", FragmentB=division_12, FragmentC="k")
operating_carbon = ExplodeTree(Data=concat_9)  # -> Branch0, Branch1, Branch2, Branch3, Branch4, Branch5
operating_cost = ExplodeTree(Data=concat_10)  # -> Branch0, Branch1, Branch2, Branch3, Branch4, Branch5

panel_9 = Panel(operating_carbon.Branch0)
panel_10 = Panel(operating_cost.Branch0)
panel_11 = Panel(operating_carbon.Branch1)
panel_12 = Panel(operating_cost.Branch1)
panel_13 = Panel(operating_cost.Branch2)
panel_14 = Panel(operating_carbon.Branch2)
panel_15 = Panel(operating_cost.Branch3)
panel_16 = Panel(operating_carbon.Branch3)
panel_17 = Panel(operating_cost.Branch4)
panel_20 = Panel(operating_cost.Branch5)

sorted_floorplate_geometry = Surface(item_11)
join_5 = JoinCurves(Curves=sorted_floorplate_edge_curve, Preserve=False)  # -> simplify(Curves)
area_8 = Area(Geometry=flatten(sorted_floorplate_geometry))  # -> Area, Centroid
ma_12 = MassAddition(Input=area_8.Area)  # -> Result, PartialResults
xy = XYPlane(Origin=area_8.Centroid)
edges_4 = BrepEdges(Brep=sorted_floorplate_geometry)  # -> Naked, Interior, NonManifold
join_6 = JoinCurves(Curves=edges_4.Naked, Preserve=False)
len_2 = Length(Curve=join_6)
sort_10 = SortList(Keys=len_2, ValuesA=join_6)  # -> reverse(Keys), reverse(ValuesA)
item_46 = ListItem(List=sort_10.ValuesA, Index=0, Wrap=True)  # -> flatten(Item)
midpt = CurveMiddle(Curve=item_46)
midpt_2 = CurveMiddle(Curve=item_12)
pdecon_3 = Deconstruct(Point=midpt)  # -> XComponent, YComponent, ZComponent
pdecon_4 = Deconstruct(Point=midpt_2)  # -> XComponent, YComponent, flatten(ZComponent)
subtraction_3 = Subtraction(A=pdecon_4.ZComponent, B=pdecon_3.ZComponent)
python_5 = GhPythonScript(x=subtraction_3)  # -> a; same code as python
Z = UnitZ(Factor=python_5)
join_7 = JoinCurves(Curves=corridor_centerline, Preserve=False)
midpt_3 = CurveMiddle(Curve=join_7)
pdecon_5 = Deconstruct(Point=midpt_3)  # -> XComponent, YComponent, ZComponent
cset_3 = CreateSet(List=pdecon_5.ZComponent)  # -> Set, Map
mindex_2 = MemberIndex(Set=pdecon_5.ZComponent, Member=cset_3.Set)  # -> Index, Count
item_47 = ListItem(List=join_7, Index=mindex_2.Index, Wrap=True)

area_9 = Data(ma_12.Result)
division_13 = Division(A=graft(addition), B=graft(area_9))  # -> simplify(Result)
multiplication_4 = Multiplication(A=ma_12.Result, B=graft(price))
python_6 = GhPythonScript(x=multiplication_4)  # -> a
# ---------- python_6: Python ----------
__author__ = "airan"
__version__ = "2022.10.24"

import rhinoscriptsyntax as rs

import math as m

a = round(x,-3)
# ---------- end python_6 ----------
python_7 = GhPythonScript(x=division_13)  # -> a
# ---------- python_7: Python ----------
__author__ = "airan"
__version__ = "2022.10.24"

import rhinoscriptsyntax as rs

import math as m

a = round(x,0)
# ---------- end python_7 ----------
division_14 = Division(A=python_6, B=1000)
concat_11 = Concatenate(FragmentA="$", FragmentB=division_14, FragmentC="k")
first_cost = ExplodeTree(Data=concat_11)  # -> Branch0, Branch1, Branch2, Branch3, Branch4, Branch5
eui = ExplodeTree(Data=python_7)  # -> Branch0, Branch1, Branch2, Branch3, Branch4, Branch5

panel_21 = Panel(eui.Branch0)
panel_22 = Panel(first_cost.Branch0)
panel_23 = Panel(eui.Branch1)
panel_24 = Panel(first_cost.Branch1)
panel_25 = Panel(eui.Branch2)
panel_26 = Panel(first_cost.Branch2)
panel_27 = Panel(eui.Branch3)
panel_28 = Panel(first_cost.Branch3)
panel_29 = Panel(eui.Branch4)
panel_30 = Panel(first_cost.Branch4)
panel_31 = Panel(eui.Branch5)
panel_32 = Panel(first_cost.Branch5)

air_velocity = ValueList({"1 m/s or 200 fpm": 1, "2 m/s or 400 fpm": 2, "4 m/s or 750 fpm": 4, "8 m/s or 1500 fpm": 8, "16 m/s or 3000 fpm": 16}, selected="4 m/s or 750 fpm")
# Draw primary loop duct for the supply air.
safety_factor = Panel("1.0")

floor_by_floor_airflow = Expression(Flowrate=ma_8.Result, Airspeed=air_velocity, SF=safety_factor, Expression="Flowrate/1000/Airspeed*SF")
floor_by_floor_airflow_2 = Expression(Flowrate=ma_9.Result, Airspeed=air_velocity, SF=safety_factor, Expression="Flowrate/1000/Airspeed*SF")
ma_13 = MassAddition(Input=flatten(floor_by_floor_airflow_2))  # -> Result, PartialResults
ma_14 = MassAddition(Input=flatten(floor_by_floor_airflow))  # -> Result, PartialResults
entwine_6 = Entwine(
    Branch00=ma_14.Result,
    Branch01=ma_14.Result,
    Branch02=ma_14.Result,
    Branch03=ma_13.Result,
    Branch04=ma_13.Result,
    Branch05=ma_13.Result,
    FlattenInputs=True)
multiplication_5 = Multiplication(A=entwine_6, B=2)
python_8 = GhPythonScript(x=multiplication_5)  # -> a
# ---------- python_8: Python ----------
__author__ = "airan"
__version__ = "2022.10.24"

import rhinoscriptsyntax as rs

import math as m

a = round(x,2)
# ---------- end python_8 ----------
area_requirements = ExplodeTree(Data=simplify(python_8))  # -> Branch0, Branch1, Branch2, Branch3, Branch4, Branch5

panel_33 = Panel(area_requirements.Branch0)
panel_34 = Panel(area_requirements.Branch1)
panel_35 = Panel(area_requirements.Branch2)
panel_36 = Panel(area_requirements.Branch3)
panel_37 = Panel(area_requirements.Branch4)
panel_38 = Panel(area_requirements.Branch5)

area_10 = Area(Geometry=flatten(sorted_floorplate_geometry))  # -> Area, Centroid
pdecon_6 = Deconstruct(Point=area_10.Centroid)  # -> XComponent, YComponent, ZComponent
sort_11 = SortList(Keys=pdecon_6.ZComponent, ValuesA=area_10.Centroid)  # -> Keys, ValuesA
item_48 = ListItem(List=sort_11.ValuesA, Index=0, Wrap=True)
expression_4 = Expression(x=ma_12.Result, Expression="(x*10.76/58)^1.087*1.25")
expression_5 = Expression(x=ma_12.Result, Expression="(x*10.76/69.2)^1.053")
pt = Point(riser_points_on_roof)
pt_2 = Point(item_48)
division_15 = Division(A=expression_4, B=10.76)
align = AlignPlanes(Planes=pt)
division_16 = Division(A=expression_5, B=10.76)
sqrt = SquareRoot(Value=division_16)
division_17 = Division(A=sqrt, B=2)
neg = Negative(Value=division_17)
dom = ConstructDomain(DomainStart=neg, DomainEnd=division_17)
Z_2 = UnitZ(Factor=2)
align_2 = AlignPlanes(Planes=pt_2)
rectangle = Rectangle(Plane=align_2, XSize=dom, YSize=dom, Radius=0)  # -> Rectangle, Length
Z_3 = UnitZ(Factor=-2)
number_slider_3 = Slider(0.7, range=0..10)
extr = Extrude(Base=rectangle.Rectangle, Direction=Z_3)
cap = CapHoles(Brep=extr)

scale_nu = ScaleNU(Geometry=cap, Plane=align_2, ScaleX=number_slider, ScaleY=number_slider, ScaleZ=1)  # -> Geometry, Transform
scale_nu_2 = ScaleNU(Geometry=cap, Plane=align_2, ScaleX=number_slider_2, ScaleY=number_slider_2, ScaleZ=1)  # -> Geometry, Transform

pdecon_7 = Deconstruct(Point=riser_points_on_roof)  # -> XComponent, YComponent, ZComponent
Z_4 = UnitZ(Factor=-1)
# Draw supply air riser and return air riser.
cset_4 = CreateSet(List=Z)  # -> Set, Map
line = LineSDL(Start=riser_points_on_roof, Direction=Z_4, Length=pdecon_7.ZComponent)
split_17 = SplitWithBreps(Curve=line, Brep=flatten(sorted_floorplate_geometry))  # -> Curve, Points
lng_6 = ListLength(List=flatten(Z))
repeat_4 = RepeatData(Data=cset_4.Set, Length=lng_6)
move = Move(Geometry=graft(split_17.Points), Motion=graft(repeat_4))  # -> Geometry, Transform
item_49 = ListItem(List=move.Geometry, Index=0, Wrap=True)  # -> Item, Item1
smaller = SmallerThan(FirstNumber=item_49.Item, SecondNumber=item_49.Item1)  # -> SmallerThan, OrEqualTo
midpt_4 = CurveMiddle(Curve=split_17.Curve)
lng_7 = ListLength(List=line)
p_n_c = PickNChoose(Pattern=smaller.SmallerThan, Stream0=item_49.Item1, Stream1=item_49.Item)
pdecon_8 = Deconstruct(Point=midpt_4)  # -> XComponent, YComponent, ZComponent
end = EndPoints(Curve=split_17.Curve)  # -> Start, End
pdecon_9 = Deconstruct(Point=p_n_c)  # -> XComponent, YComponent, ZComponent
sort_12 = SortList(Keys=flatten(pdecon_8.ZComponent), ValuesA=flatten(split_17.Curve), ValuesB=flatten(end.Start))  # -> Keys, ValuesA, ValuesB
sort_13 = SortList(Keys=flatten(pdecon_9.ZComponent), ValuesA=flatten(p_n_c), ValuesB=flatten(p_n_c))  # -> Keys, ValuesA, ValuesB
partition_3 = PartitionList(List=sort_12.ValuesA, Size=lng_7)
partition_4 = PartitionList(List=sort_12.ValuesB, Size=lng_7)
partition_5 = PartitionList(List=sort_13.ValuesA, Size=lng_7)  # -> simplify(Chunks)
crv_cp = CurveClosestPoint(Point=graft(partition_5), Curve=simplify(flatten(item_47)))  # -> Point, Parameter, Distance
xy_2 = XYPlane(Origin=partition_4)
abs_2 = Absolute(Value=item_13)
vec = VectorXYZ(XComponent=1, YComponent=0, ZComponent=0)  # -> Vector, Length
angle = Angle(VectorA=abs_2, VectorB=vec.Vector, Plane=xy_2)  # -> Angle, Reflex
cset_5 = CreateSet(List=angle.Angle)  # -> Set, Map
sort_14 = SortList(Keys=cset_5.Set)  # -> Keys, ValuesA
item_50 = ListItem(List=sort_14.Keys, Index=0, Wrap=True)
prot = RotatePlane(Plane=xy_2, Angle=item_50)
pln = Plane(prot)
alternate_return_air_riser_location = Slider(0, range=0..3)

division_18 = Division(A=division_15, B=lng_7)
sqrt_2 = SquareRoot(Value=division_18)
division_19 = Division(A=sqrt_2, B=2)
neg_2 = Negative(Value=division_19)
dom_2 = ConstructDomain(DomainStart=neg_2, DomainEnd=division_19)
rectangle_2 = Rectangle(Plane=align, XSize=dom_2, YSize=dom_2, Radius=0)  # -> Rectangle, Length
extr_2 = Extrude(Base=rectangle_2.Rectangle, Direction=Z_2)
cap_2 = CapHoles(Brep=extr_2)
scale_nu_3 = ScaleNU(Geometry=cap_2, Plane=pt, ScaleX=number_slider_3, ScaleY=number_slider_3, ScaleZ=1)  # -> Geometry, Transform
filter = StreamFilter(
    Gate=list,
    Stream0=cap,
    Stream1=scale_nu.Geometry,
    Stream2=scale_nu_2.Geometry,
    Stream3=cap,
    Stream4=scale_nu.Geometry,
    Stream5=scale_nu_2.Geometry)
filter_2 = StreamFilter(
    Gate=list,
    Stream0=cap_2,
    Stream1=cap_2,
    Stream2=scale_nu_3.Geometry,
    Stream3=cap_2,
    Stream4=cap_2,
    Stream5=scale_nu_3.Geometry)

sort_15 = SortList(Keys=crv_cp.Distance, ValuesA=crv_cp.Point)  # -> Keys, ValuesA
item_51 = ListItem(List=sort_15.ValuesA, Index=0, Wrap=True)
ln = Line(StartPoint=item_51, EndPoint=simplify(graft(partition_4)))

mechanical_rooms = Brep([filter_2, filter])

preview = CustomPreview(Geometry=mechanical_rooms, Material=ColourSwatch(SwatchColor=RGBA(255, 0, 0, 200)))

dispatch_4 = Dispatch(List=sorted_zone_floorplate_edge_curve, DispatchPattern=tmatch)  # -> ListA, ListB
area_11 = Area(Geometry=[dispatch_4.ListB, dispatch_4.ListA])  # -> Area, Centroid
Z_5 = UnitZ(Factor=python_5)
cset_6 = CreateSet(List=Z_5)  # -> Set, Map
# Draw branch ducts to each thermal zone as well as air diffusers at the end of the branch into the zone.
item_52 = ListItem(List=item_13, Index=mindex.Index, Wrap=True)
move_2 = Move(Geometry=area_11.Centroid, Motion=graft(cset_6.Set))  # -> Geometry, Transform
incurves = PointInCurves(Point=move_2.Geometry, Curves=join_5)  # -> Relationship, Index, Point
crv_cp_2 = CurveClosestPoint(Point=move_2.Geometry, Curve=reverse(item_47))  # -> Point, Parameter, Distance
crv_cp_3 = CurveClosestPoint(Point=move_2.Geometry, Curve=item_47)  # -> Point, Parameter, Distance
equals = Equality(FirstNumber=incurves.Relationship, SecondNumber=0)  # -> Equality, Inequality
larger_2 = LargerThan(FirstNumber=crv_cp_3.Distance, SecondNumber=crv_cp_2.Distance)  # -> LargerThan, OrEqualTo
tstat_2 = TreeStatistics(Tree=item_52)  # -> Paths, Length, Count
p_n_c_2 = PickNChoose(Pattern=larger_2.LargerThan, Stream0=crv_cp_3.Point, Stream1=crv_cp_2.Point)
dispatch_5 = Dispatch(List=p_n_c_2, DispatchPattern=equals.Inequality)  # -> ListA, ListB
partition_6 = PartitionList(List=move_2.Geometry, Size=tstat_2.Length)  # -> simplify(Chunks)
partition_7 = PartitionList(List=dispatch_5.ListA, Size=tstat_2.Length)  # -> simplify(Chunks)
xy_3 = XYPlane(Origin=Point(0, 0, 0))
Z_6 = UnitZ(Factor=0.3)
neg_3 = Negative(Value=Z_6)
dom_3 = ConstructDomain(DomainStart="-0.1", DomainEnd="0.1")
number_slider_4 = Slider(1.5, range=0..2)

ln_2 = Line(StartPoint=partition_6, EndPoint=partition_7)
path_mapper = PathMapper(partition_7, source="{path_index}", target="{path_count - path_index - 1}")
len_3 = Length(Curve=ln_2)

# ----
# FCU
# VRF
# VAV
panel_39 = Panel("800x400x150")
# Draw terminal zone equipment including FAN COIL UNITS, VRF CASSETTES, and VAV BOXES.
debrep_4 = DeconstructBrep(Brep=dispatch_2.ListB)  # -> Faces, Edges, Vertices
area_12 = Area(Geometry=debrep_4.Faces)  # -> Area, Centroid
split_18 = TextSplit(Text=panel_39, Separators="x")
split_19 = TextSplit(Text="200x200x700", Separators="x")
sort_16 = SortList(Keys=area_12.Area, ValuesA=area_12.Centroid)  # -> Keys, ValuesA
sort_17 = SortList(Keys=area_12.Area, ValuesA=debrep_4.Faces)  # -> Keys, ValuesA
division_20 = Division(A=split_18, B=1000)
division_21 = Division(A=split_19, B=1000)
item_53 = ListItem(List=sort_17.ValuesA, Index=0, Wrap=True)
item_54 = ListItem(List=sort_16.ValuesA, Index=0, Wrap=True)
item_55 = ListItem(List=division_20, Index=0, Wrap=True)  # -> Item, Item1, Item2
item_56 = ListItem(List=division_21, Index=0, Wrap=True)  # -> Item, Item1, Item2
devec_4 = DeconstructVector(Vector=item_54)  # -> XComponent, YComponent, ZComponent
sort_18 = SortList(Keys=flatten(devec_4.ZComponent))  # -> Keys, ValuesA
panel_40 = Panel("""0
0
0
1
1
1""")
panel_41 = Panel("""0
0
0
1
1
1""")
Z_7 = UnitZ(Factor=item_55.Item1)
item_57 = ListItem(List=sort_18.Keys, Index=0, Wrap=True)
addition_2 = Addition(A=2.5, B=item_57)
item_58 = ListItem(List=panel_40, Index=list, Wrap=True)
item_59 = ListItem(List=panel_41, Index=list, Wrap=True)
neg_4 = Negative(Value=item_57)
Z_8 = UnitZ(Factor=neg_4)
move_3 = Move(Geometry=item_54, Motion=Z_8)  # -> Geometry, Transform
evalsrf_3 = EvaluateSurface(Surface=item_53, Point="0.5,0.5")  # -> Point, Normal, UDirection, VDirection, Frame
pl = PlaneNormal(Origin=move_3.Geometry, ZAxis=evalsrf_3.Normal)
xz = XZPlane(Origin=Point(0, 0, 0))
align_3 = AlignPlanes(Planes=pl, Master=xz)
box = CenterBox(Base=align_3, X=item_55.Item, Y=item_55.Item1, Z=item_55.Item2)
box_2 = CenterBox(Base=align_3, X=item_56.Item2, Y=item_56.Item, Z=item_56.Item1)
move_4 = Move(Geometry=box, Motion=Z_7)  # -> Geometry, Transform
neg_5 = Negative(Value=Z)
Z_9 = UnitZ(Factor=duct_height_m)

filter_3 = StreamFilter(Gate=item_58, Stream0=max, Stream1=expression)
ma_15 = MassAddition(Input=filter_3)  # -> Result, PartialResults
zone_by_zone_airflow = Expression(Flowrate=filter_3, Airspeed=air_velocity, SF=safety_factor, Expression="Flowrate/1000/Airspeed*SF")
# Utilize airflow rate from energy model to calculate overall supply air duct dimension and dimensions of individual zone branches.
division_22 = Division(A=zone_by_zone_airflow, B=zone_branch_duct_aspect_ratio)
floor_by_floor_airflow_3 = Expression(Flowrate=ma_15.Result, Airspeed=air_velocity, SF=safety_factor, Expression="Flowrate/1000/Airspeed*SF")
division_23 = Division(A=floor_by_floor_airflow_3, B=main_supply_duct_aspect_ratio)
sqrt_3 = SquareRoot(Value=division_23)
sqrt_4 = SquareRoot(Value=division_22)
division_24 = Division(A=floor_by_floor_airflow_3, B=sqrt_3)
division_25 = Division(A=zone_by_zone_airflow, B=sqrt_4)
python_9 = GhPythonScript(x=division_24)  # -> a
# ---------- python_9: Python ----------
__author__ = "airan"
__version__ = "2022.10.24"

import rhinoscriptsyntax as rs

import math as m

a = round(x,1)
# ---------- end python_9 ----------
python_10 = GhPythonScript(x=sqrt_3)  # -> a; same code as python_9
python_11 = GhPythonScript(x=division_25)  # -> a; same code as python_9
python_12 = GhPythonScript(x=sqrt_4)  # -> a; same code as python_9
multiplication_6 = Multiplication(A=python_9, B=1000)
multiplication_7 = Multiplication(A=python_10, B=1000)
concat_12 = Concatenate(FragmentA=multiplication_6, FragmentB=" x ", FragmentC=multiplication_7)  # -> flatten(Result)
panel_42 = Panel(python_9)

x_dim_floor = Data(python_9)
y_dim_floor = Data(python_10)
division_26 = Division(A=x_dim_floor, B=-2)
division_27 = Division(A=x_dim_floor, B=2)
division_28 = Division(A=y_dim_floor, B=-2)
division_29 = Division(A=y_dim_floor, B=2)
offset = OffsetCurve(Curve=flatten(item_47), Distance=flatten(division_26), Plane=xy, Corners=join_7)
offset_2 = OffsetCurve(Curve=flatten(item_47), Distance=flatten(division_27), Plane=xy, Corners=1)
rulesrf = RuledSurface(CurveA=offset, CurveB=offset_2)
Z_10 = UnitZ(Factor=division_28)
move_5 = Move(Geometry=rulesrf, Motion=Z_10)  # -> Geometry, Transform
Z_11 = UnitZ(Factor=division_29)
multiplication_8 = Multiplication(A=Z_11, B=2)
extr_3 = Extrude(Base=move_5.Geometry, Direction=flatten(multiplication_8))

Z_12 = UnitZ(Factor=addition_2)

ln_3 = Line(StartPoint=partition_6, EndPoint=path_mapper)
y_dim_floor_2 = Data(python_12)
x_dim_floor_2 = Data(python_11)
divide = DivideCurve(Curve=ln_3, Count=1, Kinks=False)  # -> Points, Tangents, Parameters
division_30 = Division(A=x_dim_floor_2, B=-2)
division_31 = Division(A=x_dim_floor_2, B=2)
division_32 = Division(A=y_dim_floor_2, B=-2)
division_33 = Division(A=y_dim_floor_2, B=2)
item_60 = ListItem(List=divide.Points, Index=-2, Wrap=True)
xy_4 = XYPlane(Origin=item_60)
Z_13 = UnitZ(Factor=division_32)
Z_14 = UnitZ(Factor=division_33)
rectangle_3 = Rectangle(Plane=xy_4, XSize=dom_3, YSize=dom_3, Radius=0)  # -> Rectangle, Length
multiplication_9 = Multiplication(A=Z_14, B=2)
move_6 = Move(Geometry=rectangle_3.Rectangle, Motion=neg_3)  # -> Geometry, Transform
extr_4 = Extrude(Base=rectangle_3.Rectangle, Direction=neg_3)
scale_nu_4 = ScaleNU(Geometry=move_6.Geometry, Plane=xy_4, ScaleX=number_slider_4, ScaleY=number_slider_4, ScaleZ=1)  # -> Geometry, Transform
extr_5 = ExtrudePoint(Base=scale_nu_4.Geometry, Point=xy_4)
cap_3 = CapHoles(Brep=extr_5)
sunion_2 = SolidUnion(Breps=[extr_4, cap_3])

len_4 = Length(Curve=ln_3)
larger_3 = LargerThan(FirstNumber=len_4, SecondNumber=len_3)  # -> LargerThan, OrEqualTo
p_n_c_3 = PickNChoose(Pattern=larger_3.LargerThan, Stream0=ln_3, Stream1=ln_2)

move_7 = Move(Geometry=box_2, Motion=Z_12)  # -> Geometry, Transform
midpt_5 = CurveMiddle(Curve=p_n_c_3)
box_3 = CenterBox(Base=midpt_5, X="0.25", Y="0.25", Z="0.25")
move_8 = Move(Geometry=box_3, Motion=neg_5)  # -> Geometry, Transform
move_9 = Move(Geometry=move_8.Geometry, Motion=Z_9)  # -> Geometry, Transform
filter_4 = StreamFilter(Gate=item_59, Stream0=move_9.Geometry, Stream1=move_4.Geometry)

panel_43 = Panel(larger_3.LargerThan)

offset_3 = OffsetCurve(Curve=p_n_c_3, Distance=division_31, Plane=xy_3, Corners=1)
offset_4 = OffsetCurve(Curve=p_n_c_3, Distance=division_30, Plane=xy_3, Corners=1)
rulesrf_2 = RuledSurface(CurveA=offset_4, CurveB=offset_3)
move_10 = Move(Geometry=flatten(rulesrf_2), Motion=flatten(Z_13))  # -> Geometry, Transform
extr_6 = Extrude(Base=move_10.Geometry, Direction=multiplication_9)

ma_16 = MassAddition(Input=flatten(floor_by_floor_airflow_3))  # -> Result, PartialResults
division_34 = Division(A=ma_16.Result, B=1)
sqrt_5 = SquareRoot(Value=division_34)
division_35 = Division(A=ma_16.Result, B=sqrt_5)
lng_8 = ListLength(List=ln)
python_13 = GhPythonScript(x=sqrt_5)  # -> a; same code as python_9
python_14 = GhPythonScript(x=division_35)  # -> a; same code as python_9
y_dim_floor_3 = Data(python_13)
x_dim_floor_3 = Data(python_14)
division_36 = Division(A=x_dim_floor_3, B=-2)
division_37 = Division(A=x_dim_floor_3, B=2)
division_38 = Division(A=y_dim_floor_3, B=-2)
division_39 = Division(A=y_dim_floor_3, B=2)
division_40 = Division(A=division_38, B=lng_8)
division_41 = Division(A=division_39, B=lng_8)
division_42 = Division(A=division_36, B=lng_8)
division_43 = Division(A=division_37, B=lng_8)
multiplication_10 = Multiplication(A=y_dim_floor_3, B=1.5)
dom_4 = ConstructDomain(DomainStart=division_40, DomainEnd=division_41)
dom_5 = ConstructDomain(DomainStart=division_42, DomainEnd=division_43)
rectangle_4 = Rectangle(Plane=pln, XSize=dom_5, YSize=dom_4, Radius=0)  # -> Rectangle, Length
extrcrv = ExtrudeAlong(Base=rectangle_4.Rectangle, Curve=partition_3)
cap_4 = CapHoles(Brep=flatten(extrcrv))
sunion_3 = SolidUnion(Breps=cap_4)
X = UnitX(Factor=multiplication_10)
Y = UnitY(Factor=multiplication_10)
volume = Volume(Geometry=sunion_3)  # -> Volume, Centroid
scale_nu_5 = ScaleNU(Geometry=sunion_3, Plane=volume.Centroid, ScaleX=0.75, ScaleY=0.75, ScaleZ=1)  # -> Geometry, Transform
move_11 = Move(Geometry=graft(scale_nu_5.Geometry), Motion=[X, Y])  # -> Geometry, Transform
colom = CollisionOneMany(Collider=move_11.Geometry, Obstacles=flatten(extr_6))  # -> Collision, Index
dispatch_6 = Dispatch(List=move_11.Geometry, DispatchPattern=colom.Collision)  # -> ListA, ListB
item_61 = ListItem(List=dispatch_6.ListB, Index=alternate_return_air_riser_location, Wrap=True)

# ----
# Draw branch ducts from the supply air riser to the main supply air duct in every floor.
x_dim_floor_4 = Data(python_9)
y_dim_floor_4 = Data(python_10)
division_44 = Division(A=x_dim_floor_4, B=-2)
division_45 = Division(A=x_dim_floor_4, B=2)
division_46 = Division(A=y_dim_floor_4, B=-2)
division_47 = Division(A=y_dim_floor_4, B=2)
division_48 = Division(A=division_46, B=lng_8)
division_49 = Division(A=division_47, B=lng_8)
division_50 = Division(A=division_44, B=lng_8)
division_51 = Division(A=division_45, B=lng_8)
offset_5 = OffsetCurve(Curve=ln, Distance=division_51, Corners=1)
offset_6 = OffsetCurve(Curve=ln, Distance=division_50, Corners=1)
rulesrf_3 = RuledSurface(CurveA=offset_6, CurveB=offset_5)  # -> flatten(Surface)
partition_8 = PartitionList(List=rulesrf_3, Size=lng_7)
Z_15 = UnitZ(Factor=division_48)
Z_16 = UnitZ(Factor=division_49)
extr_7 = Extrude(Base=partition_8, Direction=Z_15)
extr_8 = Extrude(Base=partition_8, Direction=Z_16)
sunion_4 = SolidUnion(Breps=[extr_7, extr_8])

neg_6 = Negative(Value=Z)
Z_17 = UnitZ(Factor=duct_height_m)
neg_7 = Negative(Value=Z)
Z_18 = UnitZ(Factor=duct_height_m)
neg_8 = Negative(Value=Z)
Z_19 = UnitZ(Factor=duct_height_m)
move_12 = Move(Geometry=[extr_3, sunion_4], Motion=neg_6)  # -> Geometry, Transform
move_13 = Move(Geometry=extr_6, Motion=neg_7)  # -> Geometry, Transform
move_14 = Move(Geometry=sunion_2, Motion=neg_8)  # -> Geometry, Transform
move_15 = Move(Geometry=move_12.Geometry, Motion=Z_17)  # -> Geometry, Transform
move_16 = Move(Geometry=move_13.Geometry, Motion=Z_18)  # -> Geometry, Transform
move_17 = Move(Geometry=move_14.Geometry, Motion=Z_19)  # -> Geometry, Transform

supply_air_riser = Brep(scale_nu_5.Geometry)
zone_supply_air_branch = Brep(move_16.Geometry)
terminal_equipment = Brep([move_17.Geometry, filter_4])
supply_air_main_duct = Brep(move_15.Geometry)
return_air_riser = Brep(item_61)

preview_2 = CustomPreview(
    Geometry=[supply_air_main_duct, supply_air_riser, zone_supply_air_branch],
    Material=ColourSwatch(SwatchColor=RGBA(0, 55, 255, 200)))
preview_3 = CustomPreview(Geometry=return_air_riser, Material=ColourSwatch(SwatchColor=RGBA(242, 255, 0, 200)))
preview_4 = CustomPreview(Geometry=terminal_equipment, Material=ColourSwatch(SwatchColor=RGBA(255, 123, 0, 200)))
